# Grasshopper definition Final.gh (Grasshopper 1.0.7)
# plug-ins: SpacePartition, Human, PTComponentLibrary, MetaHopper, SpaceSyntaxDesign_GH

# ---- group: InputData / Labels
txt = Text(Tree({0;0}: ["Unidades sanitarias mujeres / privadas"], {0;1}: ["Unidades sanitarias hombres / privadas"], {0;2}: ["Cuarto de aseo "], {0;3}: ["Área de aseo de residuos"], {0;4}: ["Almacen General Insumos de Aseo "], {0;5}: ["Área de UPC-Rack"]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))

# ---- group: InputData / Topology
int = Integer(Tree({0}: [7], {1}: [7], {2}: [3], {3}: [2, 11], {4}: [16, 21, 19], {5}: [19]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))

# ---- group: InputData / ID
txt_2 = Text(Tree({0;0}: ["5"], {0;1}: ["5"], {0;2}: ["5"], {0;3}: ["5"], {0;4}: ["5"], {0;5}: ["5"]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))

# ---- group: InputData / Areas
txt_3 = Text(Tree({0;0}: ["3"], {0;1}: ["3"], {0;2}: ["6"], {0;3}: ["1"], {0;4}: ["5"], {0;5}: ["4"]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))

# ---- group: InputData
number_slider = Slider(1, range=0..10)
path_mapper = PathMapper(txt, source="{A;B}", target="{A}")
path_mapper_2 = PathMapper(txt_3, source="{A;B}", target="{A}")
path_mapper_3 = PathMapper(int, source="{A;B}", target="{A}")
path_mapper_4 = PathMapper(txt_2, source="{A;B}", target="{A}")
prunebranches = CSharpScript(branches=path_mapper, howMany=number_slider)  # -> prunedTree, branchCounter; inputs branches: tree of String, howMany: Int32
# ---------- prunebranches: C# ----------
    var treeOut = new DataTree<string>();

    for( int i = 0; i < branches.BranchCount - howMany; ++i )
      treeOut.AddRange(branches.Branch(i), new GH_Path(i));

    prunedTree = treeOut;
    branchCounter = treeOut.BranchCount;
# ---------- end prunebranches ----------
prunebranches_2 = CSharpScript(branches=path_mapper_2, howMany=number_slider)  # -> prunedTree, branchCounter; inputs branches: tree of String, howMany: Int32; same code as prunebranches
ma = MassAddition(Input=prunebranches_2.prunedTree)  # -> Result, PartialResults
flatten = FlattenTree(Tree=prunebranches_2.prunedTree, Path="{0}")
lng = ListLength(List=flatten)
int_2 = Integer(Slider(4, range=0..10))

# ---- group: Grid / Controllers
number_slider_2 = Slider(20.818, range=0..21)
number_slider_3 = Slider(4.392, range=0..5)

# ---- group: Voronoi
number_slider_4 = Slider(0, range=0..0.1)
subtraction = Subtraction(A=Slider(1, range=0..1), B=number_slider_4)
dom = ConstructDomain(DomainStart=number_slider_4, DomainEnd=subtraction)

# ---- group: Grid
dom_2 = ConstructDomain(DomainStart=expr("-x", number_slider_2), DomainEnd=number_slider_2)
dom_3 = ConstructDomain(DomainStart=expr("-x", number_slider_3), DomainEnd=number_slider_3)
pt = Point(Point(-27.55069635, 0.2364199029, 0))
dedomain = DeconstructDomain(Domain=dom_2)  # -> Start, End
rectangle = Rectangle(Plane=pt, XSize=dom_3, YSize=dom_2, Radius=0)  # -> Rectangle, Length

# ----
genemodifier = GenePoolModifier(GeneList="SeedsX", Count=lng, Domain=dom, Randomize=Button(), PercentageOfRandomization=Slider(1, range=0..1))
genemodifier_2 = GenePoolModifier(GeneList="SeedsY", Count=lng, Domain=dom, Randomize=Button(), PercentageOfRandomization=Slider(1, range=0..1))

# ---- group: Labels
bang = ExplodeTree(Data=prunebranches.prunedTree)  # -> Branch0, Branch1, Branch2, Branch3

# ---- group: Areas
bang_2 = ExplodeTree(Data=prunebranches_2.prunedTree)  # -> Branch0, Branch1, Branch2, Branch3

# ---- group: SpacePartition / OriginalSilhouette
crv = Curve(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)

# ---- group: SpacePartition / RandomColourSeed
number_slider_5 = Slider(40, range=0..100)
number_slider_6 = Slider(238, range=0..1000)
number_slider_7 = Slider(326, range=0..1000)

number_slider_8 = Slider(40, range=0..100)
number_slider_9 = Slider(238, range=0..1000)
number_slider_10 = Slider(326, range=0..1000)

number_slider_11 = Slider(40, range=0..100)
number_slider_12 = Slider(238, range=0..1000)
number_slider_13 = Slider(326, range=0..1000)

number_slider_14 = Slider(238, range=0..1000)
number_slider_15 = Slider(40, range=0..100)
number_slider_16 = Slider(326, range=0..1000)

number_slider_17 = Slider(238, range=0..1000)
number_slider_18 = Slider(40, range=0..100)
number_slider_19 = Slider(326, range=0..1000)

# ---- group: SpacePartition
toggle = GroupToggle(ToggleActive=True, ToggleVisible=False)  # disabled
number_slider_20 = Slider(0.9, range=0..1)
subtraction_2 = Subtraction(A=Slider(1, range=0..1), B=number_slider_20)
lng_2 = ListLength(List=flatten(bang_2.Branch1))
dom_4 = ConstructDomain(DomainStart=subtraction_2, DomainEnd=number_slider_20)
lng_3 = ListLength(List=flatten(bang_2.Branch1))
dom_5 = ConstructDomain(DomainStart=0, DomainEnd=1)
genemodifier_3 = GenePoolModifier(GeneList="XT", Count=lng_2, Domain=dom_4, Randomize=Button(), PercentageOfRandomization=Slider(1, range=0..1))
yt = GenePool(Decimals=2, Maximum=0.9, Minimum=0.1, Value=[0.37, 0.8])
xt = GenePool(Decimals=2, Maximum=0.9, Minimum=0.1, Value=[0.9, 0.19])
genemodifier_4 = GenePoolModifier(GeneList="YT", Count=lng_3, Domain=dom_4, Randomize=Button(), PercentageOfRandomization=Slider(1, range=0..1))
pt_2 = ConstructPoint(XCoordinate=xt, YCoordinate=yt, ZCoordinate=0)
number_slider_21 = Slider(0.001, range=0..0.001)
dom_6 = ConstructDomain(DomainStart=Slider(0, range=0..100), DomainEnd=Slider(255, range=0..1000))
number_slider_22 = Slider(241, range=0..255)

toggle_2 = GroupToggle(ToggleActive=True, ToggleVisible=False)  # disabled
number_slider_23 = Slider(0.9, range=0..1)
subtraction_3 = Subtraction(A=Slider(1, range=0..1), B=number_slider_23)
lng_4 = ListLength(List=flatten(bang_2.Branch2))
dom_7 = ConstructDomain(DomainStart=subtraction_3, DomainEnd=number_slider_23)
lng_5 = ListLength(List=flatten(bang_2.Branch2))
dom_8 = ConstructDomain(DomainStart=0, DomainEnd=1)
genemodifier_5 = GenePoolModifier(GeneList="XTh", Count=lng_4, Domain=dom_7, Randomize=Button(), PercentageOfRandomization=Slider(1, range=0..1))
yth = GenePool(Decimals=2, Maximum=0.9, Minimum=0.1, Value=[0.79, 0.46, 0.1, 0.12, 0.44, 0.73, 0.9])
xth = GenePool(Decimals=2, Maximum=0.9, Minimum=0.1, Value=[0.61, 0.9, 0.89, 0.11, 0.41, 0.36, 0.7])
genemodifier_6 = GenePoolModifier(GeneList="YTh", Count=lng_5, Domain=dom_7, Randomize=Button(), PercentageOfRandomization=Slider(1, range=0..1))
pt_3 = ConstructPoint(XCoordinate=xth, YCoordinate=yth, ZCoordinate=0)
number_slider_24 = Slider(0.001, range=0..0.001)
dom_9 = ConstructDomain(DomainStart=Slider(0, range=0..100), DomainEnd=Slider(255, range=0..1000))
number_slider_25 = Slider(241, range=0..255)

toggle_3 = GroupToggle(ToggleActive=True, ToggleVisible=False)  # disabled
number_slider_26 = Slider(0.9, range=0..1)
subtraction_4 = Subtraction(A=Slider(1, range=0..1), B=number_slider_26)
lng_6 = ListLength(List=flatten(bang_2.Branch3))
dom_10 = ConstructDomain(DomainStart=subtraction_4, DomainEnd=number_slider_26)
lng_7 = ListLength(List=flatten(bang_2.Branch3))
dom_11 = ConstructDomain(DomainStart=0, DomainEnd=1)
genemodifier_7 = GenePoolModifier(GeneList="XF", Count=lng_6, Domain=dom_10, Randomize=Button(), PercentageOfRandomization=Slider(1, range=0..1))
yf = GenePool(Decimals=2, Maximum=0.9, Minimum=0.1, Value=[0.9, 0.71, 0.57, 0.76, 0.43, 0.61])
xf = GenePool(Decimals=2, Maximum=0.9, Minimum=0.1, Value=[0.55, 0.42, 0.9, 0.12, 0.5, 0.9])
genemodifier_8 = GenePoolModifier(GeneList="YF", Count=lng_7, Domain=dom_10, Randomize=Button(), PercentageOfRandomization=Slider(1, range=0..1))
pt_4 = ConstructPoint(XCoordinate=xf, YCoordinate=yf, ZCoordinate=0)
number_slider_27 = Slider(0.001, range=0..0.001)
dom_12 = ConstructDomain(DomainStart=Slider(0, range=0..100), DomainEnd=Slider(255, range=0..1000))
number_slider_28 = Slider(241, range=0..255)

toggle_4 = GroupToggle(ToggleActive=True, ToggleVisible=False)  # disabled
number_slider_29 = Slider(0.9, range=0..1)
subtraction_5 = Subtraction(A=Slider(1, range=0..1), B=number_slider_29)
lng_8 = ListLength(List=flatten(ma.Result))
dom_13 = ConstructDomain(DomainStart=subtraction_5, DomainEnd=number_slider_29)
lng_9 = ListLength(List=flatten(ma.Result))
dom_14 = ConstructDomain(DomainStart=0, DomainEnd=1)
genemodifier_9 = GenePoolModifier(GeneList="X", Count=lng_8, Domain=dom_13, Randomize=Button(), PercentageOfRandomization=Slider(1, range=0..1))
X = GenePool(Decimals=3, Maximum=0.9, Minimum=0.1, Value=[0.874, 0.19, 0.594, 0.124])
bbox = BoundingBox(Content=crv, Plane=PlaneXY(0, 0, 0))  # -> Box, Box_2
genemodifier_10 = GenePoolModifier(GeneList="Y", Count=lng_9, Domain=dom_13, Randomize=Button(), PercentageOfRandomization=Slider(1, range=0..1))
Y = GenePool(Decimals=3, Maximum=0.9, Minimum=0.1, Value=[0.159, 0.897, 0.115, 0.601])
ptsrfdomnum = SurfaceDomainNumber(Surface=bbox.Box, UNumber=Slider(2, range=0..100), VNumber=Slider(30, range=0..100))
pt_5 = ConstructPoint(XCoordinate=X, YCoordinate=Y, ZCoordinate=0)
ptborders = GenerateBorders(Grid=ptsrfdomnum, PanelShape=0)  # -> simplify(Border)
evalsrf = EvaluateSurface(Surface=reparameterize(crv), Point=pt_5)  # -> Point, Normal, UDirection, VDirection, Frame
crv_2 = Curve(flatten(ptborders))
item = ListItem(List=crv_2, Index=0, Wrap=True)
area = Area(Geometry=item)  # -> Area, Centroid
multiplication = Multiplication(A=area.Area, B=Slider(0.6, range=0..1))
lng_10 = ListLength(List=flatten(ma.Result))
dom_15 = ConstructDomain(DomainStart=Slider(13, range=0..21), DomainEnd=Slider(17, range=0..30))
srf_cp = SurfaceClosestPoint(Point=evalsrf.Point, Surface=crv)  # -> Point, UVPoint, Distance
voronoi = Voronoi(Points=srf_cp.Point, Boundary=rectangle.Rectangle, BruteForceOverride=False)
genemodifier_11 = GenePoolModifier(GeneList="R", Count=lng_10, Domain=dom_15, Randomize=Button(), PercentageOfRandomization=Slider(1, range=0..1))
R = GenePool(Decimals=3, Maximum=17, Minimum=13, Value=[15.163, 15.568, 15.164, 16.094])
number_slider_30 = Slider(0.001, range=0..0.001)
scale = Scale(Geometry=rectangle.Rectangle, Center=pt, Factor=Slider(3, range=0..10))  # -> Geometry, Transform
multiplication_2 = Multiplication(A=multiplication, B=Slider(2.8, range=0..10))
w_voronoi = WeightedVoronoi(BasePlane=PlaneXY(0, 0, 0), Points=srf_cp.Point, Radii=R, BoundingCurve=scale.Geometry)  # -> AdjacencyGraph, VoronoiCells
crv_3 = Curve(w_voronoi.VoronoiCells)
dom_16 = ConstructDomain(DomainStart=Slider(0, range=0..100), DomainEnd=Slider(255, range=0..1000))
number_slider_31 = Slider(241, range=0..255)

# ----
spacepartition = SpacePartition(VoronoiIn=crv_3, GridIn=crv_2, AreaIn=multiplication, Distance=multiplication_2)

# ---- group: SpacePartition
toggle_5 = GroupToggle(ToggleActive=True, ToggleVisible=False)  # disabled
number_slider_32 = Slider(0.9, range=0..1)
subtraction_6 = Subtraction(A=Slider(1, range=0..1), B=number_slider_32)
lng_11 = ListLength(List=flatten(bang_2.Branch0))
dom_17 = ConstructDomain(DomainStart=subtraction_6, DomainEnd=number_slider_32)
lng_12 = ListLength(List=flatten(bang_2.Branch0))
dom_18 = ConstructDomain(DomainStart=0, DomainEnd=1)
genemodifier_12 = GenePoolModifier(GeneList="XO", Count=lng_11, Domain=dom_17, Randomize=Button(), PercentageOfRandomization=Slider(1, range=0..1))
yo = GenePool(Decimals=2, Maximum=0.9, Minimum=0.1, Value=[0.14, 0.63, 0.86, 0.8, 0.32, 0.76, 0.51, 0.8, 0.23, 0.9])
xo = GenePool(Decimals=2, Maximum=0.9, Minimum=0.1, Value=[0.24, 0.33, 0.66, 0.64, 0.25, 0.71, 0.16, 0.29, 0.86, 0.76])
genemodifier_13 = GenePoolModifier(GeneList="YO", Count=lng_12, Domain=dom_17, Randomize=Button(), PercentageOfRandomization=Slider(1, range=0..1))
pt_6 = ConstructPoint(XCoordinate=xo, YCoordinate=yo, ZCoordinate=0)
dom_19 = ConstructDomain(DomainStart=Slider(0, range=0..100), DomainEnd=Slider(255, range=0..1000))
number_slider_33 = Slider(241, range=0..255)

sortxy = SortPointsXY(Grid=flatten(spacepartition))
pararunion = ParallelRegionUnion(Curves=spacepartition)
missing = MissingGridCells(CulledGrid=flatten(sortxy), OriginalGrid=crv_2)
mgtree = MergeTreeMissing(CulledGrid=pararunion, MissingGridCells=missing)
pararunion_2 = ParallelRegionUnion(Curves=mgtree)
parallelregionintersection = ParallelRegionIntersection(CurvesA=crv, CurvesB=pararunion_2)
lng_13 = ListLength(List=flatten(parallelregionintersection))
random = Random(Range=dom_16, Number=lng_13, Seed=[number_slider_5, number_slider_6, number_slider_7], Integers=True)
bang_3 = ExplodeTree(Data=random)  # -> Branch0, Branch1, Branch2
srf = Surface(parallelregionintersection)
rgb = ColourRGB(Alpha=Slider(10, range=0..10), Red=bang_3.Branch0, Green=bang_3.Branch1, Blue=bang_3.Branch2)
rgb_2 = ColourRGB(
    Alpha=number_slider_31,
    Red=bang_3.Branch0,
    Green=[55, 209, 59, 216, 1, 112, 142, 1, 76, 111, 92, 58, 62, 60, 197, 158, 67, 19, 183, 163, 50, 202, 112, 182, 111],
    Blue=[9, 120, 163, 36, 100, 115, 248, 253, 79, 124, 119, 250, 189, 19, 44, 159, 229, 29, 128, 139, 34, 211, 22, 234, 166])
preview = CustomPreview(Geometry=graft(crv_3), Material=graft(rgb))

# ---- group: Geometry
bang_4 = ExplodeTree(Data=simplify(parallelregionintersection))  # -> Branch0, Branch1, Branch2, Branch3

# ----
crv_4 = Curve(bang_4.Branch1)
crv_5 = Curve(bang_4.Branch2)
crv_6 = Curve(bang_4.Branch0)
bbox_2 = BoundingBox(Content=crv_5, Plane=PlaneXY(0, 0, 0))  # -> Box, Box_2
debrep = DeconstructBrep(Brep=bbox_2.Box)  # -> Faces, Edges, Vertices
crv_7 = Curve(bang_4.Branch3)
join = JoinCurves(Curves=debrep.Edges, Preserve=False)

# ---- group: SpacePartition / OriginalSilhouette
crv_8 = Curve(join)

# ---- group: SpacePartition (continued)
bbox_3 = BoundingBox(Content=crv_8, Plane=PlaneXY(0, 0, 0))  # -> Box, Box_2
ptsrfdomnum_2 = SurfaceDomainNumber(Surface=bbox_3.Box, UNumber=Slider(2, range=0..100), VNumber=Slider(15, range=0..100))
ptborders_2 = GenerateBorders(Grid=ptsrfdomnum_2, PanelShape=0)  # -> simplify(Border)
evalsrf_2 = EvaluateSurface(Surface=reparameterize(crv_8), Point=pt_6)  # -> Point, Normal, UDirection, VDirection, Frame
crv_9 = Curve(flatten(ptborders_2))
item_2 = ListItem(List=crv_9, Index=0, Wrap=True)
area_2 = Area(Geometry=item_2)  # -> Area, Centroid
multiplication_3 = Multiplication(A=area_2.Area, B=Slider(0.6, range=0..1))
srf_cp_2 = SurfaceClosestPoint(Point=evalsrf_2.Point, Surface=crv_8)  # -> Point, UVPoint, Distance
voronoi_2 = Voronoi(Points=srf_cp_2.Point, Boundary=crv_8, BruteForceOverride=False)
crv_10 = Curve(voronoi_2)
multiplication_4 = Multiplication(A=multiplication_3, B=Slider(2.3, range=0..10))
spacepartition_2 = SpacePartition(VoronoiIn=crv_10, GridIn=crv_9, AreaIn=multiplication_3, Distance=multiplication_4)
sortxy_2 = SortPointsXY(Grid=flatten(spacepartition_2))
pararunion_3 = ParallelRegionUnion(Curves=spacepartition_2)
missing_2 = MissingGridCells(CulledGrid=flatten(sortxy_2), OriginalGrid=crv_9)
mgtree_2 = MergeTreeMissing(CulledGrid=pararunion_3, MissingGridCells=missing_2)
pararunion_4 = ParallelRegionUnion(Curves=mgtree_2)
parallelregionintersection_2 = ParallelRegionIntersection(CurvesA=crv_5, CurvesB=pararunion_4)
lng_14 = ListLength(List=flatten(parallelregionintersection_2))
random_2 = Random(Range=dom_19, Number=lng_14, Seed=[number_slider_8, number_slider_9, number_slider_10], Integers=True)
bang_5 = ExplodeTree(Data=random_2)  # -> Branch0, Branch1, Branch2
srf_2 = Surface(parallelregionintersection_2)
rgb_3 = ColourRGB(Alpha=Slider(10, range=0..10), Red=bang_5.Branch0, Green=bang_5.Branch1, Blue=bang_5.Branch2)
rgb_4 = ColourRGB(
    Alpha=number_slider_33,
    Red=bang_5.Branch0,
    Green=[55, 209, 59, 216, 1, 112, 142, 1, 76, 111, 92, 58, 62, 60, 197, 158, 67, 19, 183, 163, 50, 202, 112, 182, 111],
    Blue=[9, 120, 163, 36, 100, 115, 248, 253, 79, 124, 119, 250, 189, 19, 44, 159, 229, 29, 128, 139, 34, 211, 22, 234, 166])
rgb_5 = ColourRGB(Alpha=number_slider_33, Red=expr("x*2", bang_5.Branch1), Green=expr("x*0.5", bang_5.Branch1), Blue=0)
preview_2 = CustomPreview(Geometry=srf_2, Material=graft(rgb_5))
preview_3 = CustomPreview(Geometry=graft(crv_10), Material=graft(rgb_3))

# ----
rgb_6 = ColourRGB(Alpha=number_slider_31, Red=expr("x*2", bang_3.Branch1), Green=expr("x*0.5", bang_3.Branch1), Blue=0)

# ---- group: SpacePartition (continued)
preview_4 = CustomPreview(Geometry=srf, Material=graft(rgb_6))

# ---- group: OptimizationAndLabeling
labels = Panel("""PrivadoUno
Publico
PrivadoDos
SemiPrivado""")
area_3 = Area(Geometry=parallelregionintersection)  # -> Area, Centroid
lng_15 = ListLength(List=labels)
dom_20 = ConstructDomain(DomainStart=0, DomainEnd=Slider(30, range=0..100))
pt_7 = Point(Point(-29.85498097, -20.27765421, 0))
genemodifier_14 = GenePoolModifier(
    GeneList="DistanceList",
    Count=lng_15,
    Domain=dom_20,
    Randomize=Button(),
    PercentageOfRandomization=Slider(1, range=0..1))
distancelist = GenePool(Decimals=2, Maximum=30, Minimum=0, Value=[21.04, 0, 20.15, 0])
sort = SortList(Keys=flatten(ma.Result), ValuesA=flatten(ma.Result))  # -> Keys, ValuesA
multiplication_5 = Multiplication(A=flatten(area_3.Area), B=0.7)
galapagos = Galapagos(fitness=c_script, gene=[Y, R, X])
c_script = CSharpScript(
    x=multiplication_5,
    y=flatten(sort.Keys),
    z=flatten(area_3.Centroid),
    u=pt_7,
    v=distancelist,
    w=Slider(3, range=0..10),
    xx=Button())  # -> out, A; inputs x: list, y: list, z: list, v: list
# ---------- c_script: C# ----------
    double total = 0;
    double mult = (double) w;

    /*var document = Component.OnPingDocument();

    if( document.IsModified )
    {

      counter++;

    }

    if( (bool) xx == true )

      counter = 0;
*/
    if( x.Count != y.Count )
    {

      total = 1000;

    }

    else
    {

      for( int i = 0; i < x.Count; ++i )
      {

        total += Math.Abs(Convert.ToDouble(x[i]) - Convert.ToDouble(y[i]));
        var point = (Point3d) z[i];
        double tempDistance = point.DistanceTo(( Point3d ) u);

        switch( i )
        {

          case 0:

            tempDistance = mult * Math.Abs(tempDistance - (double) v[0]);

            break;

          case 1:

            tempDistance = mult * Math.Abs(tempDistance - (double) v[1]);

            break;

          case 2:

            tempDistance = mult * Math.Abs(tempDistance - (double) v[2]);

            break;

          case 3:

            tempDistance = mult * Math.Abs(tempDistance - (double) v[3]);

            break;

        }

        total += tempDistance;

      }

    }

    A = total;
    //Print("Number of Iterations: {0}", counter);
# ---------- c_script: C# additional code ----------
  //int counter = 0;
# ---------- end c_script ----------
division = Division(A=multiplication_5, B=sort.Keys)
graft = GraftTree(Tree=labels, IncludeEmptyLists=True, IncludeNullItems=True)  # -> simplify(Tree)
errorpercentage = Panel(division)
ma_2 = MassAddition(Input=division)  # -> Result, PartialResults
lng_16 = ListLength(List=division)
addindextolabels = CSharpScript(labels=graft, areas=flatten(multiplication_5))  # -> indexedLabels; inputs labels: tree, areas: list
# ---------- addindextolabels: C# ----------
    var newLabels = new DataTree<string>();

    for( int i = 0; i < labels.BranchCount; ++i )
      for( int j = 0; j < labels.Branch(i).Count; ++j )
      {

        newLabels.Add((string)labels.Branch(i)[j] + ' ' + Math.Round(( double ) areas[i], 3), new GH_Path(i));

      }

    indexedLabels = newLabels;
# ---------- end addindextolabels ----------
division_2 = Division(A=ma_2.Result, B=lng_16)
subtraction_7 = Subtraction(A=Slider(1, range=0..1), B=division_2)
results = Panel(multiplication_5)
errorpercentagemean = Panel(subtraction_7)
expectedresults = Panel(sort.Keys)
screentext = ScreenOrientedText(
    Text=addindextolabels,
    Font="Interstate",
    Justification=8,
    Location=graft(area_3.Centroid),
    SizeFactor=Slider(17.167, range=0..100),
    Color=RGB(0, 0, 0),
    Depth=0,
    Absolute=False)

# ---- group: SpaceSyntaxis
spctopo = SpaceTopology(Curves=flatten(parallelregionintersection), ParallelComputing=Toggle(False))
linetopo = LineTopology(PointTree=area_3.Centroid, Topology=spctopo)
ma_3 = MassAddition(Input=multiplication_5)  # -> Result, PartialResults
news_graph = GraphFromNodesLinksWithNEWS(Points=flatten(area_3.Centroid), Links=flatten(linetopo), Labels=labels, Areas=multiplication_5, TotalArea=ma_3.Result)  # -> Graph, GraphVertices, Attributes
diskograph = DiskoGraphDrawing(
    Plane=PlaneXY(0, 0, 0),
    Graph=spctopo,
    Vertices=simplify(news_graph.GraphVertices),
    Attributes=news_graph.Attributes,
    Thickness=1)

# ---- group: OptimizationAndLabeling
toggle_6 = GroupToggle(ToggleActive=True, ToggleVisible=False)  # disabled
area_4 = Area(Geometry=parallelregionintersection_2)  # -> Area, Centroid
lng_17 = ListLength(List=bang.Branch0)
dom_21 = ConstructDomain(DomainStart=0, DomainEnd=Slider(30, range=0..100))
pt_8 = Point(Point(-29.85498097, -20.27765421, 0))
genemodifier_15 = GenePoolModifier(
    GeneList="DistanceListO",
    Count=lng_17,
    Domain=dom_21,
    Randomize=Button(),
    PercentageOfRandomization=Slider(1, range=0..1))
distancelisto = GenePool(Decimals=2, Maximum=30, Minimum=0, Value=[21.04, 0, 20.15, 0, 15, 15, 15, 15, 15, 15])
sort_2 = SortList(Keys=flatten(bang_2.Branch0), ValuesA=flatten(bang_2.Branch0))  # -> Keys, ValuesA
multiplication_6 = Multiplication(A=flatten(area_4.Area), B=0.7)
c_script_2 = CSharpScript(
    x=multiplication_6,
    y=flatten(sort_2.Keys),
    z=flatten(area_4.Centroid),
    u=pt_8,
    v=distancelisto,
    w=Slider(3, range=0..10),
    xx=Button())  # -> out, A; inputs x: list, y: list, z: list, v: list
# ---------- c_script_2: C# ----------
    double total = 0;
    double mult = (double) w;

    /*var document = Component.OnPingDocument();

    if( document.IsModified )
    {

      counter++;

    }

    if( (bool) xx == true )

      counter = 0;
*/
    if( x.Count != y.Count )
    {

      total = 1000;

    }

    else
    {

      for( int i = 0; i < x.Count; ++i )
      {

        total += Math.Abs(Convert.ToDouble(x[i]) - Convert.ToDouble(y[i]));
        /*var point = (Point3d) z[i];
        double tempDistance = point.DistanceTo(( Point3d ) u);

        switch( i )
        {

          case 0:

            tempDistance = mult * Math.Abs(tempDistance - (double) v[0]);

            break;

          case 1:

            tempDistance = mult * Math.Abs(tempDistance - (double) v[1]);

            break;

          case 2:

            tempDistance = mult * Math.Abs(tempDistance - (double) v[2]);

            break;

          case 3:

            tempDistance = mult * Math.Abs(tempDistance - (double) v[3]);

            break;

        }

        total += tempDistance;
*/
      }

      }

      A = total;
      //Print("Number of Iterations: {0}", counter);
# ---------- c_script_2: C# additional code ----------
    //int counter = 0;
# ---------- end c_script_2 ----------
division_3 = Division(A=multiplication_6, B=sort_2.Keys)
panel = Panel(c_script_2.A)
graft_2 = GraftTree(Tree=bang.Branch0, IncludeEmptyLists=True, IncludeNullItems=True)  # -> simplify(Tree)
errorpercentage_2 = Panel(division_3)
ma_4 = MassAddition(Input=division_3)  # -> Result, PartialResults
lng_18 = ListLength(List=division_3)
galapagos_2 = Galapagos(fitness=c_script_2, gene=[yo, xo])
addindextolabels_2 = CSharpScript(labels=graft_2, areas=flatten(multiplication_6))  # -> indexedLabels; inputs labels: tree, areas: list; same code as addindextolabels
division_4 = Division(A=ma_4.Result, B=lng_18)
subtraction_8 = Subtraction(A=Slider(1, range=0..1), B=division_4)
results_2 = Panel(multiplication_6)
errorpercentagemean_2 = Panel(subtraction_8)
expectedresults_2 = Panel(sort_2.Keys)
screentext_2 = ScreenOrientedText(
    Text=addindextolabels_2,
    Font="Interstate",
    Justification=8,
    Location=graft(area_4.Centroid),
    SizeFactor=Slider(6.961, range=0..100),
    Color=RGB(255, 255, 255),
    Depth=0,
    Absolute=False)

# ---- group: SpaceSyntaxis
toggle_7 = GroupToggle(ToggleActive=True, ToggleVisible=False)  # disabled
spctopo_2 = SpaceTopology(Curves=flatten(parallelregionintersection_2), ParallelComputing=Toggle(False))
linetopo_2 = LineTopology(PointTree=area_4.Centroid, Topology=spctopo_2)
ma_5 = MassAddition(Input=multiplication_6)  # -> Result, PartialResults
news_graph_2 = GraphFromNodesLinksWithNEWS(
    Points=flatten(area_4.Centroid),
    Links=flatten(linetopo_2),
    Labels=bang.Branch0,
    Areas=multiplication_6,
    TotalArea=ma_5.Result)  # -> Graph, GraphVertices, Attributes
diskograph_2 = DiskoGraphDrawing(
    Plane=PlaneXY(53.10979998, -6.30065426, 0),
    Graph=spctopo_2,
    Vertices=simplify(news_graph_2.GraphVertices),
    Attributes=news_graph_2.Attributes,
    Thickness=1)

# ----
panel_2 = Panel(c_script.A)

# ---- group: SpacePartition (continued)
bbox_4 = BoundingBox(Content=crv_6, Plane=PlaneXY(0, 0, 0))  # -> Box, Box_2
debrep_2 = DeconstructBrep(Brep=bbox_4.Box)  # -> Faces, Edges, Vertices
join_2 = JoinCurves(Curves=debrep_2.Edges, Preserve=False)

# ---- group: SpacePartition / OriginalSilhouette
crv_11 = Curve(join_2)

# ---- group: SpacePartition (continued)
bbox_5 = BoundingBox(Content=crv_11, Plane=PlaneXY(0, 0, 0))  # -> Box, Box_2
ptsrfdomnum_3 = SurfaceDomainNumber(Surface=bbox_5.Box, UNumber=Slider(1, range=0..100), VNumber=Slider(20, range=0..100))
ptborders_3 = GenerateBorders(Grid=ptsrfdomnum_3, PanelShape=0)  # -> simplify(Border)
evalsrf_3 = EvaluateSurface(Surface=reparameterize(crv_11), Point=pt_2)  # -> Point, Normal, UDirection, VDirection, Frame
crv_12 = Curve(flatten(ptborders_3))
item_3 = ListItem(List=crv_12, Index=0, Wrap=True)
area_5 = Area(Geometry=item_3)  # -> Area, Centroid
multiplication_7 = Multiplication(A=area_5.Area, B=Slider(0.6, range=0..1))
srf_cp_3 = SurfaceClosestPoint(Point=evalsrf_3.Point, Surface=crv_11)  # -> Point, UVPoint, Distance
voronoi_3 = Voronoi(Points=srf_cp_3.Point, Boundary=crv_11, BruteForceOverride=False)
crv_13 = Curve(voronoi_3)
multiplication_8 = Multiplication(A=multiplication_7, B=Slider(1.8, range=0..10))
spacepartition_3 = SpacePartition(VoronoiIn=crv_13, GridIn=crv_12, AreaIn=multiplication_7, Distance=multiplication_8)
sortxy_3 = SortPointsXY(Grid=flatten(spacepartition_3))
pararunion_5 = ParallelRegionUnion(Curves=spacepartition_3)
missing_3 = MissingGridCells(CulledGrid=flatten(sortxy_3), OriginalGrid=crv_12)
mgtree_3 = MergeTreeMissing(CulledGrid=pararunion_5, MissingGridCells=missing_3)
pararunion_6 = ParallelRegionUnion(Curves=mgtree_3)
parallelregionintersection_3 = ParallelRegionIntersection(CurvesA=crv_6, CurvesB=pararunion_6)
lng_19 = ListLength(List=flatten(parallelregionintersection_3))
random_3 = Random(Range=dom_6, Number=lng_19, Seed=[number_slider_11, number_slider_12, number_slider_13], Integers=True)
bang_6 = ExplodeTree(Data=random_3)  # -> Branch0, Branch1, Branch2
srf_3 = Surface(parallelregionintersection_3)
rgb_7 = ColourRGB(Alpha=Slider(10, range=0..10), Red=bang_6.Branch0, Green=bang_6.Branch1, Blue=bang_6.Branch2)
rgb_8 = ColourRGB(
    Alpha=number_slider_22,
    Red=bang_6.Branch0,
    Green=[55, 209, 59, 216, 1, 112, 142, 1, 76, 111, 92, 58, 62, 60, 197, 158, 67, 19, 183, 163, 50, 202, 112, 182, 111],
    Blue=[9, 120, 163, 36, 100, 115, 248, 253, 79, 124, 119, 250, 189, 19, 44, 159, 229, 29, 128, 139, 34, 211, 22, 234, 166])
rgb_9 = ColourRGB(Alpha=number_slider_22, Red=expr("x*2", bang_6.Branch1), Green=expr("x*0.5", bang_6.Branch1), Blue=0)
preview_5 = CustomPreview(Geometry=srf_3, Material=graft(rgb_9))
preview_6 = CustomPreview(Geometry=graft(crv_13), Material=graft(rgb_7))

# ---- group: OptimizationAndLabeling
toggle_8 = GroupToggle(ToggleActive=True, ToggleVisible=False)  # disabled
area_6 = Area(Geometry=parallelregionintersection_3)  # -> Area, Centroid
lng_20 = ListLength(List=bang.Branch1)
dom_22 = ConstructDomain(DomainStart=0, DomainEnd=Slider(30, range=0..100))
pt_9 = Point(Point(-29.85498097, -20.27765421, 0))
genemodifier_16 = GenePoolModifier(
    GeneList="DistanceListT",
    Count=lng_20,
    Domain=dom_22,
    Randomize=Button(),
    PercentageOfRandomization=Slider(1, range=0..1))
distancelistt = GenePool(Decimals=2, Maximum=30, Minimum=0, Value=[21.04, 0])
sort_3 = SortList(Keys=flatten(bang_2.Branch1), ValuesA=flatten(bang_2.Branch1))  # -> Keys, ValuesA
multiplication_9 = Multiplication(A=flatten(area_6.Area), B=0.7)
c_script_3 = CSharpScript(
    x=multiplication_9,
    y=flatten(sort_3.Keys),
    z=flatten(area_6.Centroid),
    u=pt_9,
    v=distancelistt,
    w=Slider(3, range=0..10),
    xx=Button())  # -> out, A; inputs x: list, y: list, z: list, v: list; same code as c_script_2
division_5 = Division(A=multiplication_9, B=sort_3.Keys)
panel_3 = Panel(c_script_3.A)
graft_3 = GraftTree(Tree=bang.Branch1, IncludeEmptyLists=True, IncludeNullItems=True)  # -> simplify(Tree)
errorpercentage_3 = Panel(division_5)
ma_6 = MassAddition(Input=division_5)  # -> Result, PartialResults
lng_21 = ListLength(List=division_5)
addindextolabels_3 = CSharpScript(labels=graft_3, areas=flatten(multiplication_9))  # -> indexedLabels; inputs labels: tree, areas: list; same code as addindextolabels
division_6 = Division(A=ma_6.Result, B=lng_21)
subtraction_9 = Subtraction(A=Slider(1, range=0..1), B=division_6)
results_3 = Panel(multiplication_9)
galapagos_3 = Galapagos(fitness=c_script_3, gene=[xt, yt])
errorpercentagemean_3 = Panel(subtraction_9)
expectedresults_3 = Panel(sort_3.Keys)
screentext_3 = ScreenOrientedText(
    Text=addindextolabels_3,
    Font="Interstate",
    Justification=8,
    Location=graft(area_6.Centroid),
    SizeFactor=Slider(6.961, range=0..100),
    Color=RGB(255, 255, 255),
    Depth=0,
    Absolute=False)

# ---- group: SpaceSyntaxis
toggle_9 = GroupToggle(ToggleActive=True, ToggleVisible=False)  # disabled
toggle_10 = BooleanToggle(False)  # disabled
spctopo_3 = SpaceTopology(Curves=flatten(parallelregionintersection_3), ParallelComputing=toggle_10)  # disabled
linetopo_3 = LineTopology(PointTree=area_6.Centroid, Topology=spctopo_3)  # disabled
ma_7 = MassAddition(Input=multiplication_9)  # -> Result, PartialResults; disabled
news_graph_3 = GraphFromNodesLinksWithNEWS(
    Points=flatten(area_6.Centroid),
    Links=flatten(linetopo_3),
    Labels=bang.Branch1,
    Areas=multiplication_9,
    TotalArea=ma_7.Result)  # -> Graph, GraphVertices, Attributes; disabled
diskograph_3 = DiskoGraphDrawing(
    Plane=PlaneXY(0, 0, 0),
    Graph=spctopo_3,
    Vertices=simplify(news_graph_3.GraphVertices),
    Attributes=news_graph_3.Attributes,
    Thickness=1)  # disabled

# ---- group: SpacePartition (continued)
bbox_6 = BoundingBox(Content=crv_7, Plane=PlaneXY(0, 0, 0))  # -> Box, Box_2
debrep_3 = DeconstructBrep(Brep=bbox_6.Box)  # -> Faces, Edges, Vertices
join_3 = JoinCurves(Curves=debrep_3.Edges, Preserve=False)

# ---- group: SpacePartition / OriginalSilhouette
crv_14 = Curve(join_3)

# ---- group: SpacePartition (continued)
bbox_7 = BoundingBox(Content=crv_14, Plane=PlaneXY(0, 0, 0))  # -> Box, Box_2
ptsrfdomnum_4 = SurfaceDomainNumber(Surface=bbox_7.Box, UNumber=Slider(2, range=0..100), VNumber=Slider(15, range=0..100))
ptborders_4 = GenerateBorders(Grid=ptsrfdomnum_4, PanelShape=0)  # -> simplify(Border)
evalsrf_4 = EvaluateSurface(Surface=reparameterize(crv_14), Point=pt_3)  # -> Point, Normal, UDirection, VDirection, Frame
crv_15 = Curve(flatten(ptborders_4))
item_4 = ListItem(List=crv_15, Index=0, Wrap=True)
area_7 = Area(Geometry=item_4)  # -> Area, Centroid
multiplication_10 = Multiplication(A=area_7.Area, B=Slider(0.6, range=0..1))
srf_cp_4 = SurfaceClosestPoint(Point=evalsrf_4.Point, Surface=crv_14)  # -> Point, UVPoint, Distance
voronoi_4 = Voronoi(Points=srf_cp_4.Point, Boundary=crv_14, BruteForceOverride=False)
crv_16 = Curve(voronoi_4)
multiplication_11 = Multiplication(A=multiplication_10, B=Slider(1.8, range=0..10))
spacepartition_4 = SpacePartition(VoronoiIn=crv_16, GridIn=crv_15, AreaIn=multiplication_10, Distance=multiplication_11)
sortxy_4 = SortPointsXY(Grid=flatten(spacepartition_4))
pararunion_7 = ParallelRegionUnion(Curves=spacepartition_4)
missing_4 = MissingGridCells(CulledGrid=flatten(sortxy_4), OriginalGrid=crv_15)
mgtree_4 = MergeTreeMissing(CulledGrid=pararunion_7, MissingGridCells=missing_4)
pararunion_8 = ParallelRegionUnion(Curves=mgtree_4)
parallelregionintersection_4 = ParallelRegionIntersection(CurvesA=crv_7, CurvesB=pararunion_8)
lng_22 = ListLength(List=flatten(parallelregionintersection_4))
random_4 = Random(Range=dom_9, Number=lng_22, Seed=[number_slider_15, number_slider_14, number_slider_16], Integers=True)
bang_7 = ExplodeTree(Data=random_4)  # -> Branch0, Branch1, Branch2
srf_4 = Surface(parallelregionintersection_4)
rgb_10 = ColourRGB(Alpha=Slider(10, range=0..10), Red=bang_7.Branch0, Green=bang_7.Branch1, Blue=bang_7.Branch2)
rgb_11 = ColourRGB(
    Alpha=number_slider_25,
    Red=bang_7.Branch0,
    Green=[55, 209, 59, 216, 1, 112, 142, 1, 76, 111, 92, 58, 62, 60, 197, 158, 67, 19, 183, 163, 50, 202, 112, 182, 111],
    Blue=[9, 120, 163, 36, 100, 115, 248, 253, 79, 124, 119, 250, 189, 19, 44, 159, 229, 29, 128, 139, 34, 211, 22, 234, 166])
rgb_12 = ColourRGB(Alpha=number_slider_25, Red=expr("x*2", bang_7.Branch1), Green=expr("x*0.5", bang_7.Branch1), Blue=0)
preview_7 = CustomPreview(Geometry=srf_4, Material=graft(rgb_12))
preview_8 = CustomPreview(Geometry=graft(crv_16), Material=graft(rgb_10))

# ---- group: OptimizationAndLabeling
toggle_11 = GroupToggle(ToggleActive=True, ToggleVisible=False)  # disabled
area_8 = Area(Geometry=parallelregionintersection_4)  # -> Area, Centroid
lng_23 = ListLength(List=bang.Branch2)
dom_23 = ConstructDomain(DomainStart=0, DomainEnd=Slider(30, range=0..100))
pt_10 = Point(Point(-29.85498097, -20.27765421, 0))
genemodifier_17 = GenePoolModifier(
    GeneList="DistanceListTh",
    Count=lng_23,
    Domain=dom_23,
    Randomize=Button(),
    PercentageOfRandomization=Slider(1, range=0..1))
distancelistth = GenePool(Decimals=2, Maximum=30, Minimum=0, Value=[21.04, 0, 15, 15, 15, 15, 15])
sort_4 = SortList(Keys=flatten(bang_2.Branch2), ValuesA=flatten(bang_2.Branch2))  # -> Keys, ValuesA
multiplication_12 = Multiplication(A=flatten(area_8.Area), B=0.7)
c_script_4 = CSharpScript(
    x=multiplication_12,
    y=flatten(sort_4.Keys),
    z=flatten(area_8.Centroid),
    u=pt_10,
    v=distancelistth,
    w=Slider(3, range=0..10),
    xx=Button())  # -> out, A; inputs x: list, y: list, z: list, v: list; same code as c_script_2
galapagos_4 = Galapagos(fitness=c_script_4, gene=[xth, yth])
division_7 = Division(A=multiplication_12, B=sort_4.Keys)
panel_4 = Panel(c_script_4.A)
graft_4 = GraftTree(Tree=bang.Branch2, IncludeEmptyLists=True, IncludeNullItems=True)  # -> simplify(Tree)
errorpercentage_4 = Panel(division_7)
ma_8 = MassAddition(Input=division_7)  # -> Result, PartialResults
lng_24 = ListLength(List=division_7)
addindextolabels_4 = CSharpScript(labels=graft_4, areas=flatten(multiplication_12))  # -> indexedLabels; inputs labels: tree, areas: list; same code as addindextolabels
division_8 = Division(A=ma_8.Result, B=lng_24)
subtraction_10 = Subtraction(A=Slider(1, range=0..1), B=division_8)
results_4 = Panel(multiplication_12)
errorpercentagemean_4 = Panel(subtraction_10)
expectedresults_4 = Panel(sort_4.Keys)
screentext_4 = ScreenOrientedText(
    Text=addindextolabels_4,
    Font="Interstate",
    Justification=8,
    Location=graft(area_8.Centroid),
    SizeFactor=Slider(6.961, range=0..100),
    Color=RGB(255, 255, 255),
    Depth=0,
    Absolute=False)

# ---- group: SpaceSyntaxis
toggle_12 = GroupToggle(ToggleActive=True, ToggleVisible=False)  # disabled
spctopo_4 = SpaceTopology(Curves=flatten(parallelregionintersection_4), ParallelComputing=Toggle(False))
linetopo_4 = LineTopology(PointTree=area_8.Centroid, Topology=spctopo_4)
ma_9 = MassAddition(Input=multiplication_12)  # -> Result, PartialResults
news_graph_4 = GraphFromNodesLinksWithNEWS(
    Points=flatten(area_8.Centroid),
    Links=flatten(linetopo_4),
    Labels=bang.Branch2,
    Areas=multiplication_12,
    TotalArea=ma_9.Result)  # -> Graph, GraphVertices, Attributes
diskograph_4 = DiskoGraphDrawing(
    Plane=PlaneXY(-73.0939429, -5.906663212, 0),
    Graph=spctopo_4,
    Vertices=simplify(news_graph_4.GraphVertices),
    Attributes=news_graph_4.Attributes,
    Thickness=1)

# ---- group: SpacePartition (continued)
bbox_8 = BoundingBox(Content=crv_4, Plane=PlaneXY(0, 0, 0))  # -> Box, Box_2
debrep_4 = DeconstructBrep(Brep=bbox_8.Box)  # -> Faces, Edges, Vertices
join_4 = JoinCurves(Curves=debrep_4.Edges, Preserve=False)

# ---- group: SpacePartition / OriginalSilhouette
crv_17 = Curve(join_4)

# ---- group: SpacePartition (continued)
bbox_9 = BoundingBox(Content=crv_17, Plane=PlaneXY(0, 0, 0))  # -> Box, Box_2
ptsrfdomnum_5 = SurfaceDomainNumber(Surface=bbox_9.Box, UNumber=Slider(2, range=0..100), VNumber=Slider(15, range=0..100))
ptborders_5 = GenerateBorders(Grid=ptsrfdomnum_5, PanelShape=0)  # -> simplify(Border)
evalsrf_5 = EvaluateSurface(Surface=reparameterize(crv_17), Point=pt_4)  # -> Point, Normal, UDirection, VDirection, Frame
crv_18 = Curve(flatten(ptborders_5))
item_5 = ListItem(List=crv_18, Index=0, Wrap=True)
area_9 = Area(Geometry=item_5)  # -> Area, Centroid
multiplication_13 = Multiplication(A=area_9.Area, B=Slider(0.6, range=0..1))
srf_cp_5 = SurfaceClosestPoint(Point=evalsrf_5.Point, Surface=crv_17)  # -> Point, UVPoint, Distance
voronoi_5 = Voronoi(Points=srf_cp_5.Point, Boundary=crv_17, BruteForceOverride=False)
crv_19 = Curve(voronoi_5)
multiplication_14 = Multiplication(A=multiplication_13, B=Slider(1.8, range=0..10))
spacepartition_5 = SpacePartition(VoronoiIn=crv_19, GridIn=crv_18, AreaIn=multiplication_13, Distance=multiplication_14)
sortxy_5 = SortPointsXY(Grid=flatten(spacepartition_5))
pararunion_9 = ParallelRegionUnion(Curves=spacepartition_5)
missing_5 = MissingGridCells(CulledGrid=flatten(sortxy_5), OriginalGrid=crv_18)
mgtree_5 = MergeTreeMissing(CulledGrid=pararunion_9, MissingGridCells=missing_5)
pararunion_10 = ParallelRegionUnion(Curves=mgtree_5)
parallelregionintersection_5 = ParallelRegionIntersection(CurvesA=crv_4, CurvesB=pararunion_10)
lng_25 = ListLength(List=flatten(parallelregionintersection_5))
random_5 = Random(Range=dom_12, Number=lng_25, Seed=[number_slider_18, number_slider_17, number_slider_19], Integers=True)
bang_8 = ExplodeTree(Data=random_5)  # -> Branch0, Branch1, Branch2
srf_5 = Surface(parallelregionintersection_5)
rgb_13 = ColourRGB(Alpha=Slider(10, range=0..10), Red=bang_8.Branch0, Green=bang_8.Branch1, Blue=bang_8.Branch2)
rgb_14 = ColourRGB(
    Alpha=number_slider_28,
    Red=bang_8.Branch0,
    Green=[55, 209, 59, 216, 1, 112, 142, 1, 76, 111, 92, 58, 62, 60, 197, 158, 67, 19, 183, 163, 50, 202, 112, 182, 111],
    Blue=[9, 120, 163, 36, 100, 115, 248, 253, 79, 124, 119, 250, 189, 19, 44, 159, 229, 29, 128, 139, 34, 211, 22, 234, 166])
rgb_15 = ColourRGB(Alpha=number_slider_28, Red=expr("x*2", bang_8.Branch1), Green=expr("x*0.5", bang_8.Branch1), Blue=0)
preview_9 = CustomPreview(Geometry=srf_5, Material=graft(rgb_15))
preview_10 = CustomPreview(Geometry=graft(crv_19), Material=graft(rgb_13))

# ----
crv_20 = Curve(flatten([parallelregionintersection_5, parallelregionintersection_4, parallelregionintersection_3, parallelregionintersection_2, parallelregionintersection]))

# ---- group: OptimizationAndLabeling
toggle_13 = GroupToggle(ToggleActive=True, ToggleVisible=False)  # disabled
area_10 = Area(Geometry=parallelregionintersection_5)  # -> Area, Centroid
lng_26 = ListLength(List=bang.Branch3)
dom_24 = ConstructDomain(DomainStart=0, DomainEnd=Slider(30, range=0..100))
pt_11 = Point(Point(-29.85498097, -20.27765421, 0))
genemodifier_18 = GenePoolModifier(
    GeneList="DistanceListF",
    Count=lng_26,
    Domain=dom_24,
    Randomize=Button(),
    PercentageOfRandomization=Slider(1, range=0..1))
distancelistf = GenePool(Decimals=2, Maximum=30, Minimum=0, Value=[21.04, 0, 15, 15, 15, 15])
sort_5 = SortList(Keys=flatten(bang_2.Branch3), ValuesA=flatten(bang_2.Branch3))  # -> Keys, ValuesA
multiplication_15 = Multiplication(A=flatten(area_10.Area), B=0.7)
c_script_5 = CSharpScript(
    x=multiplication_15,
    y=flatten(sort_5.Keys),
    z=flatten(area_10.Centroid),
    u=pt_11,
    v=distancelistf,
    w=Slider(3, range=0..10),
    xx=Button())  # -> out, A; inputs x: list, y: list, z: list, v: list; same code as c_script_2
galapagos_5 = Galapagos(fitness=c_script_5, gene=[xf, yf])
division_9 = Division(A=multiplication_15, B=sort_5.Keys)
panel_5 = Panel(c_script_5.A)
graft_5 = GraftTree(Tree=bang.Branch3, IncludeEmptyLists=True, IncludeNullItems=True)  # -> simplify(Tree)
errorpercentage_5 = Panel(division_9)
ma_10 = MassAddition(Input=division_9)  # -> Result, PartialResults
lng_27 = ListLength(List=division_9)
addindextolabels_5 = CSharpScript(labels=graft_5, areas=flatten(multiplication_15))  # -> indexedLabels; inputs labels: tree, areas: list; same code as addindextolabels
division_10 = Division(A=ma_10.Result, B=lng_27)
subtraction_11 = Subtraction(A=Slider(1, range=0..1), B=division_10)
results_5 = Panel(multiplication_15)
errorpercentagemean_5 = Panel(subtraction_11)
expectedresults_5 = Panel(sort_5.Keys)
screentext_5 = ScreenOrientedText(
    Text=addindextolabels_5,
    Font="Interstate",
    Justification=8,
    Location=graft(area_10.Centroid),
    SizeFactor=Slider(6.961, range=0..100),
    Color=RGB(255, 255, 255),
    Depth=0,
    Absolute=False)

# ---- group: SpaceSyntaxis
toggle_14 = GroupToggle(ToggleActive=True, ToggleVisible=False)  # disabled
spctopo_5 = SpaceTopology(Curves=flatten(parallelregionintersection_5), ParallelComputing=Toggle(False))
linetopo_5 = LineTopology(PointTree=area_10.Centroid, Topology=spctopo_5)
ma_11 = MassAddition(Input=multiplication_15)  # -> Result, PartialResults
news_graph_5 = GraphFromNodesLinksWithNEWS(
    Points=flatten(area_10.Centroid),
    Links=flatten(linetopo_5),
    Labels=bang.Branch3,
    Areas=multiplication_15,
    TotalArea=ma_11.Result)  # -> Graph, GraphVertices, Attributes
diskograph_5 = DiskoGraphDrawing(
    Plane=PlaneXY(-117.0981639, -10.55997761, 0),
    Graph=spctopo_5,
    Vertices=simplify(news_graph_5.GraphVertices),
    Attributes=news_graph_5.Attributes,
    Thickness=1)
