# Grasshopper definition FloorPlanGH.gh (Grasshopper 1.0.7)
# Copyright: All rights reserved
# plug-ins: treesloth01, TT Toolbox, SpaceSyntaxDesign_GH

boolean_toggle = BooleanToggle(False)
text = Text(Tree({1}: ["Área de control vehicular - Vigilancia", "1", "1.5", "1.5", "1"], {2}: ["Parqueaderos vehicular (5,00 x 2,50 mts)", "5", "12.5", "62.5", "1"], {3}: ["Parqueaderos discapacitados (5,00 x 3,70 mts)", "1", "18.5", "18.5", "1"], {4}: ["Parqueaderos bicicletas/motos", "5", "1.2", "6", "1"], {5}: ["Zona de Parqueo ambulancias", "1", "11", "11", "1"], {6}: ["*", "*", "*", "*", ""]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))
read_excel_sheet = ReadExcelSheet(Run=boolean_toggle, Worksheet="1", Listen=boolean_toggle)  # -> UserMessages, Columns, Rows
text_2 = Text(Tree({1}: ["Área de control vehicular - Vigilancia", "1", "1.5", "1.5", "1"], {2}: ["Parqueaderos vehicular (5,00 x 2,50 mts)", "5", "12.5", "62.5", "1"], {3}: ["Parqueaderos discapacitados (5,00 x 3,70 mts)", "1", "18.5", "18.5", "1"], {4}: ["Parqueaderos bicicletas/motos", "5", "1.2", "6", "1"], {5}: ["Zona de Parqueo ambulancias", "1", "11", "11", "1"], {6}: ["*", "*", "*", "*", ""]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))
partitiontreeatchar = CSharpScript(data=text_2, erase="*")  # -> A; inputs data: tree of String, erase: String
# ---------- partitiontreeatchar: C# ----------
    var treeOut = new DataTree<string>();
    int path = 0;

    for( int i = 0; i < data.BranchCount; ++i )
      for( int j = 0; j < data.Branch(i).Count; ++j )
      {

        if( data.Branch(i)[j] != erase )
        {

          treeOut.Add(data.Branch(i)[j], new GH_Path(path));
          //path++;

        }
        
        else
        {
        
          path++;
        
        }

      }

    A = treeOut;
# ---------- end partitiontreeatchar ----------
cleantreefromempty = CSharpScript(data=partitiontreeatchar)  # -> A; inputs data: tree of String
# ---------- cleantreefromempty: C# ----------
    var treeOut = new DataTree<string>();

    foreach( var path in data.Paths )
    {
    
      var branch = data.Branch(path);
      
      foreach( var item in branch )
      {
      
        if( !String.IsNullOrEmpty(item) )
        treeOut.Add( item, path );
      
      }
    
    }

    A = treeOut;
# ---------- end cleantreefromempty ----------
renumber_paths = RenumberPaths(Data=cleantreefromempty)
cullbranchesfromindex = CSharpScript(branches=renumber_paths, cullFrom=Slider(4, range=0..10))  # -> out, treeOut; inputs branches: tree of String, cullFrom: Int32
# ---------- cullbranchesfromindex: C# ----------
    var newTree = new DataTree<string>();

    for( int i = 0; i < branches.BranchCount; ++i )
    {

      var path = branches.Path(i);

      if( path.Indices[0] >= cullFrom )

        newTree.AddRange(branches.Branch(i), path);

    }

    treeOut = newTree;
# ---------- end cullbranchesfromindex ----------
renumber_paths_2 = RenumberPaths(Data=cullbranchesfromindex.treeOut)
partition_list = PartitionList(List=renumber_paths_2, Size=Slider(5, range=0..10))
text_3 = Text(partition_list)
list_item = ListItem(List=text_3, Index=Slider(0, range=0..3), Wrap=True)
path_mapper = PathMapper(list_item, source="{A;B}", target="{A}")
list_item_2 = ListItem(List=text_3, Index=Slider(2, range=0..3), Wrap=True)
list_item_3 = ListItem(List=text_3, Index=Slider(3, range=0..3), Wrap=True)
path_mapper_2 = PathMapper(list_item_3, source="{A;B}", target="{A}")
list_item_4 = ListItem(List=text_3, Index=Slider(1, range=0..1), Wrap=True)
point = Point([<point referenced from the Rhino model> x2])  # disabled
point_2 = Point([<point referenced from the Rhino model> x2])  # disabled
point_3 = Point([<point referenced from the Rhino model> x8])  # disabled
point_4 = Point([<point referenced from the Rhino model> x7])  # disabled
point_5 = Point([<point referenced from the Rhino model> x3])  # disabled
flatten_tree = FlattenTree(Tree=list_item_3, Path="{0}")
panel = Panel(text_3)
point_6 = Point([<point referenced from the Rhino model> x22])
path_mapper_3 = PathMapper(list_item_2, source="{A;B}", target="{A}")
curve = Curve([<curve referenced from the Rhino model> x25])
curve_2 = Curve([<curve referenced from the Rhino model> x31])
curve_3 = Curve([<curve referenced from the Rhino model> x33])
mass_addition = MassAddition(Input=flatten(path_mapper_2))  # -> Result, PartialResults
path_mapper_4 = PathMapper(list_item, source="{A;B}", target="{A}")
c_script = CSharpScript(x=point, y=point_2, z=point_3, u=point_4, v=point_5)  # -> A; inputs x: list of Point3d, y: list of Point3d, z: list of Point3d, u: list of Point3d, v: list of Point3d; disabled
# ---------- c_script: C# ----------
    var dataTree = new DataTree<Point3d>();

    dataTree.AddRange(x, new GH_Path(4));
    dataTree.AddRange(y, new GH_Path(5));
    dataTree.AddRange(z, new GH_Path(6));
    dataTree.AddRange(u, new GH_Path(7));
    dataTree.AddRange(v, new GH_Path(8));

    A = dataTree;
# ---------- end c_script ----------
mass_addition_2 = MassAddition(Input=flatten_tree)  # -> Result, PartialResults
multiplication = Multiplication(A=path_mapper_3, B=0.5)
path_mapper_5 = PathMapper(list_item_4, source="{A;B}", target="{A}")
graphfromnodes_links = GraphFromNodesLinks(Points=point_6, Links=curve, Labels=flatten(path_mapper), Areas=flatten(path_mapper_2), TotalArea=mass_addition.Result)  # -> Graph, GraphVertices, Attributes
square_root = SquareRoot(Value=mass_addition_2.Result)
text_tag = TextTag(Location=point_6, Text=flatten(path_mapper))
mass_addition_3 = MassAddition(Input=path_mapper_5)  # -> Result, PartialResults
branchcount = CSharpScript(x=path_mapper_5)  # -> A; inputs x: tree of String
# ---------- branchcount: C# ----------
    A = x.BranchCount;
# ---------- end branchcount ----------
multiplication_2 = Multiplication(A=square_root, B=0.5)
construct_domain = ConstructDomain(DomainStart=expr("-x", multiplication), DomainEnd=multiplication)
number_slider = Slider(10000, range=0..10000)
crv = Curve(<curve referenced from the Rhino model>)  # disabled
forcedirecteddrawing = ForceDirectedDrawing(
    Graph=graphfromnodes_links.Graph,
    Vertices=graphfromnodes_links.GraphVertices,
    Attributes=graphfromnodes_links.Attributes,
    AttractionStrength=Slider(0.25, range=0..1),
    RepulsionStrength=Slider(1.4, range=0..10),
    ConvergenceTolearnce=0.001,
    MaximumIterations=4000,
    Active=Toggle(True))  # -> NewGraphVertices, IterationCount
multiplication_3 = Multiplication(A=multiplication_2, B=Slider(1.9389, range=0..10))
random = Random(Range=Domain(0, 10000), Number=branchcount, Seed=Slider(3374, range=0..10000))  # -> graft(Random)
scale = Slider(0.7, range=0..10)  # disabled
crv_2 = Curve(<curve referenced from the Rhino model>)
construct_domain_2 = ConstructDomain(DomainStart=expr("-x", multiplication_3), DomainEnd=multiplication_3)
populate_2d = Populate2D(Region=crv_2, Count=mass_addition_3.Result, Seed=random)  # -> simplify(Population)
panel_2 = Panel(construct_domain)
area = Area(Geometry=flatten(crv_2))  # -> Area, Centroid
att_tor = Att_toR(B=scale, att=graphfromnodes_links.Attributes)  # -> R, M; disabled
xy = XYPlane(Origin=Point(0, 0, 0))  # disabled
w_voronoi = WeightedVoronoi(BasePlane=xy, Points=forcedirecteddrawing.NewGraphVertices, Radii=att_tor.R, BoundingCurve=crv)  # -> AdjacencyGraph, VoronoiCells; disabled
rectangle = Rectangle(Plane=PlaneXY(0, 0, 0), XSize=construct_domain_2, YSize=construct_domain_2, Radius=0)  # -> Rectangle, Length
rectangle_2 = Rectangle(Plane=populate_2d, XSize=construct_domain, YSize=construct_domain, Radius=0)  # -> Rectangle, Length
data = Data(flatten(construct_domain))
qt = QuadTree(Points=flatten(populate_2d), Plane=PlaneXY(0, 0, 0), Square=True, Group=Slider(1, range=0..10))  # -> Quads, Points
xy_2 = XYPlane(Origin=Point(0, 0, 0))
flatten = FlattenTree(Tree=populate_2d, Path="{0}")
area_2 = Area(Geometry=w_voronoi.VoronoiCells)  # -> Area, Centroid; disabled
list_length = ListLength(List=flatten(rectangle_2.Rectangle))
srf = Surface(w_voronoi.VoronoiCells)  # disabled
preview = CustomPreview(Geometry=srf, Shader=att_tor.M)  # disabled
text_tag_2 = TextTag(Location=flatten, Text=flatten(path_mapper))
diskographdrawing = DiskoGraphDrawing(
    Plane=xy_2,
    Graph=graphfromnodes_links.Graph,
    Vertices=forcedirecteddrawing.NewGraphVertices,
    Attributes=graphfromnodes_links.Attributes,
    Thickness=1)
area_3 = Area(Geometry=flatten(rectangle_2.Rectangle))  # -> Area, Centroid
text_tag_3 = TextTag(Location=forcedirecteddrawing.NewGraphVertices, Text=flatten(path_mapper))
random_2 = Random(Range=Domain(0, 1), Number=branchcount, Seed=Slider(465, range=0..1000))
crv_3 = Curve(<curve referenced from the Rhino model>)
substrate = Substrate(Border=crv_3, Count=list_length, Angles=0, Deviation=Slider(0, range=0..1), Seed=Slider(5627, range=0..10000))
random_3 = Random(Range=Domain(0, 1), Number=branchcount, Seed=Slider(460, range=0..1000))
random_4 = Random(Range=Domain(0, 1), Number=branchcount, Seed=Slider(342, range=0..1000))
surface = Surface(rectangle_2.Rectangle)
ma = MassAddition(Input=area_3.Area)  # -> Result, PartialResults
expression = Expression(Expression="Format(\"{0}, {1}\", x, y)")
srf_2 = Surface(crv_3)
srfsplit = SurfaceSplit(Surface=srf_2, Curves=substrate)
colour_rgb_f = ColourRGBF(Alpha=1, Red=random_2, Green=random_3, Blue=random_4)  # -> simplify(graft(Colour))
area_4 = Area(Geometry=srfsplit)  # -> Area, Centroid
voronoi = Voronoi(BruteForceOverride=False)
panel_3 = Panel(area_4.Area)
custom_preview = CustomPreview(Geometry=surface, Material=colour_rgb_f)
explode_tree = ExplodeTree(Data=colour_rgb_f)  # -> Branch0, Branch1, Branch2, Branch3, Branch4
explode_tree_2 = ExplodeTree(Data=rectangle_2.Rectangle)  # -> Branch0, Branch1, Branch2, Branch3, Branch4
geometry = Geometry([explode_tree_2.Branch0, explode_tree_2.Branch1, explode_tree_2.Branch2, explode_tree_2.Branch3, explode_tree_2.Branch4])
geometry_2 = Geometry(geometry)
surface_2 = Surface(geometry)
custom_preview_2 = CustomPreview(Geometry=geometry_2, Material=explode_tree.Branch0)
area_5 = Area(Geometry=geometry_2, UseTasks=False)  # -> Area, Centroid
sort_list = SortList(Keys=area_5.Area, ValuesValuesA=area_5.Centroid)  # -> Keys, reverse(ValuesValuesA)
sort_list_2 = SortList(Keys=area_5.Area, ValuesValuesA=geometry_2)  # -> Keys, reverse(ValuesValuesA)
cross_reference = CrossReference(ListListA=area_5.Centroid, ListListB=area_5.Centroid, CrossMode=5)  # -> graft(ListListA), graft(ListListB)
partition_list_2 = PartitionList(List=sort_list_2.ValuesValuesA, Size=Slider(2, range=0..10))  # -> simplify(Chunks)
list_item_5 = ListItem(List=partition_list_2, Index=0, Wrap=True)  # -> Item, Item1
curve_4 = Curve([list_item_5.Item, list_item_5.Item1])
curve_5 = Curve(list_item_5.Item1)
point_7 = Point([cross_reference.ListListA, cross_reference.ListListB])
explode_tree_3 = ExplodeTree(Data=partition_list_2)  # -> Branch0, Branch1, Branch2, Branch3, Branch4, Branch5, Branch6, Branch7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
nestingtwoitems = CSharpScript(
    x=curve_4,
    Reference="C:\Program Files\Common Files\McNeel\Rhinoceros\6.0\Plug-ins\ClipperPlugin (bae0724c-d28b-4d54-9b02-806b19d157c2)\0.0.2.3\clipper-0.2.3-rhino6\ClipperTools.dll")  # -> A; inputs x: list of Polyline
# ---------- nestingtwoitems: C# usings ----------
using System.IO;
using System.Linq;
using System.Data;
using System.Drawing;
using System.Reflection;
using System.Windows.Forms;
using System.Xml;
using System.Xml.Linq;
using System.Runtime.InteropServices;

using Rhino.DocObjects;
using Rhino.Collections;
using GH_IO;
using GH_IO.Serialization;
using StudioAvw.Geometry;
using ClipperLib;
# ---------- nestingtwoitems: C# ----------
    // We want to cast(change from one data type to another) our list of polylines to curves, so that
    // we can call the AreaMassProperties class and its method .Compute to get the area of the polygons
    // after that we can now create a List of KeyValuePair to assign the area of our polygons to our
    // polygons so that we can sort them later according to their areas.
    /*
    List<Curve> one = new List<Curve>();
    double[] areas = new Double[x.Count];
    var curves = new List<KeyValuePair<Polyline, double>>();

    for(int i = 0; i < x.Count; ++i)
    {

    one.Add(x.ElementAt(i).ToNurbsCurve());
    areas[i] = AreaMassProperties.Compute(one.ElementAt(i)).Area;
    curves.Add(new KeyValuePair<Polyline, double>(x.ElementAt(i), areas[i]));

    }

    // Here is where the sorting according to area values takes place.
    curves.Sort(Compare1);
    curves.Reverse();
    // We retrieve a list of curves from our List of KeyValuePairs
    List<Polyline> curve = (from kvp in curves select kvp.Key).Distinct().ToList();
    curve.Reverse();
    */

    List<Polyline> curve = x;

    // We create and populate trees with the points of the curves, so that we can
    // sort each of the lower left points of each of the curves according to the
    // sum of their Xs and Ys positions.
    List<List<Point3d>> pts = new List<List<Point3d>>();
    DataTree<Point3d> tree = new DataTree<Point3d>();
    DataTree<double> treeSum = new DataTree<double>();
    var points = new DataTree<KeyValuePair<Point3d, double>>();
    var point = new List<Point3d>[curve.Count];
    DataTree<Point3d> treeLowerLeft = new DataTree<Point3d>();

    for(int i = 0; i < curve.Count; ++i)
    {

      pts.Add(curve[i].ToList());
      pts[i].RemoveAt(pts[i].Count - 1);
      GH_Path path = new GH_Path(i);

      for(int j = 0; j < pts[i].Count; ++j)
      {

        tree.Add(pts[i][j], path);
        treeSum.Add(pts[i][j].X + pts[i][j].Y, path);

        points.Add(new KeyValuePair<Point3d, double>(tree.Branch(i)[j], treeSum.Branch(i)[j]), path);

        points.Branch(i).Sort(Compare2);
        points.Branch(i).Reverse();
        point[i] = (from kvp in points.Branch(i) select kvp.Key).Distinct().ToList();
        point[i].Reverse();

      }

    }

    for(int i = 0; i < tree.BranchCount; ++i)
      for(int j = 0; j < tree.Branch(i).Count; ++j)
      {

        treeLowerLeft.Add(point[i][j], new GH_Path(i));

      }

    var treeOut = new DataTree<Point3d>();

    for(int i = 0; i < treeLowerLeft.BranchCount; ++i)
      for(int j = 0; j < treeLowerLeft.Branch(i).Count; ++j)
      {

        treeOut.Add(treeLowerLeft.Branch(i)[0], new GH_Path(i));

      }

    /*
    // Create the data structures and initialize them
    DataTree<Point3d> points = new DataTree<Point3d>();
    List<List<Point3d>> lists = new List<List<Point3d>>();

    // Fill the nested list with the list of points
    for(int i = 0; i < x.Count; ++i)
    {

      lists.Add(x[i].ToList());

    }

    // Fill the data tree with the list of points
    for(int i = 0; i < lists.Count; ++i)
    {

      var path = new GH_Path(i);

      for(int j = 0; j < lists[i].Count; ++j )
      {

        points.Add(lists[i][j], path);

      }

    }
    */


    // No Fit Polygon from minkowsky difference using the clipper lib
    Polyline polyOne = curve[0];
    Polyline polyTwo = curve[curve.Count - 1];

    Point3d center = treeOut.Branch(0).ElementAt(0);
    Vector3d zAxis = Vector3d.ZAxis;
    Plane p = new Rhino.Geometry.Plane(center, zAxis);

    double tolerance = 1e-8;
    List<Polyline> outCurves = new List<Polyline>();
    List<Polyline> outDisplacedCurves = new List<Polyline>();
    foreach(List<IntPoint> path in ClipperLib.Clipper.MinkowskiDiff(polyOne.ToPath2D(p, tolerance), polyTwo.ToPath2D(p, tolerance)))
    {

      Polyline plSum = path.ToPolyline(p, tolerance, true);
      outCurves.Add(plSum);

    }

    Polyline NFP = outCurves[0];

    //B = NFP;

    List<Point3d> ptNFP;
    ptNFP = NFP.ToList();
    ptNFP.RemoveAt(0);

    List<Vector3d> vectors = new List<Vector3d>();
    for(int i = 0; i < ptNFP.Count; ++i)
    {

      vectors.Add(new Vector3d(ptNFP.ElementAt(i) - treeOut.Branch(0)[0]));

    }

    List<Curve> translated = new List<Curve>();
    Polyline[] polys = new Polyline[ptNFP.Count];
    List<List<Point3d>> polyPoint = new List<List<Point3d>>();

    List<Point3d> pointsA = new List<Point3d>();
    pointsA = polyTwo.ToList();
    pointsA.RemoveAt(pointsA.Count - 1);
    DataTree<Point3d> polyPoints = new DataTree<Point3d>();
    DataTree<Point3d> APoints = new DataTree<Point3d>();
    for(int i = 0; i < ptNFP.Count; ++i)
    {

      var path = new GH_Path(i);
      Curve oney = polyOne.ToNurbsCurve();
      oney.Translate(vectors.ElementAt(i));
      translated.Add(oney);
      translated.ElementAt(i).TryGetPolyline(out polys[i]);
      polyPoint.Add(polys[i].ToList());

      for(int j = 0; j < polyPoint[i].Count - 1; ++j)
      {

        polyPoints.Add(polyPoint[i][j], path);

      }

    }

    for(int i = 0; i < ptNFP.Count; ++i)
      for(int j = 0; j < pointsA.Count; ++j)
      {

        var path = new GH_Path(i);
        APoints.Add(pointsA[j], path);

      }

    for(int i = 0; i < polyPoints.BranchCount; ++i)
      for(int j = 0; j < polyPoints.Branch(i).Count; ++j)
      {

        APoints.Add(polyPoints.Branch(i)[j], new GH_Path(i));

      }

    var list = new Grasshopper.Kernel.Geometry.Node2List[APoints.BranchCount];
    var polyLines = new Polyline[APoints.BranchCount];
    var curvesConvex = new Curve[APoints.BranchCount];
    var convexArea = new Double[APoints.BranchCount];
    var convexSort = new List<KeyValuePair<Polyline, double>>();
    var hullSort = new List<KeyValuePair<Polyline, double>>();

    for(int i = 0; i < APoints.BranchCount; ++i)
    {

      list[i] = new Grasshopper.Kernel.Geometry.Node2List(APoints.Branch(i));
      polyLines[i] = Grasshopper.Kernel.Geometry.ConvexHull.Solver.ComputeHull(list[i]);
      curvesConvex[i] = polyLines[i].ToNurbsCurve();
      convexArea[i] = AreaMassProperties.Compute(curvesConvex[i]).Area;
      convexSort.Add(new KeyValuePair<Polyline, double>(polys[i], convexArea[i]));
      hullSort.Add(new KeyValuePair<Polyline, double>(polyLines[i], convexArea[i]));

    }

    // Output the polygons with no convex hull
    // Here is where the sorting according to area values takes place.
    convexSort.Sort(Compare1);
    convexSort.Reverse();
    // We retrieve a list of polylines from our List of KeyValuePairs
    List<Polyline> polyFinal = (from kvp in convexSort select kvp.Key).Distinct().ToList();
    polyFinal.Reverse();

    // Output the convex hull polygons
    // Here is where the sorting according to area values takes place.
    hullSort.Sort(Compare1);
    hullSort.Reverse();
    // We retrieve a list of polylines from our List of KeyValuePairs
    List<Polyline> hullFinal = (from kvp in hullSort select kvp.Key).Distinct().ToList();
    hullFinal.Reverse();

    A = polyFinal;
# ---------- nestingtwoitems: C# additional code ----------
  static int Compare1(KeyValuePair<Polyline, double> a, KeyValuePair<Polyline, double> b)
  {

    return a.Value.CompareTo(b.Value);

  }

  static int Compare2(KeyValuePair<Point3d, double> a, KeyValuePair<Point3d, double> b)
  {

    return a.Value.CompareTo(b.Value);

  }
# ---------- end nestingtwoitems ----------
list_item_6 = ListItem(List=point_7, Index=0, Wrap=True)  # -> Item, Item1
geometry_3 = Geometry(explode_tree_3.Branch0)
list_item_7 = ListItem(List=nestingtwoitems, Index=Slider(0, range=0..3), Wrap=True)
vector_2pt = Vector2Pt(PointA=list_item_6.Item, PointB=list_item_6.Item1, Unitize=False)  # -> Vector, Length
rectanglew_h = CSharpScript(rectangleList=sort_list_2.ValuesValuesA)  # -> Width, Height; inputs rectangleList: list of Rectangle3d
# ---------- rectanglew_h: C# ----------
    var widths = new List<double>();
    var heights = new List<double>();
    
    for( int i = 0; i < rectangleList.Count; ++i )
    {
    
      widths.Add( rectangleList[i].Width );
      heights.Add( rectangleList[i].Height );
    
    }
    
    Width = widths;
    Height = heights;
# ---------- end rectanglew_h ----------
area_6 = Area(Geometry=geometry_3, UseTasks=False)  # -> Area, Centroid
area_7 = Area(Geometry=[curve_5, list_item_7])  # -> Area, Centroid
panel_4 = Panel(rectanglew_h.Height)
panel_5 = Panel(rectanglew_h.Width)
vector_display = VectorDisplay(Anchor=list_item_6.Item, Vector=vector_2pt.Vector)
list_item_8 = ListItem(List=sort_list_2.ValuesValuesA, Index=Slider(0, range=0..12), Wrap=True)  # -> Item, Item1, Item2, Item3, Item4, Item5, Item6, Item7
mass_addition_4 = MassAddition(Input=area_7.Area)  # -> Result, PartialResults
multiplication_4 = Multiplication(A=rectanglew_h.Width, B=0.5)
circle = Circle(Plane=sort_list.ValuesValuesA, Radius=multiplication_4)
curve_6 = Curve(list_item_8.Item)
curve_7 = Curve(list_item_8.Item1)
curve_8 = Curve(list_item_8.Item2)
curve_9 = Curve(list_item_8.Item3)
curve_10 = Curve(list_item_8.Item4)
curve_11 = Curve(list_item_8.Item5)
curve_12 = Curve(list_item_8.Item6)
curve_13 = Curve(list_item_8.Item7)
number_slider_2 = Slider(0.25, range=0..10)  # disabled
number_slider_3 = Slider(1.271, range=0..10)  # disabled
merge = Merge(Data1=curve_6, Data2=curve_7)
nestingtwoitemsoptimized = CSharpScript(
    x=merge,
    Reference="C:\PROGRAM FILES\COMMON FILES\MCNEEL\RHINOCEROS\6.0\PLUG-INS\CLIPPERPLUGIN (BAE0724C-D28B-4D54-9B02-806B19D157C2)\0.0.2.3\CLIPPER-0.2.3-RHINO6\ClipperTools.dll")  # -> A, B; inputs x: list of Polyline
# ---------- nestingtwoitemsoptimized: C# ----------
    List<Polyline> curve = x;

    // We create and populate trees with the points of the curves, so that we can
    // sort each of the lower left points of each of the curves according to the
    // sum of their Xs and Ys positions.
    List<List<Point3d>> pts = new List<List<Point3d>>();
    var points = new DataTree<KeyValuePair<Point3d, double>>();
    var point = new List<Point3d>[curve.Count];
    var treeOut = new DataTree<Point3d>();
    for(int i = 0; i < curve.Count; ++i)
    {

      pts.Add(curve[i].ToList());
      pts[i].RemoveAt(pts[i].Count - 1);
      GH_Path path = new GH_Path(i);

      for(int j = 0; j < pts[i].Count; ++j)
      {

        points.Add(new KeyValuePair<Point3d, double>(pts[i][j], pts[i][j].X + pts[i][j].Y), path);

        points.Branch(i).Sort(Compare2);
        points.Branch(i).Reverse();
        point[i] = (from kvp in points.Branch(i) select kvp.Key).Distinct().ToList();
        point[i].Reverse();
        treeOut.Add(point[i][0], new GH_Path(i));

      }

    }

    // No Fit Polygon from minkowsky difference using the clipper lib
    Polyline polyOne = curve[0];
    Polyline polyTwo = curve[curve.Count - 1];

    Point3d center = treeOut.Branch(0).ElementAt(0);
    Vector3d zAxis = Vector3d.ZAxis;
    Plane p = new Rhino.Geometry.Plane(center, zAxis);

    double tolerance = 1e-8;
    List<Polyline> outCurves = new List<Polyline>();
    List<Polyline> outDisplacedCurves = new List<Polyline>();
    foreach(List<IntPoint> path in ClipperLib.Clipper.MinkowskiDiff(polyOne.ToPath2D(p, tolerance), polyTwo.ToPath2D(p, tolerance)))
    {

      Polyline plSum = path.ToPolyline(p, tolerance, true);
      outCurves.Add(plSum);

    }

    Polyline NFP = outCurves[0];
    List<Point3d> ptNFP;
    ptNFP = NFP.ToList();
    ptNFP.RemoveAt(0);

    List<Vector3d> vectors = new List<Vector3d>();
    for(int i = 0; i < ptNFP.Count; ++i)
    {

      vectors.Add(new Vector3d(ptNFP.ElementAt(i) - treeOut.Branch(0)[0]));

    }

    List<Curve> translated = new List<Curve>();
    Polyline[] polys = new Polyline[ptNFP.Count];
    List<List<Point3d>> polyPoint = new List<List<Point3d>>();

    List<Point3d> pointsA = new List<Point3d>();
    pointsA = polyTwo.ToList();
    pointsA.RemoveAt(pointsA.Count - 1);
    DataTree<Point3d> polyPoints = new DataTree<Point3d>();
    DataTree<Point3d> APoints = new DataTree<Point3d>();
    for(int i = 0; i < ptNFP.Count; ++i)
    {

      var path = new GH_Path(i);
      Curve oney = polyOne.ToNurbsCurve();
      oney.Translate(vectors.ElementAt(i));
      translated.Add(oney);
      translated.ElementAt(i).TryGetPolyline(out polys[i]);
      polyPoint.Add(polys[i].ToList());

      for(int j = 0; j < polyPoint[i].Count - 1; ++j)
      {

        polyPoints.Add(polyPoint[i][j], path);
        APoints.Add(pointsA[j], path);
        APoints.Add(polyPoints.Branch(i)[j], path);

      }

    }
    
    var polyLines = new Polyline[APoints.BranchCount];
    var convexArea = new Double[APoints.BranchCount];
    var convexSort = new List<KeyValuePair<Polyline, double>>();
    var hullSort = new List<KeyValuePair<Polyline, double>>();

    for(int i = 0; i < APoints.BranchCount; ++i)
    {

      polyLines[i] = Grasshopper.Kernel.Geometry.ConvexHull.Solver.ComputeHull(new Grasshopper.Kernel.Geometry.Node2List(APoints.Branch(i)));
      convexArea[i] = AreaMassProperties.Compute(polyLines[i].ToNurbsCurve()).Area;
      convexSort.Add(new KeyValuePair<Polyline, double>(polys[i], convexArea[i]));
      hullSort.Add(new KeyValuePair<Polyline, double>(polyLines[i], convexArea[i]));

    }

    // Output the polygons with no convex hull
    // Here is where the sorting according to area values takes place.
    convexSort.Sort(Compare1);
    convexSort.Reverse();
    // We retrieve a list of polylines from our List of KeyValuePairs
    List<Polyline> polyFinal = (from kvp in convexSort select kvp.Key).Distinct().ToList();
    polyFinal.Reverse();

    // Output the convex hull polygons
    // Here is where the sorting according to area values takes place.
    hullSort.Sort(Compare1);
    hullSort.Reverse();
    // We retrieve a list of polylines from our List of KeyValuePairs
    List<Polyline> hullFinal = (from kvp in hullSort select kvp.Key).Distinct().ToList();
    hullFinal.Reverse();

    A = polyFinal;
    B = hullFinal;
# ---------- nestingtwoitemsoptimized: C# additional code ----------
  static int Compare1(KeyValuePair<Polyline, double> a, KeyValuePair<Polyline, double> b)
  {

    return a.Value.CompareTo(b.Value);

  }

  static int Compare2(KeyValuePair<Point3d, double> a, KeyValuePair<Point3d, double> b)
  {

    return a.Value.CompareTo(b.Value);

  }
# ---------- end nestingtwoitemsoptimized ----------
nestingtwoitems_2 = CSharpScript(
    x=merge,
    Reference="C:\PROGRAM FILES\COMMON FILES\MCNEEL\RHINOCEROS\6.0\PLUG-INS\CLIPPERPLUGIN (BAE0724C-D28B-4D54-9B02-806B19D157C2)\0.0.2.3\CLIPPER-0.2.3-RHINO6\ClipperTools.dll")  # -> A, B; inputs x: list of Polyline
# ---------- nestingtwoitems_2: C# ----------
    // We want to cast(change from one data type to another) our list of polylines to curves, so that
    // we can call the AreaMassProperties class and its method .Compute to get the area of the polygons
    // after that we can now create a List of KeyValuePair to assign the area of our polygons to our
    // polygons so that we can sort them later according to their areas.
    /*
    List<Curve> one = new List<Curve>();
    double[] areas = new Double[x.Count];
    var curves = new List<KeyValuePair<Polyline, double>>();

    for(int i = 0; i < x.Count; ++i)
    {

      one.Add(x.ElementAt(i).ToNurbsCurve());
      areas[i] = AreaMassProperties.Compute(one.ElementAt(i)).Area;
      curves.Add(new KeyValuePair<Polyline, double>(x.ElementAt(i), areas[i]));

    }

    // Here is where the sorting according to area values takes place.
    curves.Sort(Compare1);
    //curves.Reverse();
    // We retrieve a list of curves from our List of KeyValuePairs
    List<Polyline> curve = (from kvp in curves select kvp.Key).Distinct().ToList();
    //curve.Reverse();
    */

    List<Polyline> curve = x;

    // We create and populate trees with the points of the curves, so that we can
    // sort each of the lower left points of each of the curves according to the
    // sum of their Xs and Ys positions.
    List<List<Point3d>> pts = new List<List<Point3d>>();
    DataTree<Point3d> tree = new DataTree<Point3d>();
    DataTree<double> treeSum = new DataTree<double>();
    var points = new DataTree<KeyValuePair<Point3d, double>>();
    var point = new List<Point3d>[curve.Count];
    DataTree<Point3d> treeLowerLeft = new DataTree<Point3d>();

    for(int i = 0; i < curve.Count; ++i)
    {

      pts.Add(curve[i].ToList());
      pts[i].RemoveAt(pts[i].Count - 1);
      GH_Path path = new GH_Path(i);

      for(int j = 0; j < pts[i].Count; ++j)
      {

        tree.Add(pts[i][j], path);
        treeSum.Add(pts[i][j].X + pts[i][j].Y, path);

        points.Add(new KeyValuePair<Point3d, double>(tree.Branch(i)[j], treeSum.Branch(i)[j]), path);

        points.Branch(i).Sort(Compare2);
        points.Branch(i).Reverse();
        point[i] = (from kvp in points.Branch(i) select kvp.Key).Distinct().ToList();
        point[i].Reverse();

      }

    }

    for(int i = 0; i < tree.BranchCount; ++i)
      for(int j = 0; j < tree.Branch(i).Count; ++j)
      {

        treeLowerLeft.Add(point[i][j], new GH_Path(i));

      }

    var treeOut = new DataTree<Point3d>();

    for(int i = 0; i < treeLowerLeft.BranchCount; ++i)
      for(int j = 0; j < treeLowerLeft.Branch(i).Count; ++j)
      {

        treeOut.Add(treeLowerLeft.Branch(i)[0], new GH_Path(i));

      }

    /*
    // Create the data structures and initialize them
    DataTree<Point3d> points = new DataTree<Point3d>();
    List<List<Point3d>> lists = new List<List<Point3d>>();

    // Fill the nested list with the list of points
    for(int i = 0; i < x.Count; ++i)
    {

      lists.Add(x[i].ToList());

    }

    // Fill the data tree with the list of points
    for(int i = 0; i < lists.Count; ++i)
    {

      var path = new GH_Path(i);

      for(int j = 0; j < lists[i].Count; ++j )
      {

        points.Add(lists[i][j], path);

      }

    }
    */


    // No Fit Polygon from minkowsky difference using the clipper lib
    Polyline polyOne = curve[0];
    Polyline polyTwo = curve[curve.Count - 1];

    Point3d center = treeOut.Branch(0).ElementAt(0);
    Vector3d zAxis = Vector3d.ZAxis;
    Plane p = new Rhino.Geometry.Plane(center, zAxis);

    double tolerance = 1e-8;
    List<Polyline> outCurves = new List<Polyline>();
    List<Polyline> outDisplacedCurves = new List<Polyline>();
    foreach(List<IntPoint> path in ClipperLib.Clipper.MinkowskiDiff(polyOne.ToPath2D(p, tolerance), polyTwo.ToPath2D(p, tolerance)))
    {

      Polyline plSum = path.ToPolyline(p, tolerance, true);
      outCurves.Add(plSum);

    }

    Polyline NFP = outCurves[0];

    //B = NFP;

    List<Point3d> ptNFP;
    ptNFP = NFP.ToList();
    ptNFP.RemoveAt(0);

    List<Vector3d> vectors = new List<Vector3d>();
    for(int i = 0; i < ptNFP.Count; ++i)
    {

      vectors.Add(new Vector3d(ptNFP.ElementAt(i) - treeOut.Branch(0)[0]));

    }

    List<Curve> translated = new List<Curve>();
    Polyline[] polys = new Polyline[ptNFP.Count];
    List<List<Point3d>> polyPoint = new List<List<Point3d>>();

    List<Point3d> pointsA = new List<Point3d>();
    pointsA = polyTwo.ToList();
    pointsA.RemoveAt(pointsA.Count - 1);
    DataTree<Point3d> polyPoints = new DataTree<Point3d>();
    DataTree<Point3d> APoints = new DataTree<Point3d>();
    for(int i = 0; i < ptNFP.Count; ++i)
    {

      var path = new GH_Path(i);
      Curve oney = polyOne.ToNurbsCurve();
      oney.Translate(vectors.ElementAt(i));
      translated.Add(oney);
      translated.ElementAt(i).TryGetPolyline(out polys[i]);
      polyPoint.Add(polys[i].ToList());

      for(int j = 0; j < polyPoint[i].Count - 1; ++j)
      {

        polyPoints.Add(polyPoint[i][j], path);

      }

    }

    for(int i = 0; i < ptNFP.Count; ++i)
      for(int j = 0; j < pointsA.Count; ++j)
      {

        var path = new GH_Path(i);
        APoints.Add(pointsA[j], path);

      }

    for(int i = 0; i < polyPoints.BranchCount; ++i)
      for(int j = 0; j < polyPoints.Branch(i).Count; ++j)
      {

        APoints.Add(polyPoints.Branch(i)[j], new GH_Path(i));

      }

    var list = new Grasshopper.Kernel.Geometry.Node2List[APoints.BranchCount];
    var polyLines = new Polyline[APoints.BranchCount];
    var curvesConvex = new Curve[APoints.BranchCount];
    var convexArea = new Double[APoints.BranchCount];
    var convexSort = new List<KeyValuePair<Polyline, double>>();
    var hullSort = new List<KeyValuePair<Polyline, double>>();

    for(int i = 0; i < APoints.BranchCount; ++i)
    {

      list[i] = new Grasshopper.Kernel.Geometry.Node2List(APoints.Branch(i));
      polyLines[i] = Grasshopper.Kernel.Geometry.ConvexHull.Solver.ComputeHull(list[i]);
      curvesConvex[i] = polyLines[i].ToNurbsCurve();
      convexArea[i] = AreaMassProperties.Compute(curvesConvex[i]).Area;
      convexSort.Add(new KeyValuePair<Polyline, double>(polys[i], convexArea[i]));
      hullSort.Add(new KeyValuePair<Polyline, double>(polyLines[i], convexArea[i]));

    }

    // Output the polygons with no convex hull
    // Here is where the sorting according to area values takes place.
    convexSort.Sort(Compare1);
    convexSort.Reverse();
    // We retrieve a list of polylines from our List of KeyValuePairs
    List<Polyline> polyFinal = (from kvp in convexSort select kvp.Key).Distinct().ToList();
    polyFinal.Reverse();

    // Output the convex hull polygons
    // Here is where the sorting according to area values takes place.
    hullSort.Sort(Compare1);
    hullSort.Reverse();
    // We retrieve a list of polylines from our List of KeyValuePairs
    List<Polyline> hullFinal = (from kvp in hullSort select kvp.Key).Distinct().ToList();
    hullFinal.Reverse();

    A = polyFinal;
    B = hullFinal;
# ---------- nestingtwoitems_2: C# additional code ----------
  static int Compare1(KeyValuePair<Polyline, double> a, KeyValuePair<Polyline, double> b)
  {

    return a.Value.CompareTo(b.Value);

  }

  static int Compare2(KeyValuePair<Point3d, double> a, KeyValuePair<Point3d, double> b)
  {

    return a.Value.CompareTo(b.Value);

  }
# ---------- end nestingtwoitems_2 ----------
pauls = Pauls(L=number_slider_2, A=number_slider_3)  # disabled
number_slider_4 = Slider(2, range=0..3)
curve_14 = Curve(pauls)  # disabled
list_item_9 = ListItem(List=nestingtwoitems_2.A, Index=number_slider_4, Wrap=True)
list_item_10 = ListItem(List=nestingtwoitems_2.B, Index=number_slider_4, Wrap=True)
merge_2 = Merge(Data1=curve_8, Data2=list_item_10)
nestingtwoitems_3 = CSharpScript(
    x=merge_2,
    Reference="C:\PROGRAM FILES\COMMON FILES\MCNEEL\RHINOCEROS\6.0\PLUG-INS\CLIPPERPLUGIN (BAE0724C-D28B-4D54-9B02-806B19D157C2)\0.0.2.3\CLIPPER-0.2.3-RHINO6\ClipperTools.dll")  # -> A, B; inputs x: list of Polyline; same code as nestingtwoitems_2
number_slider_5 = Slider(1, range=0..3)
list_item_11 = ListItem(List=nestingtwoitems_3.A, Index=number_slider_5, Wrap=True)
list_item_12 = ListItem(List=nestingtwoitems_3.B, Index=number_slider_5, Wrap=True)
merge_3 = Merge(Data1=curve_9, Data2=list_item_12)
nestingtwoitems_4 = CSharpScript(
    x=merge_3,
    Reference="C:\PROGRAM FILES\COMMON FILES\MCNEEL\RHINOCEROS\6.0\PLUG-INS\CLIPPERPLUGIN (BAE0724C-D28B-4D54-9B02-806B19D157C2)\0.0.2.3\CLIPPER-0.2.3-RHINO6\ClipperTools.dll")  # -> A, B; inputs x: list of Polyline; same code as nestingtwoitems_2
number_slider_6 = Slider(1, range=0..3)
list_item_13 = ListItem(List=nestingtwoitems_4.A, Index=number_slider_6, Wrap=True)
merge_4 = Merge(Data1=curve_7, Data2=list_item_9, Data3=list_item_11, Data4=list_item_13)
list_item_14 = ListItem(List=nestingtwoitems_4.B, Index=number_slider_6, Wrap=True)

# ==== cluster Pauls
L = ClusterInput()
A = ClusterInput()
crv = ClusterInput()
crv_2 = Curve(flatten(crv))
divlength = DivideLength(Curve=crv_2, Length=L)  # -> Points, Tangents, Parameters
Z = UnitZ(Factor=1)
lng = ListLength(List=divlength.Points)  # -> flatten(Length)
divide = DivideCurve(Curve=crv_2, Count=lng, Kinks=True)  # -> Points, Tangents, Parameters
xprod = CrossProduct(VectorA=divide.Tangents, VectorB=Z, Unitize=False)  # -> Vector, Length
amp = Amplitude(Vector=xprod.Vector, Amplitude=A)
move = Move(Geometry=divide.Points, Motion=amp)  # -> Geometry, Transform
vdis = VectorDisplay(Anchor=divide.Points, Vector=amp)
cir = Circle(Plane=move.Geometry, Radius=A)  # -> graft(Circle)
ccx = CurveCurve(CurveA=cir, CurveB=crv_2)  # -> simplify(Points), ParamsA, ParamsB
pshift = ShiftPaths(Data=ccx.Points, Offset=-1)
lng_2 = ListLength(List=pshift)
equals = Equality(FirstNumber=lng_2, SecondNumber=Slider(1, range=0..4))  # -> Equality, Inequality
dispatch = Dispatch(List=flatten(divide.Points), DispatchPattern=flatten(equals.Equality))  # -> ListA, ListB
pt = Point(dispatch.ListA)
c_script = CSharpScript(pt=pt, t=L)  # -> out, A, B; inputs pt: list of Point3d, t: Double
# ---------- c_script: C# usings ----------
using System.IO;
using System.Linq;
using System.Data;
using System.Drawing;
using System.Reflection;
using System.Windows.Forms;
using System.Xml;
using System.Xml.Linq;
using System.Runtime.InteropServices;

using Rhino.DocObjects;
using Rhino.Collections;
using GH_IO;
using GH_IO.Serialization;
# ---------- c_script: C# ----------
    List<Point3d> PtOut = new List<Point3d>();
    Point3d temp = pt[0];
    int ind1 = pt.IndexOf(temp);
    PtOut.Add(temp);
    pt.RemoveAt(0);
    double d = new double();

    int N = pt.Count;

    for(int i = 0; i < N;i++){


      if(ind1 == pt.Count ){
        ind1 = 0;
      }



      d = temp.DistanceTo(pt[ind1]);

      if(d > 1.5 * t){
        temp = Point3dList.ClosestPointInList(pt, temp);
        ind1 = pt.IndexOf(temp);
      }
      else{
        temp = pt[ind1];
      }

      PtOut.Add(temp);
      pt.Remove(temp);
    }
    PtOut.Add(PtOut[0]);
    Polyline Poly = new Polyline(PtOut);

    A = Poly;
    B = PtOut;
# ---------- end c_script ----------
crv_3 = Curve(c_script.A)
crv_4 = ClusterOutput(crv_3)

# ==== cluster Att_toR
B = ClusterInput()
att = ClusterInput()
att_2 = Attributes(att)
prgm = Programme(Attributes=att_2)  # -> Tags, Areas, Colors, Legends
expression = Expression(x=prgm.Areas, Expression="Sqrt(x/π)")
multiplication = Multiplication(A=expression, B=B)
material = CreateMaterial(Diffuse=prgm.Colors, Specular=RGB(255, 255, 255), Emission=RGB(0, 0, 0), Transparency=0.5, Shine=0)
M = ClusterOutput(material)
R = ClusterOutput(multiplication)
