# Grasshopper definition MedialAxis[0].gh (Grasshopper 1.0.7)
# plug-ins: SpacePartition, ClipperComponents, Kangaroo2 Components

# Medial Axis definition by Daniel Piker 10/09/09
# 
# spacesymmetrystructure.wordpress.com
panel = Panel("200")
nurbs = Curve(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)
crv = Curve(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)
crv_2 = Curve(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)
crv_3 = Curve(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)
divide = DivideCurve(Curve=crv, Count=Slider(200, range=0..1000), Kinks=False)  # -> Points, Tangents, Parameters
flatten = FlattenTree(Tree=divide.Points, Path="{0}")
bbox = BoundingBox(Content=crv, Plane=PlaneXY(0, 0, 0))  # -> Box, Box_2
voronoi = Voronoi(Points=flatten, Boundary=bbox.Box, BruteForceOverride=False)
disc = Discontinuity(Curve=voronoi, Level=Slider(3, range=0..3))  # -> Points, Parameters
shatter = Shatter(Curve=graft(voronoi), Parameters=disc.Parameters, UseTasks=False)
flatten_2 = FlattenTree(Tree=shatter, Path="{0}")
ccx = CurveCurve(CurveA=flatten_2, CurveB=crv, UseTasks=False)  # -> Points, ParamsA, ParamsB
graft = GraftTree(Tree=flatten_2, IncludeEmptyLists=True, IncludeNullItems=True)
null = NullItem(Item=ccx.Points)  # -> NullFlags, InvalidFlags, Description
dispatch = Dispatch(List=graft, DispatchPattern=null.NullFlags)  # -> ListA, ListB
crv_4 = Curve(flatten(dispatch.ListA))
dupln = RemoveDuplicateLines(Lines=crv_4, Tolerance=0.01)
inside = PointWithinCurve(crvs=dupln, crv=crv, Parallel=Toggle(True))  # -> A; inputs crvs: list of Curve, crv: Curve, Parallel: Boolean
# ---------- inside: C# usings ----------
using System.IO;
using System.Linq;
using System.Data;
using System.Drawing;
using System.Reflection;
using System.Windows.Forms;
using System.Xml;
using System.Xml.Linq;
using System.Runtime.InteropServices;

using Rhino.DocObjects;
using Rhino.Collections;
using GH_IO;
using GH_IO.Serialization;
# ---------- inside: C# ----------
    var inside = new List<Curve>();

    Curve temp = null;

    Polyline poly = new Polyline();

    Print(crv.IsPolyline().ToString());

    //if( crv.IsPolyline() == false )
    {

      if( !crv.TryGetPolyline(out poly) )
      {

        poly = crv.ToPolyline(0.001, 0.001, 0.001, 1000.00).ToPolyline();

      }

    }

    int size = crvs.Count;

    if( Parallel == true )
    {

      bool[] insideFlag = new bool[size];

      System.Threading.Tasks.Parallel.For(0, size, i =>
        {

        //temp = crvs[i];

        if( IsInside(crvs[i].PointAt(0), poly) )

          insideFlag[i] = true;

        else
        {

          insideFlag[i] = false;

        }

        });

      for( int i = 0; i < size; ++i )
      {

        if( insideFlag[i] == true )

          inside.Add(crvs[i]);

      }

    }

    else
    {

      for( int i = 0; i < size; ++i )
      {

        temp = crvs[i];

        if( IsInside(temp.PointAt(0), poly) )

          inside.Add(temp);

      }

    }

    A = inside;
# ---------- inside: C# additional code ----------
  bool IsInside (Point3d pt, Polyline crv)
  {
    Point3d pt1, pt2;
    bool oddNodes = false;

    for (int i = 0; i < crv.SegmentCount; i++) //for each contour line
    {

      pt1 = crv.SegmentAt(i).From; //get start and end pt
      pt2 = crv.SegmentAt(i).To;

      if ( (pt1[1] < pt[1] && pt2[1] >= pt[1] || pt2[1] < pt[1] && pt1[1] >= pt[1]) && (pt1[0] <= pt[0] || pt2[0] <= pt[0]) ) //if pt is between pts in y, and either of pts is before pt in x
        oddNodes ^= ( pt2[0] + (pt[1] - pt2[1]) * (pt1[0] - pt2[0]) / (pt1[1] - pt2[1]) < pt[0] ); //^= is xor
      //end.X + (pt-end).Y   * (start-end).X  /(start-end).Y   <   pt.X
    }


    if (!oddNodes)
    {
      double minDist = 1e10;
      for (int i = 0; i < crv.SegmentCount; i++) {
        Point3d cp = crv.SegmentAt(i).ClosestPoint(pt, true);
        //Point3d cp = mvContour[i].closestPoint(pt);
        //minDist = min(minDist, cp.distance(pt));
        minDist = Math.Min(minDist, cp.DistanceTo(pt));
      }
      if (minDist < 1e-10)
        return true;
    }

    if(oddNodes) return true;

    return false;
  }
# ---------- end inside ----------
crv_5 = Curve(inside)
len = Length(Curve=crv_5)
disc_2 = Discontinuity(Curve=crv_5, Level=1)  # -> Points, Parameters
eval = EvaluateCurve(Curve=crv_5, Parameter=Slider(0.5, range=0..1))  # -> Point, Tangent, Angle
multiplication = Multiplication(A=len, B=Slider(0.5, range=0..1))
cir = Circle(Plane=eval.Point, Radius=multiplication)
spctopo = SpaceTopology(Curves=cir)
lng = ListLength(List=spctopo)
expression = Expression(x=flatten(lng), y=Slider(3, range=0..4), Expression="If( x ≥ y, False, True )")
cull = CullPattern(List=flatten(crv_5), CullPattern=expression)
crv_6 = Curve(crv)
join = JoinCurves(Curves=cull, Preserve=False)
offset = OffsetCurve(Curve=crv, Distance=Slider(-8.04, range=-10..0), Plane=PlaneXY(0, 0, 0), Corners=1)
intersectionculling = CSharpScript(Curves=join, CurveIn=offset, Tolerance=Slider(0.001, range=0..0.001), Parallel=Toggle(True))  # -> out, CurvesOut; inputs Curves: list of Curve, CurveIn: Curve, Tolerance: Double, Parallel: Boolean
# ---------- intersectionculling: C# ----------
    Rhino.Geometry.Intersect.CurveIntersections ixx;

    Curve temp = null;

    Polyline tempPoly = new Polyline();
    
    List<Curve> curvesOut = new List<Curve>();
    
    if( !CurveIn.TryGetPolyline(out tempPoly) )
    {

      tempPoly = CurveIn.ToPolyline(0.001, 0.001, 0.001, 1000.00).ToPolyline();

    }

    int size = Curves.Count;
    
    bool[] boolArray = new bool[size];

    if( Parallel == false )
    {

      for( int i = 0; i < size; ++i )
      {

        temp = Curves[i];

        ixx = Rhino.Geometry.Intersect.Intersection.CurveCurve(temp, CurveIn, Tolerance, Tolerance);

        if( IsInside(temp.PointAt(0), tempPoly) && ixx.Count == 0 )
        {

          curvesOut.Add(temp);

        }

      }

    }

    else
    {

      System.Threading.Tasks.Parallel.For(0, size, i =>
        {

        if( IsInside(Curves[i].PointAt(0), tempPoly) && Rhino.Geometry.Intersect.Intersection.CurveCurve(Curves[i], CurveIn, Tolerance, Tolerance).Count == 0 )
        {

          boolArray[i] = true;

        }

        else
        {

          boolArray[i] = false;

        }

        });
      
      for( int i = 0; i < size; ++i )
      {

        temp = Curves[i];
        
        if( boolArray[i] == true )
        {
         
          curvesOut.Add( temp );

        }
        
      }
          
    }
    
    CurvesOut = curvesOut;
# ---------- intersectionculling: C# additional code ----------
  bool IsInside (Point3d pt, Polyline crv)
  {
    Point3d pt1, pt2;
    bool oddNodes = false;

    for (int i = 0; i < crv.SegmentCount; i++) //for each contour line
    {

      pt1 = crv.SegmentAt(i).From; //get start and end pt
      pt2 = crv.SegmentAt(i).To;

      if ( (pt1[1] < pt[1] && pt2[1] >= pt[1] || pt2[1] < pt[1] && pt1[1] >= pt[1]) && (pt1[0] <= pt[0] || pt2[0] <= pt[0]) ) //if pt is between pts in y, and either of pts is before pt in x
        oddNodes ^= ( pt2[0] + (pt[1] - pt2[1]) * (pt1[0] - pt2[0]) / (pt1[1] - pt2[1]) < pt[0] ); //^= is xor
      //end.X + (pt-end).Y   * (start-end).X  /(start-end).Y   <   pt.X
    }


    if (!oddNodes)
    {
      double minDist = 1e10;
      for (int i = 0; i < crv.SegmentCount; i++) {
        Point3d cp = crv.SegmentAt(i).ClosestPoint(pt, true);
        //Point3d cp = mvContour[i].closestPoint(pt);
        //minDist = min(minDist, cp.distance(pt));
        minDist = Math.Min(minDist, cp.DistanceTo(pt));
      }
      if (minDist < 1e-10)
        return true;
    }

    if(oddNodes) return true;

    return false;
  }
# ---------- end intersectionculling ----------
disc_3 = Discontinuity(Curve=intersectionculling.CurvesOut, Level=1)  # -> Points, Parameters
flatten_3 = FlattenTree(Tree=disc_3.Points, Path="{0}")
number_slider = Slider(4, range=0..10)
dom = ConstructDomain(DomainStart=0, DomainEnd=1)
sortpoints = CSharpScript(PointsIn=flatten_3, Tolerance=Slider(0, range=0..1))  # -> out, PolylineOut; inputs PointsIn: list of Point3d, Tolerance: Double
# ---------- sortpoints: C# ----------
    /*double min = double.MaxValue, val = 0.0, dist = 0.0;

    var listOut = new List<Point3d>();

    for( int i = 0; i < PointsIn.Count - 1; ++i )
    {

      dist = PointsIn[i].DistanceTo( PointsIn[i + 1] );

      val = Math.Min( dist, min );

      if( val == dist )
      {

        listOut.Add( PointsIn[i + 1] );

      }

    }

    //var polyOut = new Polyline( listOut );

    PolylineOut = listOut;*/

    Point3d[] pointy = Point3d.SortAndCullPointList(PointsIn, Tolerance);

    PolylineOut = pointy;
# ---------- end sortpoints ----------
genemodifier = GenePoolModifier(GeneList="tParam", Count=number_slider, Domain=dom, Randomize=Button(), PercentageOfRandomization=Slider(1, range=0..1))
genemodifier_2 = GenePoolModifier(GeneList="tParamO", Count=number_slider, Domain=dom, Randomize=Button(), PercentageOfRandomization=Slider(1, range=0..1))
pline = PolyLine(Vertices=sortpoints.PolylineOut, Closed=False)
tparamo = GenePool(Decimals=2, Maximum=1, Minimum=0, Value=[0.3792282107, 0.7673605721, 1, 0.66])
tparam = GenePool(Decimals=2, Maximum=1, Minimum=0, Value=[0.4347906804, 0.55, 0, 1])
eval_2 = EvaluateCurve(Curve=reparameterize(crv_6), Parameter=tparamo)  # -> Point, Tangent, Angle
eval_3 = EvaluateCurve(Curve=reparameterize(pline), Parameter=tparam)  # -> Point, Tangent, Angle
crv_cp = CurveClosestPoint(Point=eval_3.Point, Curve=crv_6)  # -> Point, Parameter, Distance
ln = Line(StartPoint=eval_3.Point, EndPoint=eval_2.Point)
merge = Merge(Data1=pline, Data2=ln)
flatten_4 = FlattenTree(Tree=merge, Path="{0}")
number_slider_2 = Slider(2, range=0..2)
join_2 = JoinCurves(Curves=flatten_4, Preserve=False)
srfsplit = SurfaceSplit(Surface=crv_6, Curves=join_2)  # disabled
area = Area(Geometry=srfsplit, UseTasks=False)  # -> Area, Centroid; disabled
polyoffset = PolylineOffset(
    Polylines=join_2,
    Distance=Slider(1.301, range=0..10),
    Plane=Plane(origin=(0, 0, 0), x=(0, 0, 0), y=(0, 0, 0)),
    Tolerance=0.01,
    ClosedFillet=number_slider_2,
    OpenFillet=number_slider_2,
    Miter=2)  # -> Contour, Holes
panel_2 = Panel(area.Area)  # disabled
