# Grasshopper definition PhysicsPacking.gh (Grasshopper 1.0.7)
# plug-ins: SpacePartition, treesloth01, PTComponentLibrary, Kangaroo2 Components

# ---- group: InputData / Labels
text = Text(Tree({0;0}: ["Unidades sanitarias mujeres / privadas"], {0;1}: ["Unidades sanitarias hombres / privadas"], {0;2}: ["Cuarto de aseo "], {0;3}: ["Área de aseo de residuos"], {0;4}: ["Almacen General Insumos de Aseo "], {0;5}: ["Área de UPC-Rack"]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))

# ---- group: InputData / Areas
text_2 = Text(Tree({0;0}: ["3"], {0;1}: ["3"], {0;2}: ["6"], {0;3}: ["1"], {0;4}: ["5"], {0;5}: ["4"]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))

# ---- group: InputData / Topology
integer = Integer(Tree({0}: [7], {1}: [7], {2}: [3], {3}: [2, 11], {4}: [16, 21, 19], {5}: [19]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))

# ---- group: InputData / ID
text_3 = Text(Tree({0;0}: ["5"], {0;1}: ["5"], {0;2}: ["5"], {0;3}: ["5"], {0;4}: ["5"], {0;5}: ["5"]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))

# ---- group: InputData
number_slider = Slider(1, range=0..10)
path_mapper = PathMapper(text, source="{A;B}", target="{A}")
path_mapper_2 = PathMapper(text_2, source="{A;B}", target="{A}")
path_mapper_3 = PathMapper(integer, source="{A;B}", target="{A}")
path_mapper_4 = PathMapper(text_3, source="{A;B}", target="{A}")
prunebranches = CSharpScript(branches=path_mapper, howMany=number_slider)  # -> prunedTree, branchCounter; inputs branches: tree of String, howMany: Int32
# ---------- prunebranches: C# ----------
    var treeOut = new DataTree<string>();

    for( int i = 0; i < branches.BranchCount - howMany; ++i )
      treeOut.AddRange(branches.Branch(i), new GH_Path(i));

    prunedTree = treeOut;
    branchCounter = treeOut.BranchCount;
# ---------- end prunebranches ----------
prunebranches_2 = CSharpScript(branches=path_mapper_2, howMany=number_slider)  # -> prunedTree, branchCounter; inputs branches: tree of String, howMany: Int32; same code as prunebranches
mass_addition = MassAddition(Input=prunebranches_2.prunedTree)  # -> Result, PartialResults
number_slider_2 = Slider(4, range=0..10)
flatten_tree = FlattenTree(Tree=prunebranches_2.prunedTree, Path="{0}")
list_length = ListLength(List=flatten_tree)
integer_2 = Integer(list_length)

# ----
number_slider_3 = Slider(21, range=0..21)
number_slider_4 = Slider(5, range=0..5)
dom = ConstructDomain(DomainStart=expr("-x", number_slider_3), DomainEnd=number_slider_3)
dom_2 = ConstructDomain(DomainStart=expr("-x", number_slider_4), DomainEnd=number_slider_4)
rectangle = Rectangle(Plane=PlaneXY(0, 0, 0), XSize=dom_2, YSize=dom, Radius=0)  # -> Rectangle, Length
dom_3 = ConstructDomain(DomainStart=0, DomainEnd=1)
offset = OffsetCurve(Curve=rectangle.Rectangle, Distance=Slider(10, range=0..10), Plane=PlaneXY(0, 0, 0), Corners=1)
number_slider_5 = Slider(4, range=0..10)
genemodifier = GenePoolModifier(
    GeneList="VoroX",
    Count=number_slider_5,
    Domain=dom_3,
    Randomize=Button(),
    PercentageOfRandomization=Slider(1, range=0..1))
genemodifier_2 = GenePoolModifier(
    GeneList="VoroY",
    Count=number_slider_5,
    Domain=dom_3,
    Randomize=Button(),
    PercentageOfRandomization=Slider(1, range=0..1))
loft = Loft(
    Curves=flatten([offset, rectangle.Rectangle]),
    Options={Adjust=False, Closed=False, LoftEnds=0, LoftSimp=0, LoftType=0, Rebuild=10, Refit=0.01})
crv = Curve(rectangle.Rectangle)
division = Division(A=number_slider_3, B=Slider(3, range=0..50))
debrep = DeconstructBrep(Brep=loft)  # -> Faces, Edges, Vertices
division_2 = Division(A=number_slider_4, B=Slider(0.5, range=0..10))
wires = BrepWireframe(Brep=debrep.Faces, Density=-1)
vorox = GenePool(Decimals=2, Maximum=1, Minimum=0, Value=[0.54, 0.7, 0.27, 0.41])
voroy = GenePool(Decimals=2, Maximum=1, Minimum=0, Value=[0.36, 0.05, 0.26, 0.63])
ptsrfdomlen = SurfaceDomainLength(Surface=crv, ULength=division_2, VLength=division)
join = JoinCurves(Curves=wires, Preserve=False)  # -> flatten(Curves)
pt = ConstructPoint(XCoordinate=vorox, YCoordinate=voroy, ZCoordinate=0)
ptborders = GenerateBorders(Grid=ptsrfdomlen, PanelShape=0)  # -> simplify(flatten(Border))
evalsrf = EvaluateSurface(Surface=reparameterize(rectangle.Rectangle), Point=pt)  # -> Point, Normal, UDirection, VDirection, Frame
voronoi = Voronoi(Points=evalsrf.Point, Boundary=rectangle.Rectangle, BruteForceOverride=False)
item = ListItem(List=ptborders, Index=0, Wrap=True)
area = Area(Geometry=item, UseTasks=False)  # -> Area, Centroid
multiplication = Multiplication(A=area.Area, B=0.6)
spacepartition = SpacePartition(VoronoiIn=voronoi, GridIn=ptborders, AreaIn=multiplication, Tolerance=Slider(0.001, range=0..0.001))
sortxy = SortPointsXY(Grid=flatten(spacepartition))
pararunion = ParallelRegionUnion(Curves=spacepartition)
missing = MissingGridCells(CulledGrid=sortxy, OriginalGrid=ptborders)
mgtree = MergeTreeMissing(CulledGrid=pararunion, MissingGridCells=missing)
genemodifier_3 = GenePoolModifier(
    GeneList="Colours",
    Count=Slider(3, range=0..10),
    Domain=Domain(0, 255),
    Randomize=Button(),
    PercentageOfRandomization=Slider(1, range=0..1))
pararunion_2 = ParallelRegionUnion(Curves=mgtree)
colours = GenePool(Decimals=0, Maximum=255, Minimum=0, Value=[105.5423208, 124.4570353, 74.52132848])
construct_domain = ConstructDomain(DomainStart=Slider(0, range=0..100), DomainEnd=Slider(255, range=0..1000))
list_length_2 = ListLength(List=flatten(pararunion_2))

# ---- group: OriginalSilhouette
curve = Curve(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)

# ----
random = Random(Range=construct_domain, Number=list_length_2, Seed=colours, Integers=True)
pcen = PolygonCenter(Polyline=curve)  # -> CenterV, CenterE, CenterA
pcen_2 = PolygonCenter(Polyline=crv)  # -> CenterV, CenterE, CenterA
vec2pt = Vector2Pt(PointA=pcen.CenterE, PointB=pcen_2.CenterE, Unitize=False)  # -> Vector, Length
explode_tree = ExplodeTree(Data=random)  # -> Branch0, Branch1, Branch2
move = Move(Geometry=curve, Motion=vec2pt.Vector)  # -> Geometry, Transform
colour_rgb = ColourRGB(Alpha=Slider(255, range=0..255), Red=explode_tree.Branch0, Green=explode_tree.Branch1, Blue=explode_tree.Branch2)
parallelregionintersection = ParallelRegionIntersection(CurvesA=move.Geometry, CurvesB=pararunion_2)
srf = Surface(simplify(pararunion_2))
ma = MassAddition(Input=prunebranches_2.prunedTree)  # -> Result, PartialResults
custom_preview = CustomPreview(Geometry=srf, Material=graft(colour_rgb))
expression = Expression(x=ma.Result, Expression="( x * 0.3 ) + x")
expression_2 = Expression(x=expression, y=Slider(0.1, range=0..1), Expression="x * y")
addition = Addition(A=expression_2, B=expression)
subtraction = Subtraction(A=expression, B=expression_2)
area_2 = Area(Geometry=parallelregionintersection, UseTasks=False)  # -> simplify(Area), Centroid
expression_3 = Expression(x=area_2.Area, y=addition, z=subtraction, Expression="If( ( x ≤ y ) and ( x ≥ z ), 0, 1000 )")
ma_2 = MassAddition(Input=flatten(expression_3))  # -> Result, PartialResults
panel = Panel(area_2.Area)
panel_2 = Panel(ma_2.Result)
galapagos = Galapagos(fitness=ma_2, gene=[voroy, vorox])
lng = ListLength(List=prunebranches_2.prunedTree)
panel_3 = Panel("""EvaluateY
EvaluateY0
EvaluateY1
EvaluateY2""")
panel_4 = Panel("""EvaluateX
EvaluateX0
EvaluateX1
EvaluateX2""")
offsettree = CSharpScript(tree=pararunion_2, distance=Slider(20, range=-20..20))  # -> out, A; inputs tree: tree of Curve, distance: Double
# ---------- offsettree: C# ----------
    /*var curves = x.Offset(Plane.WorldXY, -10, 1e-3, CurveOffsetCornerStyle.Sharp);

    var list = new List<Curve>();
    list.AddRange(curves);
    list.Add(x);

    Brep[] brep = Brep.CreateFromLoft(list, Point3d.Unset, Point3d.Unset, LoftType.Normal, false);

    A = brep;*/

    int branches = tree.BranchCount;

    DataTree<Curve> treeOut = new DataTree<Curve>();
    GH_Path path = new GH_Path();

    for( int i = 0; i < branches; ++i )
    {

      path = new GH_Path(i);

      //for( int j = 0; j < tree.Branch(i).Count; ++j )
      {

        treeOut.Add(tree.Branch(i)[0], path);
        treeOut.AddRange(tree.Branch(i)[0].Offset(Plane.WorldXY, distance, 1e-3, CurveOffsetCornerStyle.Sharp), path);

      }

    }

    A = treeOut;
# ---------- end offsettree ----------
txt = Text(graft(panel_4))
dom_4 = ConstructDomain(DomainStart=Slider(0.1, range=0..0.1), DomainEnd=Slider(0.9, range=0..1))
txt_2 = Text(graft(panel_3))
dom_5 = ConstructDomain(DomainStart=Slider(0.8, range=0..1), DomainEnd=Slider(1.3, range=0..2))  # -> graft(Domain)
gnlst = GeneList(graft(["R", "R0", "R1", "R2"]))
genemodifier_4 = GenePoolModifier(GeneList=txt_2, Count=lng, Domain=dom_4, Randomize=Button(), PercentageOfRandomization=Slider(1, range=0..1))
genemodifier_5 = GenePoolModifier(GeneList=txt, Count=lng, Domain=dom_4, Randomize=Button(), PercentageOfRandomization=Slider(1, range=0..1))
genemodifier_6 = GenePoolModifier(GeneList=gnlst, Count=lng, Domain=dom_5, Randomize=Button(), PercentageOfRandomization=Slider(1, range=0..1))
loft_2 = Loft(Curves=offsettree.A, Options={Adjust=False, Closed=False, LoftEnds=0, LoftSimp=0, LoftType=0, Rebuild=10, Refit=0.01})
evaluatex = GenePool(
    Decimals=2,
    Maximum=0.9,
    Minimum=0.1,
    Value=[0.5019107768, 0.6655651326, 0.6947049688, 0.3688574576, 0.8783050716, 0.6011884729, 0.2819833965, 0.2298568633, 0.6190275113, 0.1917496182])
evaluatex0 = GenePool(Decimals=2, Maximum=0.9, Minimum=0.1, Value=[0.78, 0.32])
evaluatex1 = GenePool(
    Decimals=2,
    Maximum=0.9,
    Minimum=0.1,
    Value=[0.5019107768, 0.6655651326, 0.6947049688, 0.3688574576, 0.8783050716, 0.6011884729, 0.2819833965])
evaluatex2 = GenePool(
    Decimals=2,
    Maximum=0.9,
    Minimum=0.1,
    Value=[0.5019107768, 0.6655651326, 0.6947049688, 0.3688574576, 0.8783050716, 0.6011884729])
evaluatey = GenePool(
    Decimals=2,
    Maximum=0.9,
    Minimum=0.1,
    Value=[0.7810926902, 0.3539967519, 0.7091909445, 0.5152241314, 0.400909019, 0.700125439, 0.290175397, 0.7351148385, 0.4055923854, 0.2136428316])
evaluatey0 = GenePool(Decimals=2, Maximum=0.9, Minimum=0.1, Value=[0.7810926902, 0.3539967519])
evaluatey1 = GenePool(
    Decimals=2,
    Maximum=0.9,
    Minimum=0.1,
    Value=[0.7810926902, 0.3539967519, 0.7091909445, 0.5152241314, 0.400909019, 0.700125439, 0.290175397])
evaluatey2 = GenePool(
    Decimals=2,
    Maximum=0.9,
    Minimum=0.1,
    Value=[0.7810926902, 0.3539967519, 0.7091909445, 0.5152241314, 0.400909019, 0.700125439])
R = GenePool(
    Decimals=2,
    Maximum=1.3,
    Minimum=0.8,
    Value=[1.105571903, 0.9428438475, 1.128052516, 1.142068132, 0.9767494449, 0.9921440147, 1.10408464, 1.155667976, 1.182088102, 0.923050601])
r1 = GenePool(
    Decimals=2,
    Maximum=1.3,
    Minimum=0.8,
    Value=[1.105571903, 0.9428438475, 1.128052516, 1.142068132, 0.9767494449, 0.9921440147, 1.10408464])
r0 = GenePool(Decimals=2, Maximum=1.3, Minimum=0.8, Value=[1.105571903, 0.9428438475])
r2 = GenePool(
    Decimals=2,
    Maximum=1.3,
    Minimum=0.8,
    Value=[1.105571903, 0.9428438475, 1.128052516, 1.142068132, 0.9767494449, 0.9921440147])
debrep_2 = DeconstructBrep(Brep=loft_2)  # -> simplify(Faces), Edges, Vertices
sqrt = SquareRoot(Value=prunebranches_2.prunedTree)
stack = StackTrees(Data0=evaluatex, Data1=evaluatex0, Data2=evaluatex1, Data3=evaluatex2, Reduce=True)
stack_2 = StackTrees(Data0=evaluatey, Data1=evaluatey0, Data2=evaluatey1, Data3=evaluatey2, Reduce=True)
wires_2 = BrepWireframe(Brep=debrep_2.Faces, Density=-1)
pt_2 = ConstructPoint(XCoordinate=stack, YCoordinate=stack_2, ZCoordinate=0)
join_2 = JoinCurves(Curves=wires_2, Preserve=False)
stack_3 = StackTrees(Data0=R, Data1=r0, Data2=r1, Data3=r2, Reduce=True)
multiplication_2 = Multiplication(A=sqrt, B=stack_3)
evalsrf_2 = EvaluateSurface(Surface=reparameterize(pararunion_2), Point=pt_2)  # -> simplify(Point), Normal, UDirection, VDirection, Frame
division_3 = Division(A=prunebranches_2.prunedTree, B=multiplication_2)
path_mapper_5 = PathMapper(join_2, source="{A;B;C}", target="{A}")
multiplication_3 = Multiplication(A=division_3, B=0.5)
multiplication_4 = Multiplication(A=multiplication_2, B=0.5)
srf_cp = SurfaceClosestPoint(Point=evalsrf_2.Point, Surface=pararunion_2)  # -> simplify(Point), UVPoint, Distance
pln = Plane(evalsrf_2.Frame)
dom_6 = ConstructDomain(DomainStart=expr("-x", multiplication_3), DomainEnd=multiplication_3)
dom_7 = ConstructDomain(DomainStart=expr("-x", multiplication_4), DomainEnd=multiplication_4)
pt_3 = Point(srf_cp.Point)
rectangle_2 = Rectangle(Plane=pt_3, XSize=dom_7, YSize=dom_6, Radius=0)  # -> Rectangle, Length
pt_4 = Point(Point(18.80242174, -2.224422874, 0))
pt_5 = Point(Point(9.870904068, -11.24031262, 0))
pt_6 = Point(Point(15.05201052, -11.30289059, 0))
pt_7 = Point(Point(-17.17137498, 23.58812154, 0))
number_slider_6 = Slider(3, range=0..10)
data = Data(graft([pt_4, pt_5, pt_6, pt_7]))
vec2pt_2 = Vector2Pt(PointA=pt_3, PointB=data, Unitize=False)  # -> unitize(Vector), Length
Y = UnitY(Factor=expr("-x", Slider(0.002, range=0..1)))
amp = Amplitude(Vector=vec2pt_2.Vector, Amplitude=Slider(0.003, range=0..1))
grab = Grab(On=True, Strength=1, Range=3)
load = Load(Point=pt_3, ForceVector=Y, Weighting=1)
load_2 = Load(Point=pt_3, ForceVector=amp, Weighting=1)
cc = CurveCollide(Curves=rectangle_2.Rectangle, Frames=pln, PassiveCurves=path_mapper_5, BasePlane=PlaneXY(0, 0, 0), Strength=1)  # -> Goal, Frames
number_slider_7 = Slider(0.1, range=0..0.1)  # disabled
zombiesolver = ZombieSolver(GoalObjects=cc.Goal, Threshold=number_slider_7, Tolerance=0.01, MaxIterations=50000)  # -> I, V, O; disabled
solver = Solver(GoalObjects=[cc.Goal, load_2, grab], Reset=Button(), Threshold=1e-15, Tolerance=0.01, On=Toggle(False))  # -> I, V, O
clean = CleanTree(RemoveNulls=True, RemoveInvalid=True, RemoveEmpty=False, Tree=zombiesolver.O)  # disabled
clean_2 = CleanTree(RemoveNulls=True, RemoveInvalid=True, RemoveEmpty=False, Tree=solver.O)
c_script = CSharpScript(x=clean)  # -> A; inputs x: list; disabled
# ---------- c_script: C# ----------
    var listOut = new DataTree<Curve>();
    var list = new object[x.Count];
    Curve temp = null;
    
    for( int i = 0; i < x.Count; ++i )
    {
      
      list = ( object[] ) x[i];
      
      for( int j = 0; j < list.Length; ++j )
      {
        
        GH_Convert.ToCurve(list[j], ref temp, GH_Conversion.Both);
        
        listOut.Add(temp, new GH_Path(i));
      
      }
        
    }
    
    A = listOut;
# ---------- end c_script ----------
