# Grasshopper definition SpacePartition.gh (Grasshopper 1.0.7)
# plug-ins: FloorsAndVolumes, Human, PTComponentLibrary, SpaceSyntaxDesign_GH

# ---- group: Labels
text = Text(Tree({0;0}: ["Unidades sanitarias mujeres / privadas"], {0;1}: ["Unidades sanitarias hombres / privadas"], {0;2}: ["Cuarto de aseo "], {0;3}: ["Área de aseo de residuos"], {0;4}: ["Almacen General Insumos de Aseo "], {0;5}: ["Área de UPC-Rack"]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))

# ---- group: Areas
text_2 = Text(Tree({0;0}: ["3"], {0;1}: ["3"], {0;2}: ["6"], {0;3}: ["1"], {0;4}: ["5"], {0;5}: ["4"]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))

# ---- group: Topology
integer = Integer(Tree({0}: [7], {1}: [7], {2}: [3], {3}: [2, 11], {4}: [16, 21, 19], {5}: [19]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))

# ---- group: ID
text_3 = Text(Tree({0;0}: ["5"], {0;1}: ["5"], {0;2}: ["5"], {0;3}: ["5"], {0;4}: ["5"], {0;5}: ["5"]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))

# ----
number_slider = Slider(1, range=0..10)
path_mapper = PathMapper(text, source="{A;B}", target="{A}")
path_mapper_2 = PathMapper(text_2, source="{A;B}", target="{A}")
path_mapper_3 = PathMapper(integer, source="{A;B}", target="{A}")
path_mapper_4 = PathMapper(text_3, source="{A;B}", target="{A}")

# ---- group: Grid / Controllers
number_slider_2 = Slider(21, range=0..21)
number_slider_3 = Slider(5, range=0..5)
division = Division(A=number_slider_2, B=Slider(8, range=0..10))
division_2 = Division(A=number_slider_3, B=Slider(5, range=0..10))
number_slider_4 = Slider(0, range=0..1)  # disabled

# ----
prunebranches = CSharpScript(branches=path_mapper, howMany=number_slider)  # -> prunedTree, branchCounter; inputs branches: tree of String, howMany: Int32
# ---------- prunebranches: C# ----------
    var treeOut = new DataTree<string>();

    for( int i = 0; i < branches.BranchCount - howMany; ++i )
      treeOut.AddRange(branches.Branch(i), new GH_Path(i));

    prunedTree = treeOut;
    branchCounter = treeOut.BranchCount;
# ---------- end prunebranches ----------
prunebranches_2 = CSharpScript(branches=path_mapper_2, howMany=number_slider)  # -> prunedTree, branchCounter; inputs branches: tree of String, howMany: Int32; same code as prunebranches
mass_addition = MassAddition(Input=prunebranches_2.prunedTree)  # -> Result, PartialResults
flatten_tree = FlattenTree(Tree=prunebranches_2.prunedTree, Path="{0}")
number_slider_5 = Slider(0.1, range=0..0.1)
list_length = ListLength(List=flatten_tree)
integer_2 = Integer(Slider(4, range=0..10))
subtraction = Subtraction(A=Slider(1, range=0..1), B=number_slider_5)

# ---- group: Voronoi / Controllers
seedsx = GenePool(Decimals=2, Maximum=0.9, Minimum=0.1, Value=[0.5720696459, 0.5744973087, 0.33, 0.64])
seedsy = GenePool(Decimals=2, Maximum=0.9, Minimum=0.1, Value=[0.1167062629, 0.3833475107, 0.7006989731, 0.54])

# ----
number_slider_6 = Slider(37, range=0..100)  # disabled
number = Number(mass_addition.Result)
number_slider_7 = Slider(31, range=0..100)  # disabled
number_slider_8 = Slider(3791, range=0..10000)
curve = Curve()  # disabled
surface = Surface(curve)  # disabled
number_slider_9 = Slider(0, range=0..50)
curve_2 = Curve(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)
multiplication = Multiplication(A=number, B=Slider(0.2, range=0..1))
multiplication_2 = Multiplication(A=number, B=0.3)
addition = Addition(A=number, B=multiplication_2)  # -> simplify(Result)
addition_2 = Addition(A=addition, B=multiplication)  # -> simplify(Result)
subtraction_2 = Subtraction(A=addition, B=multiplication)  # -> simplify(Result)
panel = Panel(addition_2)
mass_addition_2 = MassAddition(Input=flatten(addition))  # -> Result, PartialResults
panel_2 = Panel("""0: Privado
1: Privado
2: Público
3: SemiPrivado""")
curve_3 = Curve([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])
text_4 = Text(prunebranches.prunedTree)
graft_tree = GraftTree(Tree=panel_2, IncludeEmptyLists=True, IncludeNullItems=True)  # -> simplify(Tree)
graft_tree_2 = GraftTree(Tree=text_4, IncludeEmptyLists=True, IncludeNullItems=True)
addindextolabels = CSharpScript(labels=graft_tree_2)  # -> indexedLabels; inputs labels: tree of String
# ---------- addindextolabels: C# ----------
    var newLabels = new DataTree<string>();
    
    for( int i = 0; i < labels.BranchCount; ++i )
      for( int j = 0; j < labels.Branch(i).Count; ++j )
      {
      
        newLabels.Add( i.ToString() + " " + labels.Branch(i)[j], new GH_Path(i) );
      
      }
    
    indexedLabels = newLabels;
# ---------- end addindextolabels ----------
galapagos = Galapagos(fitness=mass_addition_3, gene=[seedsx, seedsy])
panel_3 = Panel(addition)

# ---- group: Grid
number_slider_10 = Slider(22, range=0..100)  # disabled
number_slider_11 = Slider(4, range=0..10)  # disabled
number_slider_12 = Slider(0, range=0..100)  # disabled
construct_domain = ConstructDomain(DomainStart=number_slider_12, DomainEnd=number_slider_11)  # disabled
number_slider_13 = Slider(2, range=0..10)  # disabled
genepoolmodifier = GenePoolModifier(GeneList="Weights", Count=expr("x+1", number_slider_10), Domain=construct_domain)  # disabled
number_slider_14 = Slider(17.8173, range=-50..20)  # disabled
knot_vector = KnotVector(Count=expr("x+1", number_slider_10), Degree=number_slider_13, Periodic=False)  # disabled
dom = ConstructDomain(DomainStart=expr("-x", number_slider_2), DomainEnd=number_slider_2)
range = Range(Domain=dom, Steps=number_slider_10)  # disabled
dom_2 = ConstructDomain(DomainStart=expr("-x", number_slider_3), DomainEnd=number_slider_3)
weights = GenePool(Decimals=2, Maximum=4, Minimum=0, Value=[2, 2, 2, 2, 2, 2, 2, 2, 2, 2, 2, 2, 2, 2, 2, 2, 2, 2, 2, 2, 2, 2, 2])  # disabled
unit_x = UnitX(Factor=number_slider_14)  # disabled
point = Point(Point(-27.55069635, 0.2364199029, 0))
number_slider_15 = Slider(1000, range=0..1000)  # disabled
number_slider_16 = Slider(0, range=0..1000)  # disabled
number_slider_17 = Slider(0, range=0..1000)  # disabled
deconstruct_domain = DeconstructDomain(Domain=dom)  # -> Start, End
rectangle = Rectangle(Plane=point, XSize=dom_2, YSize=dom, Radius=0)  # -> Rectangle, Length
unit_y = UnitY(Factor=deconstruct_domain.Start)
colour_rgb = ColourRGB(Alpha=255, Red=number_slider_15, Green=number_slider_16, Blue=number_slider_17)  # disabled
number_slider_18 = Slider(3.01, range=0..10)  # disabled
move = Move(Geometry=point, Motion=unit_y)  # -> Geometry, Transform
crv = Curve(rectangle.Rectangle)
ptsrfdomlen = SurfaceDomainLength(Surface=crv, ULength=division_2, VLength=division)
ptborders = GenerateBorders(Grid=ptsrfdomlen, PanelShape=0)  # -> simplify(Border)
crv_2 = Curve(flatten(ptborders))
area = Area(Geometry=ptborders, UseTasks=False)  # -> Area, Centroid

# ---- group: Grid / Perlin
number_slider_19 = Slider(4, range=0..10)  # disabled
number_slider_20 = Slider(2.2, range=0..10)  # disabled
number_slider_21 = Slider(0.575734, range=0..1)  # disabled
number_slider_22 = Slider(13.910642, range=0..100)  # disabled
number_slider_23 = Slider(27.513073, range=0..100)  # disabled
number_slider_24 = Slider(1000, range=0..1000)  # disabled
perlinnoise = CSharpScript(x=range, fre=number_slider_20, amp=number_slider_21, iter=number_slider_19, t=number_slider_23, seed=number_slider_24)  # -> out, A; inputs x: Double, fre: Double, amp: Double, iter: Int32, t: Double, seed: Int32; disabled
# ---------- perlinnoise: C# ----------
    //time+=1e-7;
    
    A = fbm(new vec3(x, 0, 0) + t, fre, amp, iter, seed);
# ---------- perlinnoise: C# additional code ----------
  //double time = 0;
  
  double hash(double a, int seed)
  {

    //return fract(Math.Sin(a) * 4513.15);
    var rand = new Random( seed );
    return rand.NextDouble() * ( 1.0 + 1.0 ) - 1.0;

  }

  double noise(vec3 x, int seed)
  {

    vec3 p = x.floor();
    vec3 k = x.fract();

    k *= k * k * ( 3.0 - 2.0 * k );

    double n = p.X() + p.Y() * 57.0 + p.Z() * 113.0;

    double a = hash(n, seed);
    double b = hash(n + 1.0, seed);
    double c = hash(n + 57.0, seed);
    double d = hash(n + 58.0, seed);

    double e = hash(n + 113.0, seed);
    double f = hash(n + 114.0, seed);
    double g = hash(n + 170.0, seed);
    double h = hash(n + 171.0, seed);

    double res = vec3.mix(vec3.mix(vec3.mix(a, b, k.X()), vec3.mix(c, d, k.X()), k.Y()),
      vec3.mix(vec3.mix(e, f, k.X()), vec3.mix(g, h, k.X()), k.Y()),
      k.Z()
      );

    return res;

  }

  double fbm(vec3 f, double freq, double ampl, int iter, int seed)
  {

    double amp = 1.0, fre = 1.7, res = 0.0;

    for( int i = 0; i < iter; ++i )
    {

      amp *= ampl;
      fre *= freq;

      amp += amp;

      res += amp * noise(fre * f, seed);

    }

    return res;

  }

  class vec3
  {

    double x, y, z;

    public vec3(double x, double y, double z)
    {

      this.x = x;
      this.y = y;
      this.z = z;

    }

    public vec3(Point3d point)
    {

      this.x = point.X;
      this.y = point.Y;
      this.z = point.Z;

    }

    public double X()
    {

      return x;

    }

    public double Y()
    {

      return y;

    }

    public double Z()
    {

      return z;

    }

    // Addition operator overload.
    public static vec3 operator+( vec3 x, vec3 y )
    {

      return new vec3(x.X() + y.X(), x.Y() + y.Y(), x.Z() + y.Z());

    }

    public static vec3 operator+( vec3 x, double y )
    {

      return new vec3(x.X() + y, x.Y() + y, x.Z() + y);

    }

    public static vec3 operator+( double y, vec3 x )
    {

      return new vec3(y + x.X(), y + x.Y(), y + x.Z());

    }

    // Subtraction operator overload.
    public static vec3 operator-( vec3 x, vec3 y )
    {

      return new vec3(x.X() - y.X(), x.Y() - y.Y(), x.Z() - y.Z());

    }

    public static vec3 operator-( vec3 x, double y )
    {

      return new vec3(x.X() - y, x.Y() - y, x.Z() - y);

    }

    public static vec3 operator-( double y, vec3 x )
    {

      return new vec3(y - x.X(), y - x.Y(), y - x.Z());

    }

    // Multiplication operator overload.
    public static vec3 operator*( vec3 x, vec3 y )
    {

      return new vec3(x.X() * y.X(), x.Y() * y.Y(), x.Z() * y.Z());

    }

    public static vec3 operator*( vec3 x, double y )
    {

      return new vec3(x.X() * y, x.Y() * y, x.Z() * y);

    }

    public static vec3 operator*( double y, vec3 x )
    {

      return new vec3(y * x.X(), y * x.Y(), y * x.Z());

    }

    // Fractional part of a vec3.
    public vec3 fract()
    {

      return new vec3(fract(x), fract(y), fract(y));

    }

    // Floor.
    public vec3 floor()
    {

      return new vec3(Math.Floor(x), Math.Floor(y), Math.Floor(z));

    }

    // Fractional part of a double.
    public double fract(double x)
    {

      return x - Math.Truncate(x);

    }

    // Linear interpolation of a double.
    public static double mix(double a, double b, double c)
    {

      return a - ( 1 - c ) + b * c;

    }

    // Linear interpolation of a vec3.
    public static vec3 mix(vec3 a, vec3 b, double c)
    {

      double mixX = mix(a.X(), b.X(), c);
      double mixY = mix(a.Y(), b.Y(), c);
      double mixZ = mix(a.Z(), b.Y(), c);

      return new vec3(mixX, mixY, mixZ);

    }

    public Point3d toPoint()
    {

      return new Point3d(this.X(), this.Y(), this.Z());

    }

  }

  public double fract(double x)
  {

    return x - Math.Truncate(x);

  }
# ---------- end perlinnoise ----------

# ---- group: Grid (continued)
construct_point = ConstructPoint(XCoordinate=perlinnoise.A, YCoordinate=range, ZCoordinate=0)  # disabled
list_item = ListItem(List=construct_point, Index=0, Wrap=True)  # disabled
vector_2pt = Vector2Pt(PointA=list_item, PointB=move.Geometry, Unitize=False)  # -> Vector, Length; disabled
move_2 = Move(Geometry=construct_point, Motion=vector_2pt.Vector)  # -> Geometry, Transform; disabled
nurbs_curve_pwk = NurbsCurvePWK(Points=move_2.Geometry, Weights=weights, Knots=knot_vector)  # -> Curve, Length, Domain; disabled
custom_preview_lineweights = CustomPreviewLineweights(Geometry=nurbs_curve_pwk.Curve, Shader=colour_rgb, Thickness=number_slider_18, Absolute=False)  # disabled
curve_attraction = CurveAttraction(Grid=ptsrfdomlen, CrvAtts=nurbs_curve_pwk.Curve, Magnitude=number_slider_4)  # -> Grid, Weights; disabled

# ---- group: Voronoi
dom_3 = ConstructDomain(DomainStart=number_slider_5, DomainEnd=subtraction)
genemodifier = GenePoolModifier(GeneList="SeedsX", Count=integer_2, Domain=dom_3)
genemodifier_2 = GenePoolModifier(GeneList="SeedsY", Count=integer_2, Domain=dom_3)
pt = ConstructPoint(XCoordinate=seedsx, YCoordinate=seedsy, ZCoordinate=0)
evalsrf = EvaluateSurface(Surface=reparameterize(crv), Point=pt)  # -> Point, Normal, UDirection, VDirection, Frame
pt_2 = Point(evalsrf.Point)
voronoi = Voronoi(Points=pt_2, Boundary=rectangle.Rectangle, BruteForceOverride=False)

# ----
surface_2 = Surface(crv_2)  # disabled

# ---- group: ManhattanVoronoi
number_slider_25 = Slider(10, range=0..10)  # disabled
ghpython_script = GhPythonScript(r=number_slider_25, P=pt_2)  # -> out, PL; inputs P: list of Point3d; disabled
# ---------- ghpython_script: Python ----------
__author__ = "Paula"
__version__ = "2019.04.23"

import rhinoscriptsyntax as rs
from Rhino.Geometry import Point3d as P3
from Rhino.Geometry import Polyline as PLine

def taxicab_midnormal ( Point_1 = P3(0,0,0), Point_2 = P3(0,0,0) , leng = 10000):
    dx = abs(Point_1.X - Point_2.X)
    dy = abs(Point_1.Y - Point_2.Y)
    
    C = P3 ( ( Point_1.X + Point_2.X ) / 2, ( Point_1.Y + Point_2.Y ) / 2, ( Point_1.Z + Point_2.Z ) / 2)
    
    """ MPQN, in which M is on the lengeft(X-) or bottom(Y-) """
    P = P3 (0,0,C.Z)
    Q = P3 (0,0,C.Z)
    M = P3 (0,0,C.Z)
    N = P3 (0,0,C.Z)
    
    if dx > dy:
        P.Y = C.Y + dy / 2
        Q.Y = C.Y - dy / 2
        M.Y = P.Y + leng
        N.Y = Q.Y - leng
        if bool(Point_1.Y > Point_2.Y) ^ bool(Point_1.X > Point_2.X):
            P.X = C.X + dy / 2
            Q.X = C.X - dy / 2
        else:
            P.X = C.X - dy / 2
            Q.X = C.X + dy / 2
        M.X = P.X
        N.X = Q.X
    else:
        if dx < dy:
            P.X = C.X + dx / 2
            Q.X = C.X - dx / 2
            M.X = P.X + leng
            N.X = Q.X - leng
            if bool(Point_1.Y > Point_2.Y) ^ bool(Point_1.X > Point_2.X):
                P.Y = C.Y + dx / 2
                Q.Y = C.Y - dx / 2
            else:
                P.Y = C.Y - dx / 2
                Q.Y = C.Y + dx / 2
            M.Y = P.Y
            N.Y = Q.Y
        else:
            if bool(Point_1.Y > Point_2.Y) ^ bool(Point_1.X > Point_2.X):
                P.Y = C.Y - dx / 2
                Q.Y = C.Y + dx / 2
                P.X = C.X - dy / 2
                Q.X = C.X + dy / 2
                M.Y = P.Y - leng
                M.X = P.X - leng
                N.Y = Q.Y + leng
                N.X = Q.X + leng
            else:
                P.Y = C.Y - dx / 2
                Q.Y = C.Y + dx / 2
                P.X = C.X + dy / 2
                Q.X = C.X - dy / 2
                M.Y = P.Y - leng
                M.X = P.X + leng
                N.Y = Q.Y + leng
                N.X = Q.X - leng

    return rs.AddPolyline( [M , P , Q , N] )

def taxicab_circle ( point = P3(0,0,0), r = 1 ):
    A = P3( point.X + r, point.Y, point.Z )
    B = P3( point.X, point.Y + r, point.Z )
    C = P3( point.X - r, point.Y, point.Z )
    D = P3( point.X, point.Y - r, point.Z )
    return rs.AddPolyline( [A, B, C, D, A] )

l = 2 * r

""" PL = taxicab_midnormal ( A, B, r ) """

pts = P

polylines = []
for i in range( len( P ) ):
    polylines.append(taxicab_circle( P[i], l ))

for i in range(len(polylines)):
    for j in range(i):
        if i == j:
            continue
        if rs.CurveBooleanUnion( [ polylines[i], polylines[j] ] ):
            MN = taxicab_midnormal( pts[i], pts[j], l )
            
            ccx = rs.CurveCurveIntersection( polylines[i], MN )
            if ccx is None:
                continue
            if ccx[0][0] == 2:
                continue
            para_a = [ ccx[0][5], ccx[1][5] ]
            para_b = [ ccx[0][7], ccx[1][7] ]
            
            if para_b[0] > para_b[1]:
                para_b = [ para_b[1], para_b[0] ]
            
            probable_dash = rs.SplitCurve(polylines[i], para_a)
            edge = rs.TrimCurve(MN, para_b, False )
            edgepts = rs.CurvePoints(edge)
            
            for crv in probable_dash:
                crvpts = rs.CurvePoints(crv)
                if rs.PointCompare( crvpts[0], edgepts[0] ):
                    crvpts.reverse()
                newpl = rs.AddPolyline( edgepts + crvpts )
                if rs.PointInPlanarClosedCurve( pts[i], newpl ):
                    polylines[i] = newpl
                    break
            
            
            ccx = rs.CurveCurveIntersection( polylines[j], MN )
            if ccx is None:
                continue
            para_a = [ ccx[0][5], ccx[1][5] ]
            para_b = [ ccx[0][7], ccx[1][7] ]
            
            if para_b[0] > para_b[1]:
                para_b = [ para_b[1], para_b[0] ]
            
            probable_dash = rs.SplitCurve(polylines[j], para_a)
            edge = rs.TrimCurve(MN, para_b, False )
            edgepts = rs.CurvePoints(edge)
            
            for crv in probable_dash:
                crvpts = rs.CurvePoints(crv)
                if rs.PointCompare( crvpts[0], edgepts[0] ):
                    crvpts.reverse()
                newpl = rs.AddPolyline( edgepts + crvpts )
                if rs.PointInPlanarClosedCurve( pts[j], newpl ):
                    polylines[j] = newpl
                    break
    

PL = polylines
# ---------- end ghpython_script ----------
region_intersection = RegionIntersection(CurvesA=ghpython_script.PL, CurvesB=rectangle.Rectangle)  # disabled
curve_4 = Curve(region_intersection)  # disabled
surface_3 = Surface(curve_4)  # disabled

# ----
curve_5 = Curve(crv_2)  # disabled
curve_6 = Curve(voronoi)
surface_4 = Surface(curve_6)
area_2 = Area(Geometry=curve_5, UseTasks=False)  # -> Area, Centroid; disabled
area_3 = Area(Geometry=crv_2, UseTasks=False)  # -> Area, Centroid
sort_list = SortList(Keys=area_3.Area, ValuesValuesA=area_3.Area)  # -> Keys, ValuesValuesA
list_item_2 = ListItem(List=area_2.Centroid, Index=number_slider_7, Wrap=True)  # disabled
custom_preview = CustomPreview(
    Geometry=graft(surface_4),
    Material=Tree({0;0}: [{diffuse=RGB(248, 130, 253), emission=RGB(74, 39, 76), shine=0.5, specular=RGB(255, 255, 255), transparency=1}], {0;1}: [{diffuse=RGB(90, 186, 198), emission=RGB(27, 56, 59), shine=0.5, specular=RGB(255, 255, 255), transparency=1}], {0;2}: [{diffuse=RGB(241, 14, 173), emission=RGB(72, 4, 52), shine=0.5, specular=RGB(255, 255, 255), transparency=1}], {0;3}: [{diffuse=RGB(63, 249, 251), emission=RGB(19, 75, 75), shine=0.5, specular=RGB(255, 255, 255), transparency=1}], {0;4}: [{diffuse=RGB(28, 139, 92), emission=RGB(8, 42, 28), shine=0.5, specular=RGB(255, 255, 255), transparency=1}], {0;5}: [{diffuse=RGB(160, 224, 125), emission=RGB(48, 67, 38), shine=0.5, specular=RGB(255, 255, 255), transparency=1}]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))
list_length_2 = ListLength(List=sort_list.ValuesValuesA)
subtraction_3 = Subtraction(A=list_length_2, B=1)
list_item_3 = ListItem(List=sort_list.ValuesValuesA, Index=subtraction_3, Wrap=True)
multiplication_3 = Multiplication(A=list_item_3, B=Slider(0.5, range=0..1))
spacepartition = CSharpScript(voronoiIn=curve_6, gridIn=crv_2, areaIn=multiplication_3, seed=number_slider_8)  # -> culledGrid, R, G, B, booleans; inputs voronoiIn: list of Polyline, gridIn: list of Polyline, areaIn: Double, seed: Int32; disabled
# ---------- spacepartition: C# usings ----------
using System.Linq;
# ---------- spacepartition: C# ----------
    var intersections = new DataTree<Curve>();
    var bools = new DataTree<bool>();

    for( int i = 0; i < voronoiIn.Count; ++i )
    {

      var voro = voronoiIn[i].ToNurbsCurve();

      for( int j = 0; j < gridIn.Count; ++j )
      {

        intersections.AddRange(Curve.CreateBooleanIntersection(voro, gridIn[j].ToNurbsCurve(), 1e-3).ToList(), new GH_Path(i, j));

      }

    }

    int countTrueBools = 0;

    for( int i = 0; i < intersections.BranchCount; ++i )
    {

      var tempList = intersections.Branch(i);
      var path = new GH_Path(intersections.Path(i).Indices[0]);
      //bool temp = false;

      if( tempList.Count > 0 )
      {

        var area = AreaMassProperties.Compute(intersections.Branch(i)[0]).Area;

        //temp = area < areaIn ? false : true;

        if( area < areaIn )
        {
          //temp = false;
          bools.Add(false, path);
            
        }
          
        else
        {

          //temp = true;
          countTrueBools++;
          bools.Add(true, path);

        }

        //bools.Add(temp, path);

      }

      else
      {

        bools.Add(false, path);

      }

    }

    var treeOut = new DataTree<Polyline>();
    var coloursOutR = new DataTree<int>();
    var coloursOutG = new DataTree<int>();
    var coloursOutB = new DataTree<int>();
    //var coloursOut = new DataTree<System.Drawing.Color>();
    var rand = new Random(seed);

    int boolBranches = bools.BranchCount;
/*
    int difference = gridIn.Count - countTrueBools;
    var randT = new Random();

    for( int i = 0; i < difference; ++i )
    {

      int branch = randT.Next( 0, boolBranches - 1 );
      int branchIndex = randT.Next( 0, bools.Branch( branch ).Count - 1 );
      bools.Branch(branch)[branchIndex] = true;

    }
*/
    for( int i = 0; i < boolBranches; ++i )
    {

      var path = intersections.Path(i);

      coloursOutR.Add(rand.Next(0, 255), path);
      coloursOutG.Add(rand.Next(0, 255), path);
      coloursOutB.Add(rand.Next(0, 255), path);
      //coloursOut.Add( System.Drawing.Color.FromArgb( 255, rand.Next( 0, 255 ), rand.Next( 0, 255 ), rand.Next( 0, 255 ) ), path );

      for( int j = 0; j < bools.Branch(i).Count; ++j )
      {

        if( bools.Branch(i)[j] == true )
        {

          treeOut.Add(gridIn[j], path);

        }

      }

    }

    culledGrid = treeOut;
    R = coloursOutR;
    G = coloursOutG;
    B = coloursOutB;
    booleans = intersections;
    //R = coloursOut;
# ---------- end spacepartition ----------
surface_5 = Surface(spacepartition.booleans)  # disabled
curve_7 = Curve(flatten(spacepartition.culledGrid))  # disabled
area_4 = Area(Geometry=curve_7, UseTasks=False)  # -> Area, Centroid; disabled
list_item_4 = ListItem(List=curve_7, Index=number_slider_6, Wrap=True)  # disabled
panel_4 = Panel(spacepartition.booleans)  # disabled
deconstruct = Deconstruct(Point=area_4.Centroid)  # -> XComponent, expr("x*1000", YComponent), ZComponent; disabled
addition_3 = Addition(A=deconstruct.XComponent, B=deconstruct.YComponent)  # disabled
spacepartition_2 = CSharpScript(voronoiIn=curve_6, gridIn=crv_2, areaIn=multiplication_3, seed=number_slider_8)  # -> culledGrid, R, G, B; inputs voronoiIn: list of Polyline, gridIn: list of Polyline, areaIn: Double, seed: Int32; disabled
# ---------- spacepartition_2: C# ----------
    var interConc = new System.Collections.Concurrent.ConcurrentBag<List<Curve>>();
    var intersections = new DataTree<Curve>();
    var repeated = new DataTree<Polyline>();
    var bools = new DataTree<bool>();
    int county = 0;
    
    for( int i = 0; i < voronoiIn.Count; ++i )
    {

      repeated.AddRange(gridIn, new GH_Path(i));
      
      System.Threading.Tasks.Parallel.For(0, gridIn.Count, j =>
      {
  
        interConc.Add(Curve.CreateBooleanIntersection(voronoiIn[i].ToNurbsCurve(), gridIn[j].ToNurbsCurve(), 1e-3).ToList());
        
        System.Threading.Interlocked.Increment(ref county);
  
      });

    }
    
    for( int i = 0; i < interConc.Count; ++i )
    {
      
      var c = interConc.ElementAt(i);
      
      for( int j = 0; j < c.Count; ++j )
    
        intersections.Add(c[j], new GH_Path(j));
    }

    R = intersections;
# ---------- end spacepartition_2 ----------
surface_6 = Surface(spacepartition.culledGrid)  # disabled
sort_list_2 = SortList(Keys=addition_3, ValuesA=area_4.Centroid)  # -> Keys, ValuesA; disabled
c_script = CSharpScript(CulledGrid=spacepartition.culledGrid)  # disabled
spacepartition_3 = CSharpScript(voronoiIn=curve_6, gridIn=crv_2, areaIn=multiplication_3, seed=number_slider_8)  # -> culledGrid, R, G, B; inputs voronoiIn: list of Polyline, gridIn: list of Polyline, areaIn: Double, seed: Int32; disabled
# ---------- spacepartition_3: C# ----------
    var intersections = new DataTree<Curve>();
    var repeated = new DataTree<Polyline>();
    var bools = new DataTree<bool>();

    for( int i = 0; i < voronoiIn.Count; ++i )
    {

      repeated.AddRange(gridIn, new GH_Path(i));

      var voro = voronoiIn[i].ToNurbsCurve();

      for( int j = 0; j < gridIn.Count; ++j )
      {

        intersections.AddRange(Curve.CreateBooleanIntersection(voro, gridIn[j].ToNurbsCurve(), 1e-3).ToList(), new GH_Path(i, j));

      }

    }

    for( int i = 0; i < intersections.BranchCount; ++i )
    {

      var tempList = intersections.Branch(i);
      var path = new GH_Path(intersections.Path(i).Indices[0]);
      bool temp = false;

      if( tempList.Count > 0 )
      {

        var area = AreaMassProperties.Compute(intersections.Branch(i)[0]).Area;

        temp = area < areaIn ? false : true;

        bools.Add(temp, path);

      }

      else
      {

        temp = false;
        bools.Add(temp, path);

      }

    }

    var treeOut = new DataTree<Polyline>();
    var coloursOutR = new DataTree<int>();
    var coloursOutG = new DataTree<int>();
    var coloursOutB = new DataTree<int>();
    //var coloursOut = new DataTree<System.Drawing.Color>();
    var rand = new Random(seed);

    for( int i = 0; i < bools.BranchCount; ++i )
    {

      var path = repeated.Path(i);

      coloursOutR.Add(rand.Next(0, 255), path);
      coloursOutG.Add(rand.Next(0, 255), path);
      coloursOutB.Add(rand.Next(0, 255), path);
      //coloursOut.Add( System.Drawing.Color.FromArgb( 255, rand.Next( 0, 255 ), rand.Next( 0, 255 ), rand.Next( 0, 255 ) ), path );

      for( int j = 0; j < bools.Branch(i).Count; ++j )
      {

        if( bools.Branch(i)[j] == true )
        {

          treeOut.Add(repeated.Branch(i)[j], path);

        }

      }

    }

    culledGrid = treeOut;
    R = intersections;
    G = coloursOutG;
    B = coloursOutB;
    //R = coloursOut;
# ---------- end spacepartition_3 ----------
spacepartitionnoparallel = CSharpScript(voronoiIn=curve_6, gridIn=crv_2, areaIn=multiplication_3, seed=number_slider_8)  # -> culledGrid, R, G, B; inputs voronoiIn: list of Polyline, gridIn: list of Polyline, areaIn: Double, seed: Int32; disabled
# ---------- spacepartitionnoparallel: C# ----------
    var intersections = new DataTree<Curve>();
    var repeated = new DataTree<Polyline>();
    var bools = new DataTree<bool>();
    //Curve[][][] temp = new Curve[voronoiIn.Count][][];

    for( int i = 0; i < voronoiIn.Count; ++i )
    {

      //temp[i] = new Curve[gridIn.Count][];

      var voro = voronoiIn[i].ToNurbsCurve();

      //temp[i] = (Curve.CreateBooleanIntersection(voro, gridIn[i].ToNurbsCurve(), 1e-3));

      for( int j = 0; j < gridIn.Count; ++j )
      {

        intersections.AddRange(Curve.CreateBooleanIntersection(voro, gridIn[j].ToNurbsCurve(), 1e-3).ToList(), new GH_Path(i, j));
        //temp[i][j] = Curve.CreateBooleanIntersection(voro, gridIn[j].ToNurbsCurve(), 1e-3);

      }

    }

    culledGrid = intersections;
# ---------- end spacepartitionnoparallel ----------
region_union = RegionUnion(Curves=surface_6)  # disabled
spacepartitionparalleldict = CSharpScript(voronoiIn=curve_6, gridIn=crv_2, areaIn=multiplication_3, seed=number_slider_8)  # -> culledGrid, R, G, B; inputs voronoiIn: list of Polyline, gridIn: list of Polyline, areaIn: Double, seed: Int32
# ---------- spacepartitionparalleldict: C# ----------
    var interConc = new System.Collections.Concurrent.ConcurrentDictionary<List<Curve>, int>();
    var intersections = new DataTree<Curve>();
    var bools = new DataTree<bool>();
    var treeLock = new object();
    Curve[][][] tempJagged = new Curve[voronoiIn.Count][][];

    for( int i = 0; i < voronoiIn.Count; ++i )
    {

      var voro = voronoiIn[i].ToNurbsCurve();

      tempJagged[i] = new Curve[gridIn.Count][];

      System.Threading.Tasks.Parallel.For(0, gridIn.Count, j =>
        {

        tempJagged[i][j] = Curve.CreateBooleanIntersection(voro, gridIn[j].ToNurbsCurve(), 1e-3);

        });

    }

    for( int i = 0; i < tempJagged.Length; ++i )
      for( int j = 0; j < tempJagged[i].Length; ++j )
        intersections.AddRange(tempJagged[i][j], new GH_Path(i, j));

    for( int i = 0; i < intersections.BranchCount; ++i )
    {

      var tempList = intersections.Branch(i);
      var path = new GH_Path(intersections.Path(i).Indices[0]);
      bool temp = false;

      if( tempList.Count > 0 )
      {

        var area = AreaMassProperties.Compute(intersections.Branch(i)[0]).Area;

        temp = area < areaIn ? false : true;

        bools.Add(temp, path);

      }

      else
      {

        temp = false;
        bools.Add(temp, path);

      }

    }

    var treeOut = new DataTree<Polyline>();
    var coloursOutR = new DataTree<int>();
    var coloursOutG = new DataTree<int>();
    var coloursOutB = new DataTree<int>();
    //var coloursOut = new DataTree<System.Drawing.Color>();
    var rand = new Random(seed);

    for( int i = 0; i < bools.BranchCount; ++i )
    {

      var path = intersections.Path(i);

      coloursOutR.Add(rand.Next(0, 255), path);
      coloursOutG.Add(rand.Next(0, 255), path);
      coloursOutB.Add(rand.Next(0, 255), path);
      //coloursOut.Add( System.Drawing.Color.FromArgb( 255, rand.Next( 0, 255 ), rand.Next( 0, 255 ), rand.Next( 0, 255 ) ), path );

      for( int j = 0; j < bools.Branch(i).Count; ++j )
      {

        if( bools.Branch(i)[j] == true )
        {

          treeOut.Add(gridIn[j], path);

        }

      }

    }

    culledGrid = treeOut;
    R = coloursOutR;
    G = coloursOutG;
    B = coloursOutB;
    //R = coloursOut;
# ---------- end spacepartitionparalleldict ----------
panel_5 = Panel(c_script)  # disabled
list_item_5 = ListItem(List=sort_list_2.ValuesA, Index=number_slider_7, Wrap=True)  # disabled
surface_7 = Surface(region_union)  # disabled
curve_8 = Curve(spacepartitionnoparallel.culledGrid)  # disabled
curve_9 = Curve(spacepartitionnoparallel.culledGrid)  # disabled
surface_8 = Surface(spacepartitionparalleldict.culledGrid)  # disabled
path_mapper_5 = PathMapper(curve_8, source="{A;B}", target="{A;B}")  # disabled
panel_6 = Panel(spacepartitionparalleldict.culledGrid)  # disabled
panel_7 = Panel(spacepartition_3.culledGrid)  # disabled
distance = Distance(PointA=list_item_5, PointB=list_item_2)  # disabled
panel_8 = Panel(spacepartitionnoparallel.culledGrid)  # disabled
colour_rgb_2 = ColourRGB(
    Alpha=Slider(0, range=0..255),
    Red=spacepartitionparalleldict.R,
    Green=spacepartitionparalleldict.G,
    Blue=spacepartitionparalleldict.B)
panel_9 = Panel(spacepartition_3.R)
surface_9 = Surface(spacepartitionparalleldict.culledGrid)
curve_10 = Curve(spacepartitionparalleldict.culledGrid)
area_5 = Area(Geometry=curve_10, UseTasks=False)  # -> Area, Centroid; disabled
region_union_2 = RegionUnion(Curves=spacepartitionparalleldict.culledGrid)
colour_rgb_3 = ColourRGB(
    Alpha=Slider(255, range=0..255),
    Red=spacepartitionparalleldict.R,
    Green=spacepartitionparalleldict.G,
    Blue=spacepartitionparalleldict.B)
fix_notsopretty = CSharpScript(culledGrid=area_5.Centroid, originalGrid=area.Centroid)  # -> fix; inputs culledGrid: tree of Point3d, originalGrid: list of Point3d; disabled
# ---------- fix_notsopretty: C# ----------
    var bools = new List<bool>();
    
    var culledGridFlat = culledGrid;
    culledGridFlat.Flatten();
    
    //for( int i = 0; i < originalGr )
    
    fix = culledGridFlat;
# ---------- end fix_notsopretty ----------
spacepartitionnoparallel_2 = CSharpScript(voronoiIn=curve_6, gridIn=crv_2, areaIn=multiplication_3, seed=number_slider_8)  # -> culledGrid, R, G, B; inputs voronoiIn: list of Polyline, gridIn: list of Polyline, areaIn: Double, seed: Int32; disabled
# ---------- spacepartitionnoparallel_2: C# ----------
    var intersections = new DataTree<Curve>();
    var bools = new DataTree<bool>();

    for( int i = 0; i < voronoiIn.Count; ++i )
    {

      var voro = voronoiIn[i].ToNurbsCurve();

      for( int j = 0; j < gridIn.Count; ++j )
      {

        intersections.AddRange(Curve.CreateBooleanIntersection(voro, gridIn[j].ToNurbsCurve(), 1e-3).ToList(), new GH_Path(i, j));

      }

    }

    for( int i = 0; i < intersections.BranchCount; ++i )
    {

      var tempList = intersections.Branch(i);
      var path = new GH_Path(intersections.Path(i).Indices[0]);
      bool temp = false;

      if( tempList.Count > 0 )
      {

        var area = AreaMassProperties.Compute(intersections.Branch(i)[0]).Area;

        temp = area < areaIn ? false : true;

        bools.Add(temp, path);

      }

      else
      {

        temp = false;
        bools.Add(temp, path);

      }

    }

    var treeOut = new DataTree<Polyline>();
    var coloursOutR = new DataTree<int>();
    var coloursOutG = new DataTree<int>();
    var coloursOutB = new DataTree<int>();
    //var coloursOut = new DataTree<System.Drawing.Color>();
    var rand = new Random(seed);

    for( int i = 0; i < bools.BranchCount; ++i )
    {

      var path = intersections.Path(i);

      coloursOutR.Add(rand.Next(0, 255), path);
      coloursOutG.Add(rand.Next(0, 255), path);
      coloursOutB.Add(rand.Next(0, 255), path);
      //coloursOut.Add( System.Drawing.Color.FromArgb( 255, rand.Next( 0, 255 ), rand.Next( 0, 255 ), rand.Next( 0, 255 ) ), path );

      for( int j = 0; j < bools.Branch(i).Count; ++j )
      {

        if( bools.Branch(i)[j] == true )
        {

          treeOut.Add(gridIn[j], path);

        }

      }

    }

    culledGrid = treeOut;
    R = coloursOutR;
    G = coloursOutG;
    B = coloursOutB;
    //R = coloursOut;
# ---------- end spacepartitionnoparallel_2 ----------
panel_10 = Panel(fix_notsopretty)
region_intersection_2 = RegionIntersection(CurvesA=curve_2, CurvesB=region_union_2)  # -> simplify(Result)
surface_10 = Surface(region_intersection_2)
custom_preview_2 = CustomPreview(Geometry=surface_10, Material=colour_rgb_3)
flatten_tree_2 = FlattenTree(Tree=region_intersection_2, Path="{0}")
area_6 = Area(Geometry=surface_10, UseTasks=True)  # -> simplify(Area), Centroid
polytopo = CSharpScript(curveList=flatten_tree_2)  # -> relations; inputs curveList: list of Polyline
# ---------- polytopo: C# usings ----------
//using System.Linq;
# ---------- polytopo: C# ----------
    var repeat = new DataTree<Polyline>();

    var topoTree = new DataTree<int>();

    //var treeIndex = new DataTree<int>();

    int count = curveList.Count;

    for( int i = 0; i < count; ++i )
    {

      var path = new GH_Path(i);

      repeat.AddRange(curveList, path);

      var temp = repeat.Branch(i)[i];

      //treeIndex.Add(i, path);

      for( int j = 0; j < repeat.Branch(i).Count; ++j )
      {

        if( j != i )

          if( Curve.PlanarCurveCollision(temp.ToNurbsCurve(), repeat.Branch(i)[j].ToNurbsCurve(), Plane.WorldXY, 1e-3) )
          {

            topoTree.Add(j, path);

          }

      }

    }

    relations = topoTree;

    //index = treeIndex;
# ---------- end polytopo ----------
null_item = NullItem(Item=area_6.Area)  # -> NullFlags, InvalidFlags, Description
panel_11 = Panel(polytopo)
expression = Expression(x=null_item.NullFlags, y=area_6.Area, Expression="If( True, y, 1000 )")
expression_2 = Expression(x=expression, y=addition_2, z=subtraction_2, Expression="If( ( x < y) And ( x > z), 0, 1000 )")
panel_12 = Panel(null_item.NullFlags)
linetopo = CSharpScript(points=area_6.Centroid, relations=polytopo)  # -> lines; inputs points: tree of Point3d, relations: tree of Int32
# ---------- linetopo: C# ----------
    var linesOut = new DataTree<Line>();

    for( int i = 0; i < relations.BranchCount; ++i )
    {

      int count = relations.Branch(i).Count;

      for( int j = 0; j < count; ++j )
      {

        linesOut.Add(new Line(points.Branch(i)[0], points.Branch(relations.Branch(i)[j])[0]), new GH_Path(i));
        
      }

    }

    lines = linesOut;
# ---------- end linetopo ----------
mass_addition_3 = MassAddition(Input=flatten(expression_2))  # -> Result, PartialResults
graphfromnodes_links = GraphFromNodesLinks(
    Points=flatten(area_6.Centroid),
    Links=flatten(linetopo),
    Labels=flatten(panel_2),
    Areas=flatten(addition),
    TotalArea=mass_addition_2.Result)  # -> Graph, GraphVertices, Attributes
panel_13 = Panel(mass_addition_3.Result)
flatten_tree_3 = FlattenTree(Tree=surface_10, Path="{0}")  # disabled
explode_tree = ExplodeTree(Data=graphfromnodes_links.Attributes)
forcedirecteddrawing = ForceDirectedDrawing(
    Graph=polytopo,
    Vertices=flatten(area_6.Centroid),
    Attributes=graphfromnodes_links.Attributes,
    AttractionStrength=0.25,
    RepulsionStrength=1.4,
    ConvergenceTolearnce=0.001,
    MaximumIterations=Slider(2000, range=0..10000),
    Active=Toggle(True))  # -> NewGraphVertices, IterationCount
text_tag = TextTag(Location=area_6.Centroid, Text=graft_tree)
list_length_3 = ListLength(List=flatten_tree_3)  # disabled
list_length_4 = ListLength(List=crv_2)  # disabled
panel_14 = Panel(list_length_3)  # disabled
panel_15 = Panel(explode_tree)
expression_3 = Expression(x=list_length_4, y=list_length_3, Expression="If( x ≠ y, False, True )")  # disabled
panel_16 = Panel(area_6.Area)
diskographdrawing = DiskoGraphDrawing(
    Plane=PlaneXY(16.90127812, 6.56851581, 0),
    Graph=polytopo,
    Vertices=forcedirecteddrawing.NewGraphVertices,
    Attributes=graphfromnodes_links.Attributes,
    Thickness=1)
panel_17 = Panel(expression_3)  # disabled
