# Grasshopper definition SpacePartition[4].gh (Grasshopper 1.0.7)
# plug-ins: SpacePartition, FloorsAndVolumes, Human, PTComponentLibrary, MetaHopper, Kangaroo2 Components

# ---- group: Progress
spacepartitionnoparallel = CSharpScript()  # -> culledGrid, R, G, B; inputs voronoiIn: list of Polyline, gridIn: list of Polyline, areaIn: Double, seed: Int32; disabled
# ---------- spacepartitionnoparallel: C# usings ----------
using System.Linq;
# ---------- spacepartitionnoparallel: C# ----------
    var intersections = new DataTree<Curve>();
    var bools = new DataTree<bool>();

    for( int i = 0; i < voronoiIn.Count; ++i )
    {

      var voro = voronoiIn[i].ToNurbsCurve();

      for( int j = 0; j < gridIn.Count; ++j )
      {

        intersections.AddRange(Curve.CreateBooleanIntersection(voro, gridIn[j].ToNurbsCurve(), 1e-3).ToList(), new GH_Path(i, j));

      }

    }

    for( int i = 0; i < intersections.BranchCount; ++i )
    {

      var tempList = intersections.Branch(i);
      var path = new GH_Path(intersections.Path(i).Indices[0]);
      bool temp = false;

      if( tempList.Count > 0 )
      {

        var area = AreaMassProperties.Compute(intersections.Branch(i)[0]).Area;

        temp = area < areaIn ? false : true;

        bools.Add(temp, path);

      }

      else
      {

        temp = false;
        bools.Add(temp, path);

      }

    }

    var treeOut = new DataTree<Polyline>();
    var coloursOutR = new DataTree<int>();
    var coloursOutG = new DataTree<int>();
    var coloursOutB = new DataTree<int>();
    //var coloursOut = new DataTree<System.Drawing.Color>();
    var rand = new Random(seed);

    for( int i = 0; i < bools.BranchCount; ++i )
    {

      var path = intersections.Path(i);

      coloursOutR.Add(rand.Next(0, 255), path);
      coloursOutG.Add(rand.Next(0, 255), path);
      coloursOutB.Add(rand.Next(0, 255), path);
      //coloursOut.Add( System.Drawing.Color.FromArgb( 255, rand.Next( 0, 255 ), rand.Next( 0, 255 ), rand.Next( 0, 255 ) ), path );

      for( int j = 0; j < bools.Branch(i).Count; ++j )
      {

        if( bools.Branch(i)[j] == true )
        {

          treeOut.Add(gridIn[j], path);

        }

      }

    }

    culledGrid = treeOut;
    R = coloursOutR;
    G = coloursOutG;
    B = coloursOutB;
    //R = coloursOut;
# ---------- end spacepartitionnoparallel ----------
number_slider = Slider(4051, range=0..10000)  # disabled
pointtoclosestpath = CSharpScript()  # -> xOut, yOut; inputs grid: tree of Point3d, point: Point3d; disabled
# ---------- pointtoclosestpath: C# ----------
    int branchCount = grid.BranchCount;

    double minDistance = double.MaxValue;

    CustomPair cp;

    GH_Path path = new GH_Path();

    for( int i = 0; i < branchCount; ++i )
    {

      for( int j = 0; j < grid.Branch(i).Count; ++j )
      {

        double localDistance = point.DistanceTo(grid.Branch(i)[j]);
        cp.Key = localDistance;
        cp.Path = new GH_Path(i, j);
        minDistance = Math.Min(minDistance, localDistance);

        if( ( cp.Key - minDistance ) < 0.001 )
        {

          path = cp.Path;

        }

      }

    }

    xOut = path.Indices[0];
    yOut = path.Indices[1];
# ---------- pointtoclosestpath: C# additional code ----------
  struct CustomPair
  {

    public double Key;
    public GH_Path Path;

  }
# ---------- end pointtoclosestpath ----------
pointtoclosestpath_2 = CSharpScript()  # -> xOut, yOut; inputs grid: tree of Point3d, point: Point3d; disabled; same code as pointtoclosestpath
missinggridcells = CSharpScript()  # -> missing, places; inputs culledGrid: list of Polyline, originalGrid: list of Polyline; disabled
# ---------- missinggridcells: C# ----------
    List<Polyline> polys = new List<Polyline>();

    var temp = new List<Polyline>();

    int place = 0;
    
    List<int> placesL = new List<int>();

    int oGridC = originalGrid.Count;
    int cGridC = culledGrid.Count;

    int iter = oGridC - cGridC;

    for( int i = 0; i < iter; ++i )
    {

      polys.Add(BailOut(originalGrid, culledGrid, out place));
      culledGrid.Insert(place, originalGrid[place]);
      placesL.Add( place );

    }

    missing = polys;

    places = placesL;
# ---------- missinggridcells: C# additional code ----------
  Polyline BailOut(List<Polyline> originalGrid, List<Polyline> culledGrid, out int place)
  {

    place = 0;

    int oGridC = originalGrid.Count;
    int cGridC = culledGrid.Count;

    int iter = oGridC - cGridC;

    var tempPoly = new Polyline();

    var polysOut = new Polyline[iter];

    var cCenters = new Point3d[oGridC];
    var oCenters = new Point3d[oGridC];

    var distances = new int[oGridC];

    for( int i = place + 1; i < oGridC; ++i )
    {

      oCenters[i] = AreaMassProperties.Compute(originalGrid[i].ToNurbsCurve()).Centroid;

      if( i < cGridC )

        cCenters[i] = AreaMassProperties.Compute(culledGrid[i].ToNurbsCurve()).Centroid;

      else
      {

        cCenters[i] = Point3d.Unset;

      }

      distances[i] = oCenters[i].CompareTo(cCenters[i]);

      if( distances[i] != 0 )
      {

        tempPoly = originalGrid[i];

        place = i;

        break;

      }

    }

    return tempPoly;

  }
# ---------- end missinggridcells ----------
pathfinding = CSharpScript(idx=pointtoclosestpath.xOut, idj=pointtoclosestpath.yOut, fidx=pointtoclosestpath_2.xOut, fjdx=pointtoclosestpath_2.yOut)  # -> points; inputs grid: tree of Point3d, idx: Int32, idj: Int32, fidx: Int32, fjdx: Int32; disabled
# ---------- pathfinding: C# ----------
    int branchCount = grid.BranchCount;
    int maxTreeBranchCount = grid.Branch(branchCount - 1).Count;

    int x = idx % branchCount, y = idj % maxTreeBranchCount;

    Point3d tempPoint = new Point3d();
    Point3d point = grid.Branch(x)[y];
    Point3d finalPoint = grid.Branch(fidx % branchCount)[fjdx % maxTreeBranchCount];
    List<Point3d> tempList = new List<Point3d>();
    double minDistance = double.MaxValue;
    //var keyValuePair = new KeyValuePair<double, Point3d>();

    tempList.Add(point);

    CustomPair customPair;

    GH_Path path = new GH_Path();

    while( tempPoint.CompareTo(finalPoint) != 0 )
    {

      for( int xx = x - 1; xx < x + 2; ++xx )
        //System.Threading.Tasks.Parallel.For(x - 1, x + 2, xx =>
      {

        for( int yy = y - 1; yy < y + 2; ++yy )
          //System.Threading.Tasks.Parallel.For(y - 1, y + 2, yy =>
        {

          if( xx >= 0 && xx < branchCount && yy >= 0 && yy < maxTreeBranchCount )
          {

            double localDistance = finalPoint.DistanceTo(grid.Branch(xx)[yy]);

            customPair.Key = localDistance;
            customPair.Value = grid.Branch(xx)[yy];
            customPair.Path = new GH_Path(xx, yy);

            minDistance = Math.Min(minDistance, localDistance);

            if( ( customPair.Key - minDistance ) < 0.01 )
            {

              tempPoint = customPair.Value;
              path = customPair.Path;

            }

          }

        }

      }

      x = path.Indices[0];
      y = path.Indices[1];

      tempList.Add(tempPoint);

    }

    Print("Path: " + path.ToString());

    points = tempList;
# ---------- pathfinding: C# additional code ----------
  struct CustomPair
  {

    public double Key;
    public Point3d Value;
    public GH_Path Path;

  }
# ---------- end pathfinding ----------
spacepartitionallparallel = CSharpScript()  # -> simplify(culledGrid); inputs voronoiIn: list of Curve, gridIn: list of Curve, areaIn: Double; disabled
# ---------- spacepartitionallparallel: C# ----------
    int voronoiCount = voronoiIn.Count;
    int gridCount = gridIn.Count;

    Curve[][][] tempJagged = new Curve[voronoiCount][][];
    bool[][] boolJagged = new bool[voronoiCount][];
    var treeOut = new DataTree<Curve>();

    bool temp = false;
    double area = 0.0;

    System.Threading.Tasks.Parallel.For( 0, voronoiCount, i =>
    {

      var path = new GH_Path(i);

      var voro = voronoiIn[i];

      tempJagged[i] = new Curve[gridCount][];
      boolJagged[i] = new bool[gridCount];

      System.Threading.Tasks.Parallel.For(0, gridCount, j =>
        {

        tempJagged[i][j] = Curve.CreateBooleanIntersection(voro, gridIn[j].ToNurbsCurve(), 1e-8);

        if( tempJagged[i][j].Length > 0 )
        {

          area = AreaMassProperties.Compute(tempJagged[i][j][0]).Area;

          temp = area < areaIn ? false : true;

          boolJagged[i][j] = temp;

        }

        else
        {

          boolJagged[i][j] = false;

        }

        });

    });
    
    for( int i = 0; i < boolJagged.Length; ++i )
      for( int j = 0; j < boolJagged[i].Length; ++j )
      {

        if( boolJagged[i][j] == true )
        {

          treeOut.Add(gridIn[j]);


        }

      }

    culledGrid = treeOut;
# ---------- end spacepartitionallparallel ----------
spacepartitioninternalparallel = CSharpScript()  # -> simplify(culledGrid); inputs voronoiIn: list of Curve, gridIn: list of Curve, areaIn: Double; disabled
# ---------- spacepartitioninternalparallel: C# ----------
    int voronoiCount = voronoiIn.Count;
    int gridCount = gridIn.Count;

    Curve[][][] tempJagged = new Curve[voronoiCount][][];
    bool[][] boolJagged = new bool[voronoiCount][];
    var treeOut = new DataTree<Curve>();

    bool temp = false;
    double area = 0.0;

    for( int i = 0; i < voronoiCount; ++i )
    {

      var path = new GH_Path(i);

      var voro = voronoiIn[i];

      tempJagged[i] = new Curve[gridCount][];
      boolJagged[i] = new bool[gridCount];

      System.Threading.Tasks.Parallel.For(0, gridCount, j =>
        {

        tempJagged[i][j] = Curve.CreateBooleanIntersection(voro, gridIn[j].ToNurbsCurve(), 1e-8);

        if( tempJagged[i][j].Length > 0 )
        {

          area = AreaMassProperties.Compute(tempJagged[i][j][0]).Area;

          temp = area < areaIn ? false : true;

          boolJagged[i][j] = temp;

        }

        else
        {

          boolJagged[i][j] = false;

        }

        });

      for( int j = 0; j < boolJagged[i].Length; ++j )
      {

        if( boolJagged[i][j] == true )
        {

          treeOut.Add(gridIn[j]);


        }

      }
      
    }

    culledGrid = treeOut;
# ---------- end spacepartitioninternalparallel ----------
parallelregionintersection = CSharpScript()  # -> out, A; inputs CurvesA: list of Curve, CurvesB: list of Curve; disabled
# ---------- parallelregionintersection: C# ----------
    Curve[][][] tempJagged = new Curve[CurvesA.Count][][];
    var treeOut = new List<Curve>();

    for( int i = 0; i < CurvesA.Count; ++i )
    {

      var voro = CurvesA[i];

      tempJagged[i] = new Curve[CurvesB.Count][];

      System.Threading.Tasks.Parallel.For(0, CurvesB.Count, j =>
        {

        tempJagged[i][j] = Curve.CreateBooleanIntersection(voro, CurvesB[j], 1e-3);

        });

      for( int j = 0; j < tempJagged[i].Length; ++j )
      {

        for( int k = 0; k < tempJagged[i][j].Length; ++k )
        {

          var path = new GH_Path(i);

          treeOut.Add(tempJagged[i][j][k]);


        }

      }

    }

    A = treeOut;
# ---------- end parallelregionintersection ----------
pline = PolyLine(Vertices=pathfinding, Closed=False)  # disabled

# ---- group: InputData / Labels
txt = Text(Tree({0;0}: ["Unidades sanitarias mujeres / privadas"], {0;1}: ["Unidades sanitarias hombres / privadas"], {0;2}: ["Cuarto de aseo "], {0;3}: ["Área de aseo de residuos"], {0;4}: ["Almacen General Insumos de Aseo "], {0;5}: ["Área de UPC-Rack"]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))

# ---- group: InputData / Topology
int = Integer(Tree({0}: [7], {1}: [7], {2}: [3], {3}: [2, 11], {4}: [16, 21, 19], {5}: [19]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))

# ---- group: InputData / ID
txt_2 = Text(Tree({0;0}: ["5"], {0;1}: ["5"], {0;2}: ["5"], {0;3}: ["5"], {0;4}: ["5"], {0;5}: ["5"]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))

# ---- group: InputData / Areas
txt_3 = Text(Tree({0;0}: ["3"], {0;1}: ["3"], {0;2}: ["6"], {0;3}: ["1"], {0;4}: ["5"], {0;5}: ["4"]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))

# ---- group: InputData
number_slider_2 = Slider(1, range=0..10)
path_mapper = PathMapper(txt, source="{A;B}", target="{A}")
path_mapper_2 = PathMapper(txt_3, source="{A;B}", target="{A}")
path_mapper_3 = PathMapper(int, source="{A;B}", target="{A}")
path_mapper_4 = PathMapper(txt_2, source="{A;B}", target="{A}")
prunebranches = CSharpScript(branches=path_mapper, howMany=number_slider_2)  # -> prunedTree, branchCounter; inputs branches: tree of String, howMany: Int32
# ---------- prunebranches: C# ----------
    var treeOut = new DataTree<string>();

    for( int i = 0; i < branches.BranchCount - howMany; ++i )
      treeOut.AddRange(branches.Branch(i), new GH_Path(i));

    prunedTree = treeOut;
    branchCounter = treeOut.BranchCount;
# ---------- end prunebranches ----------
prunebranches_2 = CSharpScript(branches=path_mapper_2, howMany=number_slider_2)  # -> prunedTree, branchCounter; inputs branches: tree of String, howMany: Int32; same code as prunebranches
ma = MassAddition(Input=prunebranches_2.prunedTree)  # -> Result, PartialResults
flatten = FlattenTree(Tree=prunebranches_2.prunedTree, Path="{0}")
lng = ListLength(List=flatten)
int_2 = Integer(Slider(4, range=0..10))

# ---- group: Grid / Controllers
number_slider_3 = Slider(20, range=0..21)
number_slider_4 = Slider(4, range=0..5)
number_slider_5 = Slider(6, range=0..10)  # disabled
number_slider_6 = Slider(1, range=0..30)  # disabled
division = Division(A=number_slider_3, B=number_slider_5)  # disabled
division_2 = Division(A=number_slider_4, B=number_slider_6)  # disabled
number_slider_7 = Slider(0, range=0..1)  # disabled

# ----
pt = Point(Point(-30.22731102, -18.72041778, 0))  # disabled
pt_2 = Point(Point(-23.83729354, 16.36997504, 0))  # disabled

# ---- group: Voronoi / Controllers
seedsx = GenePool(
    Decimals=4,
    Maximum=1,
    Minimum=0,
    Value=[0.742, 0.1905, 0.4605, 0.4738, 0.8605, 0.3496, 0.619, 0.501, 0.7766, 0.7323, 0.5204, 0.7815, 0.6354, 0.6776, 0.9687, 0.1304, 0.9018, 0.6519, 0.2035, 0.5871, 0.7827, 0.1536, 0.1608, 0.6868, 0.9138])
seedsy = GenePool(
    Decimals=4,
    Maximum=1,
    Minimum=0,
    Value=[0.9623, 0.212, 0.5811, 0.0839, 0.4559, 0.3962, 0.6995, 0.8896, 0.9355, 0.2295, 0.2249, 0.0609, 0.7309, 0.1816, 0.3498, 0.1315, 0.826, 0.0994, 0.6014, 0.4758, 0.9213, 0.3526, 0.0893, 0.4822, 0.7524])

# ----
number_slider_8 = Slider(1000, range=0..1000)  # disabled
number_slider_9 = Slider(0, range=0..1000)  # disabled
number_slider_10 = Slider(0, range=0..1000)  # disabled
number_slider_11 = Slider(8, range=0..10)
rgb = ColourRGB(Alpha=255, Red=number_slider_8, Green=number_slider_9, Blue=number_slider_10)  # disabled
number_slider_12 = Slider(5, range=0..10)  # disabled
num = Number(ma.Result)
number_slider_13 = Slider(0, range=0..10)
number_slider_14 = Slider(5.594, range=0..100)

# ---- group: SpacePartition / OriginalSilhouette
crv = Curve(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)

# ---- group: Spine
toggle = GroupToggle(ToggleActive=True, ToggleVisible=False)  # disabled
number_slider_15 = Slider(500, range=0..1000)  # disabled
crv_2 = Curve(crv)  # disabled
skeleton = MedialAxisSkeleton(CurveIn=crv_2, NumberOfSamples=number_slider_15)  # disabled
dupln = RemoveDuplicateLines(Lines=skeleton, Tolerance=0.01)  # disabled
inside = InsideOriginal(CurvesToCull=dupln, BoundaryCurve=crv)  # disabled
crv_3 = Curve(inside)  # disabled
cut = CutCorners(CurvesToSplit=crv_3)  # disabled
number_slider_16 = Slider(0.809, range=-10..10)  # disabled
offset = OffsetCurve(Curve=crv_2, Distance=number_slider_16, Plane=PlaneXY(0, 0, 0), Corners=1)  # disabled
intercull = IntersectionCulling(CurvesToCull=cut, BoundaryCurve=offset)  # disabled
reconstruct = ReconstructCurve(CurvesIn=intercull)  # disabled

# ---- group: SpacePartition / RandomColourSeed
number_slider_17 = Slider(40, range=0..100)
number_slider_18 = Slider(402, range=0..1000)
number_slider_19 = Slider(326, range=0..1000)

# ----
flatten_2 = FlattenTree(Tree=prunebranches_2.prunedTree, Path="{0}")

# ---- group: AddAreaForCirculation
multiplication = Multiplication(A=flatten_2, B=0.3)
addition = Addition(A=flatten_2, B=multiplication)  # -> simplify(Result)

# ----
panel = Panel("""0: Privado
1: Privado
2: Público
3: SemiPrivado""")
txt_4 = Text(prunebranches.prunedTree)
graft = GraftTree(Tree=panel, IncludeEmptyLists=True, IncludeNullItems=True)  # -> simplify(Tree)
graft_2 = GraftTree(Tree=txt_4, IncludeEmptyLists=True, IncludeNullItems=True)
addindextolabels = CSharpScript(labels=graft_2)  # -> indexedLabels; inputs labels: tree of String
# ---------- addindextolabels: C# ----------
    var newLabels = new DataTree<string>();
    
    for( int i = 0; i < labels.BranchCount; ++i )
      for( int j = 0; j < labels.Branch(i).Count; ++j )
      {
      
        newLabels.Add( i.ToString() + " " + labels.Branch(i)[j], new GH_Path(i) );
      
      }
    
    indexedLabels = newLabels;
# ---------- end addindextolabels ----------
galapagos = Galapagos(fitness=ma_2, gene=[seedsx, seedsy])

# ---- group: Perlin
number_slider_20 = Slider(22, range=0..100)  # disabled
number_slider_21 = Slider(4, range=0..10)  # disabled
number_slider_22 = Slider(0, range=0..100)  # disabled
number_slider_23 = Slider(4, range=0..10)  # disabled
dom = ConstructDomain(DomainStart=number_slider_22, DomainEnd=number_slider_21)  # disabled
genemodifier = GenePoolModifier(GeneList="Weights", Count=expr("x+1", number_slider_20), Domain=dom)  # disabled
number_slider_24 = Slider(4, range=0..10)  # disabled
number_slider_25 = Slider(69, range=0..1000)  # disabled
number_slider_26 = Slider(3.2, range=0..10)  # disabled
number_slider_27 = Slider(0.430667, range=0..1)  # disabled
number_slider_28 = Slider(13.910642, range=0..100)  # disabled
number_slider_29 = Slider(32.088268, range=0..100)  # disabled
knots = KnotVector(Count=expr("x+1", number_slider_20), Degree=number_slider_23, Periodic=False)  # disabled
weights = GenePool(Decimals=2, Maximum=4, Minimum=0, Value=[2, 2, 2, 2, 2, 2, 2, 2, 2, 2, 2, 2, 2, 2, 2, 2, 2, 2, 2, 2, 2, 2, 2])  # disabled
number_slider_30 = Slider(1000, range=0..1000)  # disabled
number_slider_31 = Slider(0, range=0..1000)  # disabled
number_slider_32 = Slider(0, range=0..1000)  # disabled
rgb_2 = ColourRGB(Alpha=255, Red=number_slider_30, Green=number_slider_31, Blue=number_slider_32)  # disabled
number_slider_33 = Slider(3.01, range=0..10)  # disabled

# ---- group: Voronoi
number_slider_34 = Slider(0, range=0..0.1)
subtraction = Subtraction(A=Slider(1, range=0..1), B=number_slider_34)
dom_2 = ConstructDomain(DomainStart=number_slider_34, DomainEnd=subtraction)
pt_3 = ConstructPoint(XCoordinate=seedsx, YCoordinate=seedsy, ZCoordinate=0)

# ----
genemodifier_2 = GenePoolModifier(GeneList="SeedsX", Count=lng, Domain=dom_2, Randomize=Button(), PercentageOfRandomization=Slider(1, range=0..1))
genemodifier_3 = GenePoolModifier(GeneList="SeedsY", Count=lng, Domain=dom_2, Randomize=Button(), PercentageOfRandomization=Slider(1, range=0..1))

# ---- group: Grid
dom_3 = ConstructDomain(DomainStart=expr("-x", number_slider_3), DomainEnd=number_slider_3)
dom_4 = ConstructDomain(DomainStart=expr("-x", number_slider_4), DomainEnd=number_slider_4)
pt_4 = Point(Point(-27.55069635, 0.2364199029, 0))
dedomain = DeconstructDomain(Domain=dom_3)  # -> Start, End
rectangle = Rectangle(Plane=pt_4, XSize=dom_4, YSize=dom_3, Radius=0)  # -> Rectangle, Length
crv_4 = Curve(rectangle.Rectangle)
ptsrfdomlen = SurfaceDomainLength(Surface=crv_4, ULength=division_2, VLength=division)  # disabled

# ---- group: Perlin (continued)
range = Range(Domain=dom_3, Steps=number_slider_20)  # disabled
perlinnoise = CSharpScript(x=range, fre=number_slider_26, amp=number_slider_27, iter=number_slider_24, t=number_slider_29, seed=number_slider_25)  # -> out, A; inputs x: Double, fre: Double, amp: Double, iter: Int32, t: Double, seed: Int32; disabled
# ---------- perlinnoise: C# ----------
    //time+=1e-7;
    
    A = fbm(new vec3(x, 0, 0) + t, fre, amp, iter, seed);
# ---------- perlinnoise: C# additional code ----------
  //double time = 0;
  
  double hash(double a, int seed)
  {

    //return fract(Math.Sin(a) * 4513.15);
    var rand = new Random( seed );
    return rand.NextDouble() * ( 1.0 + 1.0 ) - 1.0;

  }

  double noise(vec3 x, int seed)
  {

    vec3 p = x.floor();
    vec3 k = x.fract();

    k *= k * k * ( 3.0 - 2.0 * k );

    double n = p.X() + p.Y() * 57.0 + p.Z() * 113.0;

    double a = hash(n, seed);
    double b = hash(n + 1.0, seed);
    double c = hash(n + 57.0, seed);
    double d = hash(n + 58.0, seed);

    double e = hash(n + 113.0, seed);
    double f = hash(n + 114.0, seed);
    double g = hash(n + 170.0, seed);
    double h = hash(n + 171.0, seed);

    double res = vec3.mix(vec3.mix(vec3.mix(a, b, k.X()), vec3.mix(c, d, k.X()), k.Y()),
      vec3.mix(vec3.mix(e, f, k.X()), vec3.mix(g, h, k.X()), k.Y()),
      k.Z()
      );

    return res;

  }

  double fbm(vec3 f, double freq, double ampl, int iter, int seed)
  {

    double amp = 1.0, fre = 1.7, res = 0.0;

    for( int i = 0; i < iter; ++i )
    {

      amp *= ampl;
      fre *= freq;

      amp += amp;

      res += amp * noise(fre * f, seed);

    }

    return res;

  }

  class vec3
  {

    double x, y, z;

    public vec3(double x, double y, double z)
    {

      this.x = x;
      this.y = y;
      this.z = z;

    }

    public vec3(Point3d point)
    {

      this.x = point.X;
      this.y = point.Y;
      this.z = point.Z;

    }

    public double X()
    {

      return x;

    }

    public double Y()
    {

      return y;

    }

    public double Z()
    {

      return z;

    }

    // Addition operator overload.
    public static vec3 operator+( vec3 x, vec3 y )
    {

      return new vec3(x.X() + y.X(), x.Y() + y.Y(), x.Z() + y.Z());

    }

    public static vec3 operator+( vec3 x, double y )
    {

      return new vec3(x.X() + y, x.Y() + y, x.Z() + y);

    }

    public static vec3 operator+( double y, vec3 x )
    {

      return new vec3(y + x.X(), y + x.Y(), y + x.Z());

    }

    // Subtraction operator overload.
    public static vec3 operator-( vec3 x, vec3 y )
    {

      return new vec3(x.X() - y.X(), x.Y() - y.Y(), x.Z() - y.Z());

    }

    public static vec3 operator-( vec3 x, double y )
    {

      return new vec3(x.X() - y, x.Y() - y, x.Z() - y);

    }

    public static vec3 operator-( double y, vec3 x )
    {

      return new vec3(y - x.X(), y - x.Y(), y - x.Z());

    }

    // Multiplication operator overload.
    public static vec3 operator*( vec3 x, vec3 y )
    {

      return new vec3(x.X() * y.X(), x.Y() * y.Y(), x.Z() * y.Z());

    }

    public static vec3 operator*( vec3 x, double y )
    {

      return new vec3(x.X() * y, x.Y() * y, x.Z() * y);

    }

    public static vec3 operator*( double y, vec3 x )
    {

      return new vec3(y * x.X(), y * x.Y(), y * x.Z());

    }

    // Fractional part of a vec3.
    public vec3 fract()
    {

      return new vec3(fract(x), fract(y), fract(y));

    }

    // Floor.
    public vec3 floor()
    {

      return new vec3(Math.Floor(x), Math.Floor(y), Math.Floor(z));

    }

    // Fractional part of a double.
    public double fract(double x)
    {

      return x - Math.Truncate(x);

    }

    // Linear interpolation of a double.
    public static double mix(double a, double b, double c)
    {

      return a - ( 1 - c ) + b * c;

    }

    // Linear interpolation of a vec3.
    public static vec3 mix(vec3 a, vec3 b, double c)
    {

      double mixX = mix(a.X(), b.X(), c);
      double mixY = mix(a.Y(), b.Y(), c);
      double mixZ = mix(a.Z(), b.Y(), c);

      return new vec3(mixX, mixY, mixZ);

    }

    public Point3d toPoint()
    {

      return new Point3d(this.X(), this.Y(), this.Z());

    }

  }

  public double fract(double x)
  {

    return x - Math.Truncate(x);

  }
# ---------- end perlinnoise ----------
pt_5 = ConstructPoint(XCoordinate=perlinnoise.A, YCoordinate=range, ZCoordinate=0)  # disabled
item = ListItem(List=pt_5, Index=0, Wrap=True)  # disabled
Y = UnitY(Factor=dedomain.Start)  # disabled
move = Move(Geometry=pt_4, Motion=Y)  # -> Geometry, Transform; disabled
vec2pt = Vector2Pt(PointA=item, PointB=move.Geometry, Unitize=False)  # -> Vector, Length; disabled
move_2 = Move(Geometry=pt_5, Motion=vec2pt.Vector)  # -> Geometry, Transform; disabled
nurbcrv = NurbsCurvePWK(Points=move_2.Geometry, Weights=weights, Knots=knots)  # -> Curve, Length, Domain; disabled
previewlw = CustomPreviewLineweights(Geometry=nurbcrv.Curve, Shader=rgb_2, Thickness=number_slider_33, Absolute=False)  # disabled

# ----
ptsrfdomnum = SurfaceDomainNumber(Surface=crv_4, UNumber=Slider(3, range=0..100), VNumber=Slider(15, range=0..100))
closestptgrid = ClosestPointInGrid(Grid=ptsrfdomnum, Point=pt)  # -> ClosestPointInGrid, BranchOfGrid, LeafOfGrid; disabled
closestptgrid_2 = ClosestPointInGrid(Grid=ptsrfdomnum, Point=pt_2)  # -> ClosestPointInGrid, BranchOfGrid, LeafOfGrid; disabled
shortorto = ShortestPathOrthogonal(
    Grid=ptsrfdomnum,
    StartPointBranch=closestptgrid.BranchOfGrid,
    StartPointLeaf=closestptgrid.LeafOfGrid,
    EndPointBranch=closestptgrid_2.BranchOfGrid,
    EndPointLeaf=closestptgrid_2.LeafOfGrid)  # disabled

# ---- group: Voronoi (continued)
evalsrf = EvaluateSurface(Surface=reparameterize(crv_4), Point=pt_3)  # -> Point, Normal, UDirection, VDirection, Frame
pt_6 = Point(evalsrf.Point)
voronoi = Voronoi(Points=pt_6, Boundary=rectangle.Rectangle, BruteForceOverride=False)

# ----
panel_2 = Panel(pt_6)  # disabled

# ---- group: Grid (continued)
ptcrvatts = CurveAttraction(Grid=ptsrfdomnum, CrvAtts=nurbcrv.Curve, Magnitude=number_slider_7)  # -> Grid, Weights; disabled
ptborders = GenerateBorders(Grid=ptsrfdomnum, PanelShape=0)  # -> simplify(Border)
crv_5 = Curve(flatten(ptborders))
area = Area(Geometry=ptborders, UseTasks=False)  # -> Area, Centroid

# ---- group: Circulation
colom = CollisionOneMany(Collider=nurbcrv.Curve, Obstacles=graft(crv_5))  # -> Collision, Index; disabled
cull = CullPattern(List=crv_5, CullPattern=flatten(colom.Collision))  # disabled
pararunion = ParallelRegionUnion(Curves=cull)  # disabled
parallelregionintersection_2 = ParallelRegionIntersection(CurvesA=crv, CurvesB=pararunion)  # disabled
srf = Surface(parallelregionintersection_2)  # disabled
frgb = ColourRGBF(Alpha=1, Red=0, Green=0, Blue=0)  # disabled
preview = CustomPreview(Geometry=srf, Material=frgb)  # disabled

# ----
qt = QuadTree(Points=pt_6, Plane=PlaneXY(0, 0, 0), Square=False, Group=5)  # -> Quads, Points; disabled
qt_2 = QuadTree(Points=flatten(ptsrfdomnum), Plane=PlaneXY(0, 0, 0), Square=False, Group=5)  # -> Quads, Points; disabled
panel_3 = Panel(qt.Points)  # disabled
previewlw_2 = CustomPreviewLineweights(Geometry=shortorto, Shader=rgb, Thickness=number_slider_12, Absolute=False)  # disabled

# ---- group: ManhattanVoronoi
number_slider_35 = Slider(10, range=0..10)  # disabled
python = GhPythonScript(r=number_slider_35, P=evalsrf.Point)  # -> out, PL; inputs P: list of Point3d; disabled
# ---------- python: Python ----------
__author__ = "Paula"
__version__ = "2019.04.23"

import rhinoscriptsyntax as rs
from Rhino.Geometry import Point3d as P3
from Rhino.Geometry import Polyline as PLine

def taxicab_midnormal ( Point_1 = P3(0,0,0), Point_2 = P3(0,0,0) , leng = 10000):
    dx = abs(Point_1.X - Point_2.X)
    dy = abs(Point_1.Y - Point_2.Y)
    
    C = P3 ( ( Point_1.X + Point_2.X ) / 2, ( Point_1.Y + Point_2.Y ) / 2, ( Point_1.Z + Point_2.Z ) / 2)
    
    """ MPQN, in which M is on the lengeft(X-) or bottom(Y-) """
    P = P3 (0,0,C.Z)
    Q = P3 (0,0,C.Z)
    M = P3 (0,0,C.Z)
    N = P3 (0,0,C.Z)
    
    if dx > dy:
        P.Y = C.Y + dy / 2
        Q.Y = C.Y - dy / 2
        M.Y = P.Y + leng
        N.Y = Q.Y - leng
        if bool(Point_1.Y > Point_2.Y) ^ bool(Point_1.X > Point_2.X):
            P.X = C.X + dy / 2
            Q.X = C.X - dy / 2
        else:
            P.X = C.X - dy / 2
            Q.X = C.X + dy / 2
        M.X = P.X
        N.X = Q.X
    else:
        if dx < dy:
            P.X = C.X + dx / 2
            Q.X = C.X - dx / 2
            M.X = P.X + leng
            N.X = Q.X - leng
            if bool(Point_1.Y > Point_2.Y) ^ bool(Point_1.X > Point_2.X):
                P.Y = C.Y + dx / 2
                Q.Y = C.Y - dx / 2
            else:
                P.Y = C.Y - dx / 2
                Q.Y = C.Y + dx / 2
            M.Y = P.Y
            N.Y = Q.Y
        else:
            if bool(Point_1.Y > Point_2.Y) ^ bool(Point_1.X > Point_2.X):
                P.Y = C.Y - dx / 2
                Q.Y = C.Y + dx / 2
                P.X = C.X - dy / 2
                Q.X = C.X + dy / 2
                M.Y = P.Y - leng
                M.X = P.X - leng
                N.Y = Q.Y + leng
                N.X = Q.X + leng
            else:
                P.Y = C.Y - dx / 2
                Q.Y = C.Y + dx / 2
                P.X = C.X + dy / 2
                Q.X = C.X - dy / 2
                M.Y = P.Y - leng
                M.X = P.X + leng
                N.Y = Q.Y + leng
                N.X = Q.X - leng

    return rs.AddPolyline( [M , P , Q , N] )

def taxicab_circle ( point = P3(0,0,0), r = 1 ):
    A = P3( point.X + r, point.Y, point.Z )
    B = P3( point.X, point.Y + r, point.Z )
    C = P3( point.X - r, point.Y, point.Z )
    D = P3( point.X, point.Y - r, point.Z )
    return rs.AddPolyline( [A, B, C, D, A] )

l = 2 * r

""" PL = taxicab_midnormal ( A, B, r ) """

pts = P

polylines = []
for i in range( len( P ) ):
    polylines.append(taxicab_circle( P[i], l ))

for i in range(len(polylines)):
    for j in range(i):
        if i == j:
            continue
        if rs.CurveBooleanUnion( [ polylines[i], polylines[j] ] ):
            MN = taxicab_midnormal( pts[i], pts[j], l )
            
            ccx = rs.CurveCurveIntersection( polylines[i], MN )
            if ccx is None:
                continue
            if ccx[0][0] == 2:
                continue
            para_a = [ ccx[0][5], ccx[1][5] ]
            para_b = [ ccx[0][7], ccx[1][7] ]
            
            if para_b[0] > para_b[1]:
                para_b = [ para_b[1], para_b[0] ]
            
            probable_dash = rs.SplitCurve(polylines[i], para_a)
            edge = rs.TrimCurve(MN, para_b, False )
            edgepts = rs.CurvePoints(edge)
            
            for crv in probable_dash:
                crvpts = rs.CurvePoints(crv)
                if rs.PointCompare( crvpts[0], edgepts[0] ):
                    crvpts.reverse()
                newpl = rs.AddPolyline( edgepts + crvpts )
                if rs.PointInPlanarClosedCurve( pts[i], newpl ):
                    polylines[i] = newpl
                    break
            
            
            ccx = rs.CurveCurveIntersection( polylines[j], MN )
            if ccx is None:
                continue
            para_a = [ ccx[0][5], ccx[1][5] ]
            para_b = [ ccx[0][7], ccx[1][7] ]
            
            if para_b[0] > para_b[1]:
                para_b = [ para_b[1], para_b[0] ]
            
            probable_dash = rs.SplitCurve(polylines[j], para_a)
            edge = rs.TrimCurve(MN, para_b, False )
            edgepts = rs.CurvePoints(edge)
            
            for crv in probable_dash:
                crvpts = rs.CurvePoints(crv)
                if rs.PointCompare( crvpts[0], edgepts[0] ):
                    crvpts.reverse()
                newpl = rs.AddPolyline( edgepts + crvpts )
                if rs.PointInPlanarClosedCurve( pts[j], newpl ):
                    polylines[j] = newpl
                    break
    

PL = polylines
# ---------- end python ----------
rint = RegionIntersection(CurvesA=python.PL)  # disabled
crv_6 = Curve(rint)  # disabled
srf_2 = Surface(crv_6)  # disabled

# ----
crv_7 = Curve(voronoi)
bang = ExplodeTree(Data=qt.Points)  # -> Branch0, Branch1, Branch2, Branch3, Branch4, Branch5, Branch6, Branch7, Branch8, Branch9; disabled
srf_3 = Surface(crv_7)
pt_7 = Point(bang.Branch3)  # disabled
area_2 = Area(Geometry=crv_5, UseTasks=False)  # -> Area, Centroid
sort = SortList(Keys=area_2.Area, ValuesA=area_2.Area)  # -> Keys, ValuesA; disabled
lng_2 = ListLength(List=sort.ValuesA)  # disabled
subtraction_2 = Subtraction(A=lng_2, B=1)  # disabled
item_2 = ListItem(List=area_2.Area, Index=Slider(0, range=0..50), Wrap=True)
multiplication_2 = Multiplication(A=item_2, B=Slider(0.6, range=0..1))
pt_8 = Point(pt_6)
c_script = CSharpScript(VoroPoints=pt_6, x=number_slider_13, y=number_slider_14)  # -> out, A; inputs VoroPoints: list of Point3d, x: Double, y: Double, z: Double, u: Double
# ---------- c_script: C# usings ----------
using Grasshopper.Kernel.Geometry;
# ---------- c_script: C# ----------
    DataTree<Point3d> pointTree = new DataTree<Point3d>();
    DataTree<int> topoTree = new DataTree<int>();

    Node2List node2List = new Node2List(VoroPoints);
    Node2Tree node2Tree = node2List.CreateTree(0.0, false, 10);

    GH_Path path = new GH_Path();

    for( int i = 0; i < node2List.Count; ++i )
    {

      path = new GH_Path(i);

      //Print(node2List[i].ToString());

      Node2Proximity node2Proximity = new Node2Proximity( node2List[i], i, 5, x, y );
      node2Tree.SolveProximity( node2Proximity );
      Print( node2Proximity.CurrentCount.ToString() );

      //Print(node2Proximity.MaximumCount.ToString());

      if( node2Proximity.CurrentCount != 0 )
      {

        Print("YES");

        //List<int> enu = node2Proximity.get_IndexList().GetEnumerator();

        List<int> enu = node2Proximity.IndexList;//.GetEnumerator();

        for( int j = 0; j < enu.Count; ++j )
        {

          topoTree.Add(enu[j], path);

        }

      }

    }

    A = topoTree;
# ---------- end c_script ----------
prox = Proximity2D(Points=pt_6, Plane=PlaneXY(0, 0, 0), Group=5, MinRadius=number_slider_13, MaxRadius=number_slider_14)  # -> Links, Topology
spctopo = SpaceTopology(Curves=voronoi, ParallelComputing=Toggle(True))
qt_3 = QuadTree(Points=pt_6, Plane=PlaneXY(0, 0, 0), Square=False, Group=5)  # -> Quads, Points
c_script_2 = CSharpScript(VoroPoints=pt_6, x=number_slider_13, y=number_slider_14)  # -> out, A; inputs VoroPoints: list of Point3d, x: Double, y: Double, z: Double, u: Double
# ---------- c_script_2: C# ----------
    DataTree<GH_Curve> curveTree = new DataTree<GH_Curve>();
    DataTree<int> topoTree = new DataTree<int>();

    Grasshopper.Kernel.Geometry.Node2List node2List = new Grasshopper.Kernel.Geometry.Node2List(VoroPoints);
    Grasshopper.Kernel.Geometry.Node2Tree node2Tree = node2List.CreateTree(0.0, false, 5);

    var leafAction_Outline = new LeafAction_Outline( curveTree, Plane.WorldXY );
    node2Tree.PerformAction( leafAction_Outline, false );
    
    DataTree<GH_Point> pointTree = new DataTree<GH_Point>();
    var leafAction_Points = new LeafAction_Points( node2List, pointTree, Plane.WorldXY );
    node2Tree.PerformAction( leafAction_Points, false );
    
    A = pointTree;
# ---------- c_script_2: C# additional code ----------
  public class LeafAction_Outline : Grasshopper.Kernel.Geometry.Node2Leaf.ILeafAction
  {
    private DataTree<GH_Curve> boxes;

    private Transform x_form;

    public LeafAction_Outline(DataTree<GH_Curve> box_list, Plane plane)
    {
      this.boxes = box_list;
      this.x_form = Transform.ChangeBasis(plane, Plane.WorldXY);
    }

    public Grasshopper.Kernel.Geometry.Node2Leaf.VorLeafRecursionResult LeafAction(Grasshopper.Kernel.Geometry.Node2Leaf Leaf)
    {
      Polyline polyline = new Polyline();
      polyline.Add(Leaf.x_min, Leaf.y_min, 0.0);
      polyline.Add(Leaf.x_max, Leaf.y_min, 0.0);
      polyline.Add(Leaf.x_max, Leaf.y_max, 0.0);
      polyline.Add(Leaf.x_min, Leaf.y_max, 0.0);
      polyline.Add(Leaf.x_min, Leaf.y_min, 0.0);
      PolylineCurve polylineCurve = new PolylineCurve(polyline);
      polylineCurve.Transform(this.x_form);
      GH_Curve gH_Curve = new GH_Curve(polylineCurve);
      this.boxes.Add(gH_Curve);
      return 0;
    }
  }
  
  public class LeafAction_Points : Grasshopper.Kernel.Geometry.Node2Leaf.ILeafAction
  {
    private DataTree<GH_Point> points;

    private Grasshopper.Kernel.Geometry.Node2List nodes;

    private GH_Path m_path;

    private Transform x_form;

    public LeafAction_Points(Grasshopper.Kernel.Geometry.Node2List nodelist, DataTree<GH_Point> point_list, Plane plane)
    {
      this.m_path = new GH_Path(-1);
      this.nodes = nodelist;
      this.points = point_list;
      this.x_form = Transform.ChangeBasis(plane, Plane.WorldXY);
    }

    public Grasshopper.Kernel.Geometry.Node2Leaf.VorLeafRecursionResult LeafAction(Grasshopper.Kernel.Geometry.Node2Leaf Leaf)
    {
//      var path = new GH_Path();
//      path.
      if (Leaf != null)
      {
        this.m_path = new GH_Path(checked(this.m_path.Indices[0] + 1));
        //try
        {
          List<int>.Enumerator enumerator = Leaf.Nodes.GetEnumerator();
          while (enumerator.MoveNext())
          {
            int current = enumerator.Current;
            Grasshopper.Kernel.Geometry.Node2 node = this.nodes[current];
            Point3d point3d = new Point3d(node.x, node.y, 0.0);
            point3d.Transform(this.x_form);
            this.points.Add(new GH_Point(point3d), this.m_path);
          }
        }
        //finally
        {
          //List<int>.Enumerator enumerator;
          //((IDisposable) enumerator).Dispose();
        }
      }
      return 0;
    }
  }
# ---------- end c_script_2 ----------
linetopo = LineTopology(PointTree=graft(pt_8), Topology=spctopo)
linetopo_2 = LineTopology(PointTree=graft(pt_8), Topology=c_script.A)
panel_4 = Panel(qt_3.Points)
panel_5 = Panel(c_script.A)

# ---- group: SpacePartition
spacepartition = SpacePartition(VoronoiIn=crv_7, GridIn=crv_5, AreaIn=multiplication_2, Tolerance=Slider(0.001, range=0..0.001))
sortxy = SortPointsXY(Grid=flatten(spacepartition))
pararunion_2 = ParallelRegionUnion(Curves=spacepartition)
missing = MissingGridCells(CulledGrid=flatten(sortxy), OriginalGrid=crv_5)
mgtree = MergeTreeMissing(CulledGrid=pararunion_2, MissingGridCells=missing)
pararunion_3 = ParallelRegionUnion(Curves=mgtree)
parallelregionintersection_3 = ParallelRegionIntersection(CurvesA=crv, CurvesB=pararunion_3)
lng_3 = ListLength(List=flatten(parallelregionintersection_3))
dom_5 = ConstructDomain(DomainStart=Slider(0, range=0..100), DomainEnd=Slider(255, range=0..1000))
random = Random(Range=dom_5, Number=lng_3, Seed=[number_slider_17, number_slider_18, number_slider_19], Integers=True)
bang_2 = ExplodeTree(Data=random)  # -> Branch0, Branch1, Branch2
number_slider_36 = Slider(241, range=0..255)
rgb_3 = ColourRGB(Alpha=Slider(10, range=0..10), Red=bang_2.Branch0, Green=bang_2.Branch1, Blue=bang_2.Branch2)  # disabled
rgb_4 = ColourRGB(
    Alpha=number_slider_36,
    Red=bang_2.Branch0,
    Green=[55, 209, 59, 216, 1, 112, 142, 1, 76, 111, 92, 58, 62, 60, 197, 158, 67, 19, 183, 163, 50, 202, 112, 182, 111],
    Blue=[9, 120, 163, 36, 100, 115, 248, 253, 79, 124, 119, 250, 189, 19, 44, 159, 229, 29, 128, 139, 34, 211, 22, 234, 166])  # disabled
srf_4 = Surface(parallelregionintersection_3)
preview_2 = CustomPreview(Geometry=graft(srf_3), Material=graft(rgb_3))  # disabled

# ----
rgb_5 = ColourRGB(Alpha=number_slider_36, Red=expr("x*2", bang_2.Branch1), Green=expr("x*0.5", bang_2.Branch1), Blue=0)

# ---- group: SpacePartition (continued)
preview_3 = CustomPreview(Geometry=srf_4, Material=graft(rgb_5))

# ---- group: CalculateThresholdOfArea
area_3 = Area(Geometry=parallelregionintersection_3, UseTasks=False)  # -> simplify(flatten(Area)), simplify(Centroid)
null = NullItem(Item=area_3.Area)  # -> NullFlags, InvalidFlags, Description
expression = Expression(x=null.InvalidFlags, y=area_3.Area, Expression="If( True, y, 1000 )")
expression_2 = Expression(x=addition, y=expression, Expression="Abs( x - y ) * 0.1")

# ----
c_script_3 = CSharpScript(AreaTree=area_3.Area)  # disabled
flatten_3 = FlattenTree(Tree=area_3.Area, Path="{0}")
lng_4 = ListLength(List=flatten_3)
expression_3 = Expression(x=lng_4, y=lng, Expression="If( x ≠ y, 1000, 0 )")
tag = TextTag(Location=area_3.Centroid, Text=addindextolabels)

# ---- group: CalculateThresholdOfArea (continued)
ma_2 = MassAddition(Input=flatten([expression_3, expression_2]))  # -> Result, PartialResults

# ----
screentext = ScreenOrientedText(
    Text=addindextolabels,
    Font="Interstate",
    Justification=8,
    Location=area_3.Centroid,
    SizeFactor=Slider(6.961, range=0..100),
    Color=RGB(255, 255, 255),
    Depth=0,
    Absolute=False)
panel_6 = Panel(ma_2.Result)

# ---- group: TakeScreenShotIterations
toggle_2 = GroupToggle(ToggleActive=True, ToggleVisible=False)  # disabled
panel_7 = Panel("C:\Users\Paula\Desktop\Felipe\GenerativeFloorPlan\Images\VideoTres\")
data = Data(flatten([seedsx, seedsy]))
takescreenshot = CSharpScript(
    Run=Toggle(True),
    Reset=Button(),
    Fitness=ma_2.Result,
    Min=Slider(0, range=0..1),
    Max=Slider(20, range=0..20),
    GalapagosSliders=flatten(data),
    Path=panel_7,
    ImageName="VideoTres")  # -> out; inputs Run: Boolean, Reset: Boolean, Fitness: Double, Min: Double, Max: Double, GalapagosSliders: list of Double, Path: String, ImageName: String
# ---------- takescreenshot: C# ----------
    string pather = Path + ImageName + counter.ToString();

    GH_Document ghDocument = Component.OnPingDocument();

    if(ghDocument.IsModified && Run == true )
    {

      if( Fitness >= Min && Fitness <= Max  )
      {

        Rhino.RhinoApp.RunScript("_-ScreenCaptureToFile " + pather, true);

        counter++;

      }

    }

    if(Reset == true) counter = 0;

    Print(pather);
# ---------- takescreenshot: C# additional code ----------
  int counter = 0;
# ---------- end takescreenshot ----------
panel_8 = Panel(takescreenshot)
